# Grasshopper definition ExcelToBubbleDiagram.ghx (Grasshopper 1.0.8)
# plug-ins: Pufferfish, LunchBox

instruction = Panel("Step1: Copy File Path")
panel = Panel("\"C:\\Users\\Kevin\\Documents\\Senior Design\\Treadway Build\\Program_ExcelToGrasshopper_Test.xlsm\"")

# ---- group: Excel Doc Reader
# Copy File Path for Excel Doc & Paste Here: "C:\Users\Kevin\Documents\Senior Design\Treadway Build\Program_ExcelToGrasshopper_Test.xlsm"
panel_2 = Panel("\"")
turn_to_true_to_read = BooleanToggle(True)
split = TextSplit(Text=panel, Separators=panel_2)
item = ListItem(List=split, Index=1, Wrap=True)
what_sheet_is_the_info_on = Panel("ProgramInfo")
excel_file_path = FilePath(item)
excelread = ExcelReader(
    ReadExcelData=turn_to_true_to_read,
    WorkbookPath=excel_file_path,
    WorksheetName=what_sheet_is_the_info_on,
    DataStruct=False)  # -> Exceptions, ColumnHeaderNames, ExcelData
mindex = MemberIndex(Set=excelread.ExcelData, Member="0")  # -> Index, Count
cull_i = CullIndex(List=excelread.ExcelData, Indices=mindex.Index, Wrap=True)
panel_3 = Panel(excelread.ColumnHeaderNames)
panel_4 = Panel(cull_i)
panel_5 = Panel(excelread.Exceptions)

# ----
flip = FlipMatrix(Data=excelread.ExcelData)
panel_6 = Panel("""37
78
79
143
144
147
150""")

# ----
# Color RGB
panel_7 = Panel("Color RGB")
keysearch = KeyValueSearch(Keys=excelread.ColumnHeaderNames, Values=flip, Search=panel_7)  # -> flatten(Result)

# ----
# Dept No
panel_8 = Panel("Dept No")
keysearch_2 = KeyValueSearch(Keys=excelread.ColumnHeaderNames, Values=flip, Search=panel_8)  # -> flatten(Result)

# ----
# Conn. Primary
panel_9 = Panel("Conn. Primary")
keysearch_3 = KeyValueSearch(Keys=excelread.ColumnHeaderNames, Values=flip, Search=panel_9)  # -> flatten(Result)

# ----
# Room Qty/ Units
panel_10 = Panel("Room Qty/ Units")
keysearch_4 = KeyValueSearch(Keys=excelread.ColumnHeaderNames, Values=flip, Search=panel_10)  # -> flatten(Result)

mindex_2 = MemberIndex(Set=keysearch_4, Member="0")  # -> Index, Count

panel_11 = Panel(mindex_2.Index)

cull_i_2 = CullIndex(List=keysearch_4, Indices=mindex_2.Index, Wrap=False)
panel_12 = Panel(cull_i_2)
ma = MassAddition(Input=cull_i_2)  # -> Result, PartialResults
total_of_rooms = Panel(ma.Result)

# ----
# Program Element
panel_13 = Panel("Program Element")
keysearch_5 = KeyValueSearch(Keys=excelread.ColumnHeaderNames, Values=flip, Search=panel_13)  # -> flatten(Result)
cull_i_3 = CullIndex(List=keysearch_5, Indices=mindex_2.Index, Wrap=True)  # -> simplify(List)
panel_14 = Panel(cull_i_3)
repeat = RepeatData(Data=graft(cull_i_3), Length=graft(cull_i_2))  # -> simplify(Data)

# ---- group: Size Square
# Net SF/ Units
panel_15 = Panel("Net SF/ Units")
keysearch_6 = KeyValueSearch(Keys=excelread.ColumnHeaderNames, Values=flip, Search=panel_15)  # -> flatten(Result)
cull_i_4 = CullIndex(List=keysearch_6, Indices=mindex_2.Index, Wrap=True)  # -> simplify(List)
panel_16 = Panel(cull_i_4)
repeat_2 = RepeatData(Data=graft(cull_i_4), Length=graft(cull_i_2))  # -> simplify(Data)

# ----
cull_i_5 = CullIndex(List=keysearch, Indices=mindex_2.Index, Wrap=True)  # -> simplify(List)
panel_17 = Panel(cull_i_5)
repeat_3 = RepeatData(Data=graft(cull_i_5), Length=simplify(graft(cull_i_2)))  # -> simplify(Data)
pdecon = Deconstruct(Point=flatten(repeat_3))  # -> XComponent, YComponent, ZComponent
rgb = ColourRGB(Alpha=255, Red=pdecon.XComponent, Green=pdecon.YComponent, Blue=pdecon.ZComponent)

cull_i_6 = CullIndex(List=keysearch_2, Indices=mindex_2.Index, Wrap=True)  # -> simplify(List)
panel_18 = Panel(cull_i_6)
repeat_4 = RepeatData(Data=graft(cull_i_6), Length=graft(cull_i_2))  # -> simplify(Data)

cull_i_7 = CullIndex(List=keysearch_3, Indices=mindex_2.Index, Wrap=True)  # -> simplify(List)
panel_19 = Panel(cull_i_7)
repeat_5 = RepeatData(Data=graft(cull_i_7), Length=graft(cull_i_2))  # -> simplify(Data)
fsim = FindSimilarMember(Data=flatten(repeat_5), Set=flatten(repeat_4))  # -> Hit, Index

# ---- group: Size Square
# Size Circle
pi = Pi(Factor=1)
division = Division(A=repeat_2, B=pi)
sqrt = SquareRoot(Value=division)  # -> flatten(Result)

sqrt_2 = SquareRoot(Value=repeat_2)  # -> flatten(Result)

# ----
flatten_tree = FlattenTree(Tree=repeat, Path="{0}")

# ---- group: Shift list to multiple distribution
bounds = Bounds(Numbers=panel_12)
deconstruct_domain = DeconstructDomain(Domain=bounds)  # -> Start, End
series = Series(Start=0, Step=1, Count=deconstruct_domain.End)
repeat_6 = RepeatData(Data=series, Length=simplify(cull_i_2))  # -> simplify(Data)
addition = Addition(A=flatten(repeat_6), B=fsim.Index)

# ----
panel_20 = Panel(flatten_tree)

# ---- group: Label Largest Size
replace_members = ReplaceMembers(Set=repeat_2, Find=0)
concatenate = Concatenate(FragmentA=flatten(replace_members), FragmentB=" sq.ft")
len = TextLength(Text=repeat_4)
len_2 = TextLength(Text=repeat)
len_3 = TextLength(Text=concatenate)
maximum = Maximum(A=flatten(len), B=flatten(len_2))
maximum_2 = Maximum(A=maximum, B=len_3)
division_2 = Division(A=sqrt, B=flatten(maximum_2))
multiplication = Multiplication(A=division_2, B=2)

# ----
# Floor #
keysearch_7 = KeyValueSearch(Keys=excelread.ColumnHeaderNames, Values=flip, Search="Flr")  # -> flatten(Result)
cull_i_8 = CullIndex(List=keysearch_7, Indices=mindex_2.Index, Wrap=True)  # -> simplify(List)
panel_21 = Panel(cull_i_8)
# Color RGB
# Floor #
repeat_7 = RepeatData(Data=graft(cull_i_8), Length=simplify(graft(cull_i_2)))  # -> simplify(Data)

bounds_2 = Bounds(Numbers=flatten(repeat_7))
deconstruct_domain_2 = DeconstructDomain(Domain=bounds_2)  # -> Start, End

series_2 = Series(Start=1, Step=1, Count=deconstruct_domain_2.End)
total_of_flrs = Panel(deconstruct_domain_2.End)
equals = Equality(FirstNumber=simplify(graft(series_2)), SecondNumber=flatten(repeat_7))  # -> Equality, Inequality
dispatch = Dispatch(List=flatten(repeat_2), DispatchPattern=simplify(equals.Equality))  # -> ListA, ListB
ma_2 = MassAddition(Input=simplify(dispatch.ListA))  # -> Result, PartialResults
total_sq_ft_per_flr = Panel(ma_2.Result)
ma_3 = MassAddition(Input=flatten(ma_2.Result))  # -> Result, PartialResults
total_sq_ft = Panel(ma_3.Result)

equals_2 = Equality(FirstNumber=simplify(graft(series_2)), SecondNumber=flatten(panel_21))  # -> Equality, Inequality

of_per_col_of_prog = Slider(3, range=1..5)
series_3 = Series(Start=0, Step=1, Count=of_per_col_of_prog)
repeat_list = Integer(cull_i_2)
radii_of_room = Number(sqrt)
dispatch_2 = Dispatch(List=flatten(repeat_list), DispatchPattern=simplify(equals_2.Equality))  # -> ListA, ListB
dispatch_3 = Dispatch(List=flatten(radii_of_room), DispatchPattern=simplify(equals.Equality))  # -> ListA, ListB
bnd = Bounds(Numbers=flatten(dispatch_3.ListA))
dedomain = DeconstructDomain(Domain=bnd)  # -> Start, End
bnd_2 = Bounds(Numbers=dispatch_2.ListA)
multiplication_2 = Multiplication(A=dedomain.End, B=2)
lng = ListLength(List=dispatch_2.ListA)
dedomain_2 = DeconstructDomain(Domain=bnd_2)  # -> Start, End
series_4 = Series(Start=0, Step=1, Count=simplify(dispatch_2.ListA))
division_3 = Division(A=multiplication_2, B=2)

bounds_3 = Bounds(Numbers=series_3)
deconstruct_domain_3 = DeconstructDomain(Domain=bounds_3)  # -> Start, End
addition_2 = Addition(A=Slider(5, range=1..5), B=deconstruct_domain_3.End)
x_minus_one = XMinusOne(NumberX=series_2)
multiplication_3 = Multiplication(A=addition_2, B=multiplication_2)
multiplication_4 = Multiplication(A=multiplication_3, B=x_minus_one)
unit_y = UnitY(Factor=multiplication_4)
point = Point(Point(0, 0, 0))
move = Move(Geometry=point, Motion=unit_y)  # -> Geometry, Transform
xy = XYPlane(Origin=move.Geometry)

recgrid = Rectangular(
    Plane=simplify(flatten(xy)),
    SizeX=multiplication_2,
    SizeY=multiplication_2,
    ExtentX=simplify(flatten(lng)),
    ExtentY=simplify(flatten(dedomain_2.End)))  # -> Cells, Points
item_2 = ListItem(List=simplify(recgrid.Cells), Index=simplify(series_4), Wrap=True)  # -> simplify(Item)
lng_2 = ListLength(List=item_2)  # -> flatten(Length)
lng_3 = ListLength(List=lng_2)
repeat_8 = RepeatData(Data=series_3, Length=graft(lng_3))  # -> simplify(Data)
repeat_9 = RepeatData(Data=graft(repeat_8), Length=graft(dispatch_2.ListA))  # -> simplify(Data)
multiplication_5 = Multiplication(A=repeat_9, B=division_3)  # -> simplify(Result)
Y = UnitY(Factor=multiplication_5)
move_2 = Move(Geometry=item_2, Motion=Y)  # -> simplify(Geometry), Transform
shift_paths = ShiftPaths(Data=move_2.Geometry, Offset=-1)

# ---- group: Based on Combined Prog Area
x_minus_one_2 = XMinusOne(NumberX=deconstruct_domain_2.End)
x_minus_one_3 = XMinusOne(NumberX=deconstruct_domain_2.End)
series_5 = Series(Start=0, Step=1, Count=x_minus_one_2)
square_root = SquareRoot(Value=ma_2.Result)
series_6 = Series(Start=0, Step=1, Count=x_minus_one_3)
list_item = ListItem(List=flatten(move.Geometry), Index=series_5, Wrap=True)
deconstruct = Deconstruct(Point=list_item)  # -> XComponent, YComponent, ZComponent
list_item_2 = ListItem(List=flatten(square_root), Index=series_6, Wrap=True)
scale_factor = Slider(1.5, range=1..2)
addition_3 = Addition(A=list_item_2, B=deconstruct.YComponent)
multiplication_6 = Multiplication(A=addition_3, B=scale_factor)
construct_point = ConstructPoint(XCoordinate=deconstruct.XComponent, YCoordinate=multiplication_6, ZCoordinate=deconstruct.ZComponent)
merge = Merge(Data1=list_item, Data2=construct_point)
rectangle = Rectangle(Plane=merge, XSize=flatten(square_root), YSize=flatten(square_root), Radius=0)  # -> Rectangle, Length
scale = Scale(Geometry=rectangle.Rectangle, Center=merge, Factor=scale_factor)  # -> Geometry, Transform

# ----
panel_22 = Panel(shift_paths)

radii_of_rm_per_flr = Number(dispatch_3.ListA)
size_of_text = Number(multiplication)
prgm_name = Text(repeat)
rect_cells = Geometry(shift_paths)
rm_sqft_text = Text(concatenate)
dept_text = Text(repeat_4)
conn_index = Integer(addition)
rgb_2 = Colour(rgb)

dispatch_4 = Dispatch(List=flatten(conn_index), DispatchPattern=simplify(equals.Equality))  # -> ListA, ListB
dispatch_5 = Dispatch(List=flatten(dept_text), DispatchPattern=simplify(equals.Equality))  # -> ListA, ListB
dispatch_6 = Dispatch(List=flatten(prgm_name), DispatchPattern=simplify(equals.Equality))  # -> ListA, ListB
dispatch_7 = Dispatch(List=flatten(size_of_text), DispatchPattern=simplify(equals.Equality))  # -> ListA, ListB
dispatch_8 = Dispatch(List=flatten(rgb_2), DispatchPattern=simplify(equals.Equality))  # -> ListA, ListB
dispatch_9 = Dispatch(List=flatten(rm_sqft_text), DispatchPattern=simplify(equals.Equality))  # -> ListA, ListB

# ---- group: Program Grid Placement
area = Area(Geometry=rect_cells)  # -> Area, Centroid
cir = Circle(Plane=flatten(area.Centroid), Radius=simplify(flatten(radii_of_rm_per_flr)))
boundary = BoundarySurfaces(Edges=cir)

# ---- group: Text arrangement
multiplication_7 = Multiplication(A=dispatch_7.ListA, B=Slider(1, range=0.25..1))
negative = Negative(Value=multiplication_7)
unit_y_2 = UnitY(Factor=negative)
unit_y_3 = UnitY(Factor=multiplication_7)
move_3 = Move(Geometry=area.Centroid, Motion=unit_y_3)  # -> Geometry, Transform
move_4 = Move(Geometry=area.Centroid, Motion=unit_y_2)  # -> Geometry, Transform

# ----
list_item_3 = ListItem(List=flatten(dept_text), Index=flatten(dispatch_4.ListA), Wrap=True)
fsim_2 = FindSimilarMember(Data=list_item_3, Set=flatten(dispatch_5.ListA))  # -> Hit, Index
addition_4 = Addition(A=flatten(repeat_6), B=fsim_2.Index)

# ---- group: Lines
item_3 = ListItem(List=flatten(area.Centroid), Index=addition_4, Wrap=True)
ln = Line(StartPoint=flatten(area.Centroid), EndPoint=flatten(item_3))  # -> simplify(Line)

# ----
preview = CustomPreview(Geometry=ln, Material=flatten(dispatch_8.ListA))
preview_2 = CustomPreview(Geometry=boundary, Material=flatten(dispatch_8.ListA))
tag = TextTag3D(Location=move_3.Geometry, Text=dispatch_5.ListA, Size=dispatch_7.ListA, Colour=dispatch_8.ListA, Justification=8)
tag_2 = TextTag3D(Location=area.Centroid, Text=dispatch_6.ListA, Size=dispatch_7.ListA, Colour=dispatch_8.ListA, Justification=5)
tag_3 = TextTag3D(Location=move_4.Geometry, Text=dispatch_9.ListA, Size=dispatch_7.ListA, Colour=dispatch_8.ListA, Justification=2)

rm_sqft_text_per_flr = Text(dispatch_9.ListA)
radii_of_room_per_flr = Number(radii_of_rm_per_flr)
dept_text_per_flr = Text(dispatch_5.ListA)
conn_index_per_flr = Integer(dispatch_4.ListA)
size_of_text_per_flr = Number(dispatch_7.ListA)
prgm_name_per_flr = Text(dispatch_6.ListA)
program_pts_per_flr = Point(area.Centroid)
conn_lines_per_flr = Curve(ln)
rgb_per_flr = Colour(dispatch_8.ListA)
prgm_areas = Number(repeat_2)
floor_vetor = Vector(unit_y)
crv = Curve(<curve referenced from the Rhino model>)

# ----
# Bubble Diagram Constrained
move_5 = Move(Geometry=crv, Motion=floor_vetor)  # -> Geometry, Transform

tree_branch = TreeBranch(Tree=simplify(graft(scale.Geometry)), MaintainPaths=True)

neg = Negative(Value=simplify(radii_of_room_per_flr))
offset = OffsetCurve(Curve=graft(scale.Geometry), Distance=neg, Corners=1)
shift_paths_2 = ShiftPaths(Data=simplify(offset), Offset=-1)
xy_2 = XYPlane(Origin=Point(0, 0, 0))
cpc = CurvePointCollide(Points=program_pts_per_flr, Curve=shift_paths_2, Plane=xy_2, Interior=Toggle(True), Strength=Slider(1, range=0.01..50))

item_4 = ListItem(List=radii_of_room_per_flr, Index=conn_index_per_flr, Wrap=True)
addition_5 = Addition(A=radii_of_room_per_flr, B=item_4)
multiplication_8 = Multiplication(A=simplify(addition_5), B=Slider(1.01, range=0..1.01))
length_line = LengthLine(Line=conn_lines_per_flr, Length=flatten(multiplication_8), Strength=Slider(0.005, range=0..2))

collider = Collider(Objects=program_pts_per_flr, Radii=radii_of_room_per_flr, Strength=Slider(2, range=0.01..50))

merge_2 = Merge(Data1=simplify(flatten(cpc)), Data2=simplify(flatten(collider)), Data3=simplify(flatten(length_line)))
bouncysolver = BouncySolver(
    GoalObjects=merge_2,
    Reset=Button(),
    Threshold=1e-15,
    Tolerance=0.0001,
    Damping=Slider(0.95, range=0..1),
    Iterations=Slider(10, range=1..10),
    On=Toggle(False))  # -> I, V, O

null_item = NullItem(Item=bouncysolver.V)  # -> NullFlags, InvalidFlags, Description
member_index = MemberIndex(Set=null_item.InvalidFlags, Member=Toggle(True))  # -> Index, Count
dispatch_10 = Dispatch(List=bouncysolver.V, DispatchPattern=null_item.InvalidFlags)  # -> ListA, ListB
point_list = PointList(Points=bouncysolver.V, Size=Slider(5, range=1..5))
panel_23 = Panel(member_index.Index)
list_length = ListLength(List=dispatch_10.ListA)
null_pts = Panel(list_length)

multiplication_9 = Multiplication(A=size_of_text_per_flr, B=Slider(1, range=0.25..1))
negative_2 = Negative(Value=multiplication_9)
unit_y_4 = UnitY(Factor=negative_2)
move_6 = Move(Geometry=bouncysolver.V, Motion=flatten(unit_y_4))  # -> Geometry, Transform

dispatch_11 = Dispatch(List=flatten(conn_index), DispatchPattern=simplify(equals.Equality))  # -> ListA, ListB
list_item_4 = ListItem(List=flatten(dept_text), Index=flatten(dispatch_11.ListA), Wrap=True)
fsim_3 = FindSimilarMember(Data=list_item_4, Set=flatten(dispatch_5.ListA))  # -> Hit, Index
addition_6 = Addition(A=flatten(repeat_6), B=fsim_3.Index)
item_5 = ListItem(List=flatten(bouncysolver.V), Index=addition_6, Wrap=True)
ln_2 = Line(StartPoint=flatten(bouncysolver.V), EndPoint=flatten(item_5))  # -> simplify(Line)

length = Length(Curve=ln_2)
subtraction = Subtraction(A=length, B=flatten(addition_5))
bounds_4 = Bounds(Numbers=subtraction)
deconstruct_domain_4 = DeconstructDomain(Domain=bounds_4)  # -> Start, End
gradient = Gradient(
    LowerLimit=0,
    UpperLimit=deconstruct_domain_4.End,
    Parameter=subtraction,
    stops=[0: RGB(0, 128, 0), 0.5: RGB(255, 255, 0), 1: RGB(255, 0, 0)])

mass_addition = MassAddition(Input=subtraction)  # -> Result, PartialResults
list_item_5 = ListItem(List=flatten(program_pts_per_flr), Index=panel_6, Wrap=True)

cir_2 = Circle(Plane=flatten(bouncysolver.V), Radius=simplify(flatten(radii_of_room_per_flr)))
boundary_2 = BoundarySurfaces(Edges=cir_2)

panel_24 = Panel(mass_addition.Result)

unit_y_5 = UnitY(Factor=multiplication_9)
move_7 = Move(Geometry=bouncysolver.V, Motion=flatten(unit_y_5))  # -> Geometry, Transform

ma_4 = MassAddition(Input=flatten(prgm_areas))  # -> Result, PartialResults
area_2 = Area(Geometry=scale.Geometry)  # -> Area, Centroid
round = Round(Number=area_2.Area)  # -> Nearest, Floor, Ceiling
round_2 = Round(Number=ma_4.Result)  # -> Nearest, Floor, Ceiling
concat = Concatenate(FragmentA=round_2.Ceiling, FragmentB=" sq ft")
concat_2 = Concatenate(FragmentA=round.Ceiling, FragmentB=" sq ft")
sq_ft_of_all_program = Panel(concat)
sq_ft_of_constraining_crv = Panel(concat_2)

preview_3 = CustomPreview(Geometry=boundary_2, Material=flatten(rgb_per_flr))
preview_4 = CustomPreview(Geometry=ln_2, Material=flatten(gradient))
tag_4 = TextTag3D(
    Location=move_7.Geometry,
    Text=flatten(dept_text_per_flr),
    Size=flatten(size_of_text_per_flr),
    Colour=flatten(rgb_per_flr),
    Justification=8)
tag_5 = TextTag3D(
    Location=bouncysolver.V,
    Text=flatten(prgm_name_per_flr),
    Size=flatten(size_of_text_per_flr),
    Colour=flatten(rgb_per_flr),
    Justification=5)
tag_6 = TextTag3D(
    Location=move_6.Geometry,
    Text=flatten(rm_sqft_text_per_flr),
    Size=flatten(size_of_text_per_flr),
    Colour=flatten(rgb_per_flr),
    Justification=2)
