# Grasshopper definition Space Syntax Modeling_0.3.gh (Grasshopper 1.0.8)
# plug-ins: Pufferfish, Human, LunchBox

# ---- group: GH_ExcelReader
panel = Panel("\"C:\\Users\\jtreadway\\OneDrive - HKS Inc\\HKS Collaborative\\Grasshopper\\Program\\ExcelToGrasshopper\\Program_ExcelToGrasshopper_Test.xlsm\"")
split = TextSplit(Text=panel, Separators="\"")
item = ListItem(List=split, Index=1, Wrap=True)
path = FilePath(item)
excelread = ExcelReader(ReadExcelData=Toggle(True), WorkbookPath=path, WorksheetName="Sheet2", DataStruct=False)  # -> Exceptions, ColumnHeaderNames, ExcelData
mindex = MemberIndex(Set=excelread.ExcelData, Member="0")  # -> Index, Count
cull_i = CullIndex(List=excelread.ExcelData, Indices=mindex.Index, Wrap=True)
panel_2 = Panel(excelread.ColumnHeaderNames)
panel_3 = Panel(cull_i)
panel_4 = Panel(excelread.Exceptions)

# "C:\Users\jhtwa\OneDrive - HKS Inc\HKS Collaborative\Grasshopper\Program\ExcelToGrasshopper\Program_ExcelToGrasshopper_Test.xlsm"
# "C:\Users\jo562116\OneDrive - University of Central Florida\UCF\00_Tenure-Track\Year 3\26Su\Research\HKS Collaborative\Grasshopper\Program\ExcelToGrasshopper\Program_ExcelToGrasshopper_Test.xlsm"
flip = FlipMatrix(Data=excelread.ExcelData)

# ---- group: Claude Code_V0.3.0 / Component 01_Excel Reader
panel_5 = Panel("\"C:\\Users\\jtreadway\\OneDrive - HKS Inc\\HKS Collaborative\\Grasshopper\\Program\\ExcelToGrasshopper\\Program_ExcelToGrasshopper_Test.xlsm\"")
split_2 = TextSplit(Text=panel_5, Separators="\"")
item_2 = ListItem(List=split_2, Index=1, Wrap=True)
sheet_name = Panel("Sheet2")
path_2 = FilePath(item_2)
comp01_reader = Python3Script(xlsx_path=path_2, sheet_name=sheet_name, header_row=Slider(1, range=0..5), skip_zero=Toggle(True), run=Toggle(True))  # -> out, uid, label, dept, dept_raw, area, floor, floor_pref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; inputs xlsx_path: String, sheet_name: String, header_row: Int32, skip_zero: Boolean, run: Boolean
#   port floor: Floor number (nan floors coerced to 1).
# ---------- comp01_reader: Python ----------
#! python3
# r: openpyxl
# ==============================================================================
# COMPONENT 01  |  PROGRAM READER  (Excel -> Room Instances)
# ------------------------------------------------------------------------------
# Rhino 8 / Grasshopper CPython script component.
# Reads Sheet2 of the program .xlsm, cleans it, explodes Qty into individual
# room instances, and wires directed adjacency pairwise-by-index. Emits flat,
# index-aligned lists that Component 02 (bubble solver) consumes.
#
# ------------------------------------------------------------------------------
# INPUTS  (set Type Hint + Access exactly as noted; right-click each param)
#   xlsx_path   : str   | Item   | Full path to the .xlsm program file.
#   sheet_name  : str   | Item   | Worksheet to read. Default "Sheet2".
#   header_row  : int   | Item   | 1-based row holding the column headers. Default 1.
#   skip_zero   : bool  | Item   | True -> drop rows whose Qty == 0. Default True.
#   run         : bool  | Item   | Toggle to (re)read the file. Default True.
#
# OUTPUTS (all List Access, index-aligned 1:1 across the room outputs)
#   uid         : str   | List   | Stable instance id "{DeptNo}#{i}"  (unique).
#   label       : str   | List   | Display label "{DeptNo} {ProgramElement} (i/N)".
#   dept        : int   | List   | Leading dept token before first dot (7.10 -> 7).
#   dept_raw    : str   | List   | Original Dept No string, preserved for labels.
#   area        : float | List   | Net SF per single instance (NOT x Qty).
#   floor       : int   | List   | LEGACY floor number (blank coerced to 1).
#                                  Kept so the existing Comp02 wiring keeps
#                                  working during the floor-assignment refactor.
#                                  RETIRED at Stage 2 -- use floor_pref instead.
#   floor_pref  : int   | List   | Floor PREFERENCE. 0 = no preference (blank /
#                                  non-numeric / <=0 cell). A positive value is a
#                                  requested floor, honoured as the primary
#                                  consideration by the Comp03 floor assigner but
#                                  overflowable (down first, then up) when the
#                                  plate runs out of capacity.
#   color       : Colour| List   | System.Drawing.Color from "R, G, B".
#   shared_out  : bool  | List   | Shared Access flag: room connects directly to
#                                  its adjacency parent (no corridor door). Reads
#                                  the optional "Shared Access" column; TRUE/X/yes
#                                  -> True. Absent column -> all False.
#                                  NOTE: output param is named 'shared_out' to
#                                  avoid colliding with the internal read.
#   adj_source  : str   | List   | uid of THIS room (edge tail).
#   adj_target  : str   | List   | uid of the Conn.Primary room (edge head).
#                                  Wired pairwise-by-index, clamped to target N.
#   depts       : int   | List   | Sorted unique dept tokens (passthrough for 02/03).
#   info        : str   | Item   | Diagnostics string (counts, skips, warnings).
#
# ------------------------------------------------------------------------------
# CONVENTIONS / GOTCHAS (CPython Rhino 8)
#   - "#! python3" shebang required on line 1.
#   - Set geometry/type hints on the params; do not rely on .Item[j] indexers.
#   - openpyxl ships with Rhino 8 CPython; if missing, info reports it cleanly.
#   - Qty explodes ALL attributes N times (area is per-instance, unchanged).
#   - Adjacency is directed: source PULLS toward target (see Comp 02).
#   - Pairwise wiring: instance #k of A -> instance #min(k, Nb-1) of B.
# ==============================================================================

import System
import math

# ---- import openpyxl defensively -------------------------------------------
_OPENPYXL_OK = True
_OPENPYXL_ERR = ""
try:
    import openpyxl
except Exception as e:
    _OPENPYXL_OK = False
    _OPENPYXL_ERR = str(e)


# ---- helpers ---------------------------------------------------------------
def _s(v):
    """Cell -> clean string ('' for None)."""
    if v is None:
        return ""
    if isinstance(v, float) and math.isnan(v):
        return ""
    return str(v).strip()


def _num(v, default=None):
    """Cell -> float, tolerant of strings/blanks; returns default on failure."""
    if v is None:
        return default
    if isinstance(v, (int, float)):
        if isinstance(v, float) and math.isnan(v):
            return default
        return float(v)
    txt = str(v).strip().replace(",", "")
    if txt == "":
        return default
    try:
        return float(txt)
    except ValueError:
        return default


def _dept_token(dept_raw):
    """Leading numeric token before the first dot. '7.10'->7, '1.1.2'->1."""
    txt = _s(dept_raw)
    if txt == "":
        return -1
    head = txt.split(".")[0]
    try:
        return int(head)
    except ValueError:
        return -1


def _parse_color(rgb_text):
    """'168, 174, 73' -> System.Drawing.Color. Falls back to mid-grey."""
    txt = _s(rgb_text)
    try:
        parts = [int(float(p.strip())) for p in txt.split(",")]
        if len(parts) >= 3:
            r, g, b = (max(0, min(255, parts[k])) for k in range(3))
            return System.Drawing.Color.FromArgb(255, r, g, b)
    except Exception:
        pass
    return System.Drawing.Color.FromArgb(255, 128, 128, 128)


def _is_white(rgb_text):
    """Spacer rows carry 255,255,255."""
    txt = _s(rgb_text)
    try:
        parts = [int(float(p.strip())) for p in txt.split(",")]
        return len(parts) >= 3 and parts[0] == 255 and parts[1] == 255 and parts[2] == 255
    except Exception:
        return False


# ---- column resolution (tolerant of trailing spaces / minor renames) -------
def _find_col(headers, *candidates):
    norm = {h.strip().lower(): i for i, h in enumerate(headers)}
    for cand in candidates:
        key = cand.strip().lower()
        if key in norm:
            return norm[key]
    # loose contains-match fallback
    for cand in candidates:
        key = cand.strip().lower()
        for h, i in norm.items():
            if key in h:
                return i
    return -1


# ---- main ------------------------------------------------------------------
uid = []
label = []
dept = []
dept_raw = []
area = []
floor = []
floor_pref = []
color = []
shared_out = []
adj_source = []
adj_target = []
depts = []
info = ""

_warn = []


def _build():
    global info
    lines = []

    if not _OPENPYXL_OK:
        return ("ERROR: openpyxl unavailable in this CPython env.\n{}\n"
                "FIX: ensure line 2 of this script reads  # r: openpyxl  then re-solve\n"
                "(first solve downloads it; needs PyPI access). Manual fallback:\n"
                "  <rhino-python.exe> -m pip install openpyxl").format(_OPENPYXL_ERR)

    path = _s(xlsx_path) if 'xlsx_path' in globals() and xlsx_path else ""
    if path == "":
        return "Waiting: no xlsx_path supplied."

    sheet = _s(sheet_name) if 'sheet_name' in globals() and sheet_name else "Sheet2"
    hrow = int(header_row) if ('header_row' in globals() and header_row) else 1
    do_skip_zero = True if ('skip_zero' not in globals() or skip_zero is None) else bool(skip_zero)

    try:
        wb = openpyxl.load_workbook(path, data_only=True, keep_vba=True, read_only=True)
    except Exception as e:
        return "ERROR loading workbook: {}".format(e)

    if sheet not in wb.sheetnames:
        return "ERROR: sheet '{}' not found. Available: {}".format(sheet, ", ".join(wb.sheetnames))

    ws = wb[sheet]
    rows = list(ws.iter_rows(values_only=True))
    if len(rows) < hrow:
        return "ERROR: sheet has fewer rows than header_row."

    headers = [_s(h) for h in rows[hrow - 1]]
    c_dept = _find_col(headers, "Dept No")
    c_name = _find_col(headers, "Program Element")
    c_qty = _find_col(headers, "Room Qty/ Units", "Room Qty", "Qty")
    c_net = _find_col(headers, "Net SF/ Units", "Net SF")
    c_conn = _find_col(headers, "Conn. Primary", "Conn Primary", "Conn")
    c_flr = _find_col(headers, "Flr", "Floor")
    c_rgb = _find_col(headers, "Color RGB", "RGB")
    c_shared = _find_col(headers, "Shared Access", "SharedAccess", "Shared")

    missing = [n for n, i in [("Dept No", c_dept), ("Program Element", c_name),
                              ("Qty", c_qty), ("Net SF", c_net),
                              ("Conn.Primary", c_conn)] if i < 0]
    if missing:
        return "ERROR: missing columns: {}".format(", ".join(missing))

    # ---- PASS 1: clean rows into records ----------------------------------
    records = []          # dict per surviving source row
    n_white = 0
    n_zero = 0
    n_blank = 0
    for r in rows[hrow:]:
        d_raw = _s(r[c_dept]) if c_dept < len(r) else ""
        name = _s(r[c_name]) if c_name < len(r) else ""
        if d_raw == "" and name == "":
            n_blank += 1
            continue
        rgb_txt = _s(r[c_rgb]) if (c_rgb >= 0 and c_rgb < len(r)) else ""
        if _is_white(rgb_txt):
            n_white += 1
            continue
        qty = _num(r[c_qty], 0) if c_qty < len(r) else 0
        qty = int(qty) if qty is not None else 0
        if do_skip_zero and qty <= 0:
            n_zero += 1
            continue
        if qty <= 0:
            qty = 1
        net = _num(r[c_net], 0.0) if c_net < len(r) else 0.0
        conn = _s(r[c_conn]) if c_conn < len(r) else ""
        # Floor is now a PREFERENCE, not an assignment. A blank / non-numeric /
        # non-positive cell means "no preference" -> 0, and Comp03's assigner is
        # free to place the room wherever capacity and affinity put it. The
        # legacy 'floor' output still coerces blank to 1 so the existing Comp02
        # wiring keeps solving until Stage 2 retires it.
        flr_raw = _num(r[c_flr], None) if (c_flr >= 0 and c_flr < len(r)) else None
        try:
            pref = int(flr_raw) if flr_raw is not None else 0
        except (ValueError, TypeError):
            pref = 0
        if pref < 0:
            pref = 0
        flr = 1 if flr_raw is None else int(flr_raw)
        col = _parse_color(rgb_txt)
        tok = _dept_token(d_raw)
        # Shared Access: TRUE/X marks a room that connects DIRECTLY to its
        # adjacency parent (restroom -> classroom) with no corridor door.
        # Absent column -> all False (everyone gets a corridor door).
        shared_txt = _s(r[c_shared]) if (c_shared >= 0 and c_shared < len(r)) else ""
        shared = shared_txt.strip().lower() in ("true", "x", "yes", "1", "shared")
        records.append(dict(d_raw=d_raw, name=name, qty=qty, net=net,
                            conn=conn, flr=flr, pref=pref, col=col, tok=tok,
                            shared=shared))

    if not records:
        return "ERROR: no usable rows after cleaning."

    # ---- PASS 2: explode Qty into instances -------------------------------
    # instances_by_dept: raw dept string -> ordered list of uids.
    # A Dept No string can legitimately repeat in the source (Excel collapsed
    # "7.10" -> "7.1", so two different rooms share "7.1"). Duplicate uids would
    # corrupt every name-based lookup downstream, so we disambiguate the SECOND
    # and later occurrences with a group-letter suffix on the uid namespace
    # ("7.1", then "7.1b", "7.1c", ...). The display label is untouched.
    instances_by_dept = {}
    inst = []              # ordered list of instance dicts
    _seen_dept_rows = {}   # d_raw -> how many source rows have used it
    _dupe_notes = []
    for rec in records:
        base = rec["d_raw"]
        seen = _seen_dept_rows.get(base, 0)
        _seen_dept_rows[base] = seen + 1
        if seen == 0:
            key = base                                   # first occurrence keeps the clean key
        else:
            key = "{}{}".format(base, chr(ord('a') + seen))  # 7.1 -> 7.1b, 7.1c...
            _dupe_notes.append("'{}' row #{} -> uid namespace '{}' ({})".format(
                base, seen + 1, key, rec["name"]))
        n = rec["qty"]
        ids = []
        for k in range(n):
            u = "{}#{}".format(key, k)
            ids.append(u)
            inst.append(dict(uid=u, d_raw=base, name=rec["name"],
                             net=rec["net"], flr=rec["flr"], pref=rec["pref"],
                             col=rec["col"],
                             tok=rec["tok"], conn=rec["conn"], idx=k, qty=n,
                             shared=rec["shared"]))
        instances_by_dept[key] = list(ids)
        # also register under the clean base for adjacency lookups that target
        # the department string; first occurrence wins as the canonical target.
        if base not in instances_by_dept:
            instances_by_dept[base] = list(ids)

    # ---- PASS 3: wire directed adjacency, pairwise-by-index ---------------
    unresolved = []
    for it in inst:
        tgt_dept = _s(it["conn"])
        if tgt_dept == "" or tgt_dept == "0":
            continue
        tgt_list = instances_by_dept.get(tgt_dept, None)
        if not tgt_list:
            unresolved.append("{} -> {}".format(it["uid"], tgt_dept))
            continue
        j = it["idx"] if it["idx"] < len(tgt_list) else (len(tgt_list) - 1)
        adj_source.append(it["uid"])
        adj_target.append(tgt_list[j])

    # ---- emit room lists (index-aligned) ----------------------------------
    dept_set = set()
    for it in inst:
        n = it["qty"]
        uid.append(it["uid"])
        label.append("{} {} ({}/{})".format(it["d_raw"], it["name"], it["idx"] + 1, n))
        dept.append(it["tok"])
        dept_raw.append(it["d_raw"])
        area.append(float(it["net"]))
        floor.append(int(it["flr"]))
        floor_pref.append(int(it["pref"]))
        color.append(it["col"])
        shared_out.append(bool(it["shared"]))
        dept_set.add(it["tok"])

    for d in sorted(dept_set):
        depts.append(d)

    lines.append("Component 01 | Program Reader")
    lines.append("Source rows kept : {}".format(len(records)))
    lines.append("Room instances   : {}".format(len(inst)))
    lines.append("Adjacency edges  : {}".format(len(adj_source)))
    lines.append("Departments      : {}".format(", ".join(str(d) for d in sorted(dept_set))))
    lines.append("Skipped -> white spacers: {}, qty=0: {}, blank: {}".format(n_white, n_zero, n_blank))
    if _dupe_notes:
        lines.append("NOTE duplicate Dept No disambiguated ({}):".format(len(_dupe_notes)))
        for dn in _dupe_notes:
            lines.append("  " + dn)
    if unresolved:
        lines.append("WARN unresolved adj targets ({}) [target skipped as qty=0 or absent]:".format(len(unresolved)))
        lines.append("  " + "; ".join(unresolved[:12]) + (" ..." if len(unresolved) > 12 else ""))
    # ---- floor PREFERENCE diagnostics -------------------------------------
    # Reports the pinned demand per floor (net SF) and the free pool. Comp03's
    # assigner compares this against plate capacity, so these numbers are what
    # you calibrate floor_efficiency against.
    if c_flr < 0:
        lines.append("Floor column     : ABSENT -> all rooms unpinned (no preference)")
    pref_sf = {}
    pref_ct = {}
    for it in inst:
        p = int(it["pref"])
        pref_sf[p] = pref_sf.get(p, 0.0) + float(it["net"])
        pref_ct[p] = pref_ct.get(p, 0) + 1
    n_pinned = sum(v for k, v in pref_ct.items() if k > 0)
    lines.append("Floor preference : {} pinned / {} unpinned (0 = free to place)".format(
        n_pinned, pref_ct.get(0, 0)))
    for p in sorted(pref_sf):
        tag = "no pref" if p == 0 else "floor {}".format(p)
        lines.append("  {:<10}: {:>4} rooms, {:>10,.0f} net SF".format(
            tag, pref_ct[p], pref_sf[p]))
    lines.append("  {:<10}: {:>4} rooms, {:>10,.0f} net SF".format(
        "TOTAL", len(inst), sum(pref_sf.values())))
    return "\n".join(lines)


# gate on run toggle
_do_run = True if ('run' not in globals() or run is None) else bool(run)
if _do_run:
    info = _build()
else:
    info = "Idle: set run=True to read the program file."
# ---------- end comp01_reader ----------
txt = Text(comp01_reader.uid)
num = Number(comp01_reader.area)
bool = Boolean(comp01_reader.shared_out)
panel_6 = Panel(comp01_reader.info)
panel_7 = Panel(comp01_reader.out)
int = Integer(comp01_reader.dept)
txt_2 = Text(comp01_reader.adj_target)
int_2 = Integer(comp01_reader.depts)
txt_3 = Text(comp01_reader.label)
txt_4 = Text(comp01_reader.dept_raw)
int_3 = Integer(comp01_reader.floor)
col = Colour(comp01_reader.color)
txt_5 = Text(comp01_reader.adj_source)

# ----
int_4 = Integer(comp01_reader.floor_pref)

# ---- group: Claude Code_V0.3.0
panel_8 = Panel("feet")
comp02_bubblesolver = Python3Script(
    uid=txt,
    area=num,
    color=col,
    label=txt_3,
    dept=int,
    adj_source=txt_5,
    adj_target=txt_2,
    depts=int_2,
    unit_system=panel_8,
    iterations=Slider(1000, range=100..1000),
    k_adj=Slider(0.08, range=0..1),
    k_repel=Slider(1, range=0..1),
    pad=Slider(1, range=1..3),
    seed=Slider(20, range=0..100),
    run=Toggle(True))  # -> out, centers, circles, radii, labels, colors, uid_out, dept_out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; inputs uid: list of String, area: list of Double, color: list of Color, label: list of String, dept: list of Int32, adj_source: list of String, adj_target: list of String, depts: list of Int32, unit_system: String, iterations: Int32, deoverlap_iters: Int32, k_adj: Double, k_repel: Double, pad: Double, seed: Int32, run: Boolean
# ---------- comp02_bubblesolver: Python ----------
#! python3
# ==============================================================================
# COMPONENT 02  |  BUBBLE DIAGRAM SOLVER  (force relaxation, single cloud)
# ------------------------------------------------------------------------------
# Rhino 8 / Grasshopper CPython script component.
# Consumes the flat room lists from Component 01 and relaxes them into ONE
# non-overlapping bubble diagram. Adjacency pulls (directed) draw a room toward
# its Conn.Primary target; a repulsion term prevents overlap.
#
# FLOORS ARE NOT KNOWN HERE. This component solves the program as a single
# global adjacency cloud; Component 03 assigns rooms to floors from that cloud
# using floor preference + plate capacity + proximity/adjacency/dept affinity.
# Because there are no floors, the old floor-cohesion term (k_floor), the
# per-floor repulsion grouping, and the STACKED/SEPARATED view offsets are all
# gone -- along with the cross-floor "pull as if stacked" workaround they
# required. Floor separation now begins in Component 03.
#
# ------------------------------------------------------------------------------
# INPUTS
#   uid          : str   | List | from Comp 01 (index-aligned room lists)
#   area         : float | List | Net SF per instance
#   color        : Colour| List | per instance
#   NOTE: the old 'floor' input is GONE. Floor preference travels straight from
#         Comp01 'floor_pref' to Comp03; it plays no part in the bubble solve.
#         Delete the floor / separated_view / spread_axis / floor_gap / k_floor
#         params from the component -- leaving them wired is harmless but dead.
#   label        : str   | List | per instance
#   dept         : int   | List | per instance (passthrough)
#   adj_source   : str   | List | edge tails  (uid)
#   adj_target   : str   | List | edge heads  (uid)
#   depts        : int   | List | passthrough for Comp 03
#
#   unit_system  : str   | Item | "feet" or "meters" -- units the AREAS/inputs are in
#   iterations   : int   | Item | fixed relaxation steps. Default 400.
#   deoverlap_iters : int| Item | hard de-overlap sweeps after main solve.
#                                  Default 300. Raised from 120 because the cloud
#                                  is now global (denser) rather than per-floor;
#                                  120 leaves ~0.03 ft residual on 151 rooms.
#                                  Raise further if info reports "CAP HIT".
#   k_adj        : float | Item | adjacency spring stiffness. Default 0.08
#   k_repel      : float | Item | overlap repulsion stiffness. Default 0.85
#   pad          : float | Item | min gap between bubble edges (unit_system). Default 2.0
#   seed         : int   | Item | RNG seed for initial layout. Default 42
#   run          : bool  | Item | solve toggle
#
# ------------------------------------------------------------------------------
# OUTPUTS  (SINGLE BRANCH {0} -- one global cloud, no floors)
#   centers   : Point3d | Tree | bubble centers (Rhino units)
#   circles   : Circle  | Tree | bubble circles for display
#   radii     : float   | Tree | bubble radii (Rhino units)
#   labels    : str     | Tree | labels, branch-aligned to centers
#   colors    : Colour  | Tree | colors, branch-aligned
#   uid_out   : str     | Tree | uids, branch-aligned (name-based lookups downstream)
#   dept_out  : int     | Tree | dept token, branch-aligned
#   env_rect  : Rect(Curve)| Tree | bounding rectangle of the whole cloud
#   adj_lines : Line    | Tree | adjacency connectors (single branch)
#   depts     : int     | List | passthrough (sorted unique dept tokens)
#   max_overlap : float | Item | worst residual bubble overlap (input units).
#                                 ~0 means clean. Watch this before Part 2.
#   info      : str     | Item | diagnostics
#
# ------------------------------------------------------------------------------
# CONVENTIONS / GOTCHAS
#   - "#! python3" required. Rhino.Geometry types throughout.
#   - Type hints: uid/label str, area float, color Colour (List Access).
#   - Areas convert unit_system -> Rhino file unit via a scale factor so bubble
#     radii are in true model units. r = sqrt(area_model / pi).
#   - Repulsion is now GLOBAL (all pairs) rather than grouped per floor, so the
#     pair count rises from sum(n_f^2)/2 to n^2/2. On 151 rooms that is ~1.8x the
#     work per iteration; drop 'iterations' if the solve feels slow.
#   - use int(math.ceil(...)) where integer counts are needed.
#   - isinstance() (not hasattr) for type checks.
# ==============================================================================

import Rhino
import Rhino.Geometry as rg
import System
import math
import random
from Grasshopper import DataTree
from Grasshopper.Kernel.Data import GH_Path


# ---- unit conversion: unit_system -> Rhino file unit ------------------------
def _unit_scale(sys_name):
    """Return model units per 1 linear input unit.
    Areas are SF or SM depending on unit_system; we convert the LINEAR
    dimension (sqrt of area) into the active Rhino file unit."""
    name = (sys_name or "feet").strip().lower()
    if name.startswith("m"):
        src_m = 1.0            # meters -> meters
    else:
        src_m = 0.3048         # feet -> meters
    # active Rhino unit expressed in meters
    doc = Rhino.RhinoDoc.ActiveDoc
    try:
        umeters = Rhino.RhinoMath.UnitScale(Rhino.UnitSystem.Meters, doc.ModelUnitSystem)
        # umeters = model units per meter
    except Exception:
        umeters = 1.0
    return src_m * umeters      # model units per 1 input linear unit


def _area_to_radius(a_input, lin_scale):
    """area given in (input-unit)^2 -> radius in model units."""
    if a_input is None or a_input <= 0:
        a_input = 1.0
    a_model = a_input * (lin_scale * lin_scale)
    return math.sqrt(a_model / math.pi)


# ---- guards / defaults ------------------------------------------------------
def _get(name, default):
    return globals()[name] if (name in globals() and globals()[name] is not None) else default


centers = DataTree[object]()
circles = DataTree[object]()
radii = DataTree[object]()
labels = DataTree[object]()
colors = DataTree[object]()
uid_out = DataTree[object]()
dept_out = DataTree[object]()
env_rect = DataTree[object]()
adj_lines = DataTree[object]()
depts = []
max_overlap = 0.0
info = ""


def _solve():
    global depts, max_overlap
    lines = []

    _uid = list(_get("uid", []))
    _area = list(_get("area", []))
    _color = list(_get("color", []))
    _label = list(_get("label", []))
    _dept = list(_get("dept", []))
    _asrc = list(_get("adj_source", []))
    _atgt = list(_get("adj_target", []))
    _depts_in = list(_get("depts", []))

    n = len(_uid)
    if n == 0:
        return "Waiting: no rooms from Component 01."
    # index-alignment guard
    for nm, lst in [("area", _area)]:
        if len(lst) != n:
            return "ERROR: '{}' length {} != uid length {}.".format(nm, len(lst), n)

    unit_system = _get("unit_system", "feet")
    iters = int(_get("iterations", 400))
    k_adj = float(_get("k_adj", 0.08))
    k_repel = float(_get("k_repel", 0.85))
    pad_in = float(_get("pad", 2.0))
    seed = int(_get("seed", 42))

    lin = _unit_scale(unit_system)
    pad = pad_in * lin

    # ---- build per-instance arrays ----------------------------------------
    rad = [_area_to_radius(_area[i], lin) for i in range(n)]
    idx_of = {}                      # uid -> index
    for i in range(n):
        idx_of[_uid[i]] = i

    # single global membership -- every room is in one cloud
    members = list(range(n))

    deoverlap_iters = int(_get("deoverlap_iters", 300))
    max_step = None  # set after radii known

    # ---- initial placement: one seeded disc for the whole program ---------
    random.seed(seed)
    px = [0.0] * n
    py = [0.0] * n
    tot_a = sum(math.pi * rad[i] * rad[i] for i in members)
    R = math.sqrt(tot_a / math.pi) * 1.3 + 1.0
    for i in members:
        ang = random.uniform(0, 2 * math.pi)
        rr = random.uniform(0, R)
        px[i] = rr * math.cos(ang)
        py[i] = rr * math.sin(ang)

    # adjacency edges as index pairs (skip any that don't resolve)
    edges = []
    for s, t in zip(_asrc, _atgt):
        if s in idx_of and t in idx_of:
            edges.append((idx_of[s], idx_of[t]))

    # ---- relaxation loop (fixed iterations) -------------------------------
    # All physics run in FLOOR-LOCAL coordinates (each floor centered near its
    # own origin); cross-floor adjacency therefore pulls "as if stacked".
    for _ in range(max(1, iters)):
        fx = [0.0] * n
        fy = [0.0] * n

        # 1) adjacency springs (directed: source pulled toward target)
        for (a, b) in edges:
            dx = px[b] - px[a]
            dy = py[b] - py[a]
            d = math.hypot(dx, dy)
            rest = rad[a] + rad[b] + pad
            if d < 1e-6:
                continue
            # pull source toward target proportional to (d - rest)
            f = k_adj * (d - rest)
            ux, uy = dx / d, dy / d
            fx[a] += f * ux
            fy[a] += f * uy
            # mild reciprocal so the pair converges (target nudged half back)
            fx[b] -= 0.5 * f * ux
            fy[b] -= 0.5 * f * uy

        # 2) non-overlap repulsion (GLOBAL -- every pair, no floor grouping)
        for a in range(n):
            for b in range(a + 1, n):
                dx = px[b] - px[a]
                dy = py[b] - py[a]
                d = math.hypot(dx, dy)
                min_d = rad[a] + rad[b] + pad
                if d < 1e-6:
                    # jitter apart
                    dx, dy, d = random.uniform(-1, 1), random.uniform(-1, 1), 1.0
                if d < min_d:
                    overlap = (min_d - d)
                    ux, uy = dx / d, dy / d
                    f2 = k_repel * overlap
                    fx[a] -= f2 * ux
                    fy[a] -= f2 * uy
                    fx[b] += f2 * ux
                    fy[b] += f2 * uy

        # (floor cohesion removed: there are no floors at this stage)

        # integrate with a per-step clamp so a bubble can't leap through a
        # neighbor in one iteration (overshoot is the main source of frozen
        # overlap). Cap the move at ~half the smallest radius.
        if max_step is None:
            max_step = 0.5 * min(rad)
        for i in range(n):
            sx, sy = fx[i], fy[i]
            slen = math.hypot(sx, sy)
            if slen > max_step and slen > 1e-9:
                sx *= max_step / slen
                sy *= max_step / slen
            px[i] += sx
            py[i] += sy

    # ---- DE-OVERLAP PASS (guarantees near-zero overlap) -------------------
    # Runs repulsion ONLY (no springs, no cohesion), moving each overlapping
    # pair exactly half the overlap distance directly apart. With nothing
    # pulling them back, overlap collapses to ~0 in a few dozen iterations.
    # We iterate until the worst overlap is under tolerance or we hit the cap.
    tol = 0.01 * lin                      # 0.01 input-units of slop, in model units
    max_ov = 0.0
    for _di in range(max(0, deoverlap_iters)):
        worst = 0.0
        for a in range(n):
            for b in range(a + 1, n):
                dx = px[b] - px[a]
                dy = py[b] - py[a]
                d = math.hypot(dx, dy)
                min_d = rad[a] + rad[b] + pad
                if d < 1e-9:
                    ang = random.uniform(0, 2 * math.pi)
                    dx, dy, d = math.cos(ang), math.sin(ang), 1.0
                if d < min_d:
                    overlap = min_d - d
                    if overlap > worst:
                        worst = overlap
                    # push each bubble half the overlap directly apart
                    ux, uy = dx / d, dy / d
                    shift = 0.5 * overlap
                    px[a] -= shift * ux
                    py[a] -= shift * uy
                    px[b] += shift * ux
                    py[b] += shift * uy
        max_ov = worst
        if worst <= tol:
            break
    max_overlap = max_ov / lin if lin else max_ov   # report in input units

    # ---- re-center the single cloud on the origin -------------------------
    if members:
        cx = sum(px[i] for i in members) / len(members)
        cy = sum(py[i] for i in members) / len(members)
        for i in members:
            px[i] -= cx
            py[i] -= cy

    # ---- emit ONE branch {0} ----------------------------------------------
    # No floors here, so no view offsets and no per-floor grafting. Comp03 reads
    # this flat cloud, assigns floors, and does the grafting + separation.
    z = 0.0
    path = GH_Path(0)
    for i in members:
        pt = rg.Point3d(px[i], py[i], z)
        centers.Add(pt, path)
        circles.Add(rg.Circle(pt, rad[i]), path)
        radii.Add(rad[i], path)
        labels.Add(_label[i] if i < len(_label) else _uid[i], path)
        colors.Add(_color[i] if i < len(_color) else System.Drawing.Color.Gray, path)
        uid_out.Add(_uid[i], path)
        dept_out.Add(_dept[i] if i < len(_dept) else -1, path)

    # envelope rectangle for the whole cloud
    if members:
        lox = min(px[i] - rad[i] for i in members)
        hix = max(px[i] + rad[i] for i in members)
        loy = min(py[i] - rad[i] for i in members)
        hiy = max(py[i] + rad[i] for i in members)
        plane = rg.Plane(rg.Point3d(lox, loy, z), rg.Vector3d.ZAxis)
        rect = rg.Rectangle3d(plane, hix - lox, hiy - loy)
        env_rect.Add(rect.ToNurbsCurve(), path)

    # ---- adjacency lines (single branch) ----------------------------------
    for (a, b) in edges:
        adj_lines.Add(rg.Line(rg.Point3d(px[a], py[a], 0.0),
                              rg.Point3d(px[b], py[b], 0.0)), path)

    # ---- passthrough depts -------------------------------------------------
    if _depts_in:
        depts = list(_depts_in)
    else:
        depts = sorted(set(_dept)) if _dept else []

    lines.append("Component 02 | Bubble Solver (single global cloud)")
    lines.append("Rooms: {}   Edges: {}   (floors assigned downstream in Comp03)".format(n, len(edges)))
    lines.append("Unit system: {}   model-units/input: {:.4f}".format(unit_system, lin))
    lines.append("Iterations: {}   global repulsion pairs/iter: {:,}".format(
        iters, n * (n - 1) // 2))
    lines.append("k_adj={}  k_repel={}  pad={}".format(k_adj, k_repel, pad_in))
    _clean = max_overlap <= (0.01 + 1e-9)
    lines.append("De-overlap: {}   max residual overlap: {:.4f} {}  {}".format(
        "converged" if _clean else "CAP HIT (raise deoverlap_iters)",
        max_overlap, unit_system,
        "OK" if _clean else "<-- still overlapping"))
    if members:
        _w = (max(px[i] + rad[i] for i in members) - min(px[i] - rad[i] for i in members)) / lin
        _h = (max(py[i] + rad[i] for i in members) - min(py[i] - rad[i] for i in members)) / lin
        lines.append("Cloud extent: {:.0f} x {:.0f} {}  (single branch {{0}})".format(
            _w, _h, unit_system))
    return "\n".join(lines)


_do_run = True if ('run' not in globals() or run is None) else bool(run)
if _do_run:
    info = _solve()
else:
    info = "Idle: set run=True to solve."
# ---------- end comp02_bubblesolver ----------
panel_9 = Panel(comp02_bubblesolver.info)
num_2 = Number(comp02_bubblesolver.max_overlap)
panel_10 = Panel(comp02_bubblesolver.out)
pt = Point(comp02_bubblesolver.centers)
num_3 = Number(comp02_bubblesolver.radii)
col_2 = Colour(comp02_bubblesolver.colors)
int_5 = Integer(comp02_bubblesolver.dept_out)
line = Line(comp02_bubblesolver.adj_lines)
circle = Circle(comp02_bubblesolver.circles)
txt_6 = Text(comp02_bubblesolver.labels)
txt_7 = Text(comp02_bubblesolver.uid_out)
crv = Curve(comp02_bubblesolver.env_rect)
int_6 = Integer(comp02_bubblesolver.depts)
linetypes = QueryModelLinetypes(AutoUpdateState=True)
list = ItemSelector(linetypes, {"Model Linetype : (Continuous)"}, selected="Model Linetype : (Continuous)")
expression = Expression(x=num_3, Expression="2*x")
len = TextLength(Text=txt_6)
swatch = ColourSwatch(SwatchColor=RGB(0, 0, 0))
division = Division(A=expression, B=len)
boundary = BoundarySurfaces(Edges=circle)

preview = CustomPreview(Geometry=boundary, Material=col_2)  # disabled
preview_2 = CustomPreview(Geometry=line, Material=col_2)  # disabled
tag = TextTag3D(Location=pt, Text=txt_6, Size=division, Colour=swatch, Justification=5)  # disabled
curve_preview = CustomCurvePreview(Curve=comp02_bubblesolver.env_rect, Linetype=list, Colour=swatch)  # disabled

# ----
crv_2 = Curve(<curve referenced from the Rhino model>)

# ---- group: GH_ExcelReader
# Color RGB
panel_11 = Panel("Color RGB")
keysearch = KeyValueSearch(Keys=excelread.ColumnHeaderNames, Values=flip, Search=panel_11)  # -> flatten(Result)

# Conn. Primary
panel_12 = Panel("Conn. Primary")
keysearch_2 = KeyValueSearch(Keys=excelread.ColumnHeaderNames, Values=flip, Search=panel_12)  # -> flatten(Result)

# Dept No
panel_13 = Panel("Dept No")
keysearch_3 = KeyValueSearch(Keys=excelread.ColumnHeaderNames, Values=flip, Search=panel_13)  # -> flatten(Result)

# Floor #
panel_14 = Panel("Flr")
keysearch_4 = KeyValueSearch(Keys=excelread.ColumnHeaderNames, Values=flip, Search=panel_14)  # -> flatten(Result)

# Room Qty/ Units
panel_15 = Panel("Room Qty/ Units")
keysearch_5 = KeyValueSearch(Keys=excelread.ColumnHeaderNames, Values=flip, Search=panel_15)  # -> flatten(Result)

mindex_2 = MemberIndex(Set=keysearch_5, Member="0")  # -> Index, Count

cull_i_2 = CullIndex(List=keysearch_5, Indices=mindex_2.Index, Wrap=False)
panel_16 = Panel(cull_i_2)
ma = MassAddition(Input=cull_i_2)  # -> Result, PartialResults
total_of_rooms = Panel(ma.Result)

# Program Element
panel_17 = Panel("Program Element")
keysearch_6 = KeyValueSearch(Keys=excelread.ColumnHeaderNames, Values=flip, Search=panel_17)  # -> flatten(Result)
cull_i_3 = CullIndex(List=keysearch_6, Indices=mindex_2.Index, Wrap=True)  # -> simplify(List)
panel_18 = Panel(cull_i_3)
repeat = RepeatData(Data=graft(cull_i_3), Length=graft(cull_i_2))  # -> simplify(Data)

# ---- group: GH_ExcelReader / Size Square
# Net SF/ Units
panel_19 = Panel("Net SF/ Units")
keysearch_7 = KeyValueSearch(Keys=excelread.ColumnHeaderNames, Values=flip, Search=panel_19)  # -> flatten(Result)
cull_i_4 = CullIndex(List=keysearch_7, Indices=mindex_2.Index, Wrap=True)  # -> simplify(List)
panel_20 = Panel(cull_i_4)
repeat_2 = RepeatData(Data=graft(cull_i_4), Length=graft(cull_i_2))  # -> simplify(Data)

# ---- group: GH_ExcelReader (continued)
cull_i_5 = CullIndex(List=keysearch, Indices=mindex_2.Index, Wrap=True)  # -> simplify(List)
panel_21 = Panel(cull_i_5)
repeat_3 = RepeatData(Data=graft(cull_i_5), Length=simplify(graft(cull_i_2)))  # -> simplify(Data)
pdecon = Deconstruct(Point=flatten(repeat_3))  # -> XComponent, YComponent, ZComponent
rgb = ColourRGB(Alpha=255, Red=pdecon.XComponent, Green=pdecon.YComponent, Blue=pdecon.ZComponent)

cull_i_6 = CullIndex(List=keysearch_4, Indices=mindex_2.Index, Wrap=True)  # -> simplify(List)
panel_22 = Panel(cull_i_6)
repeat_4 = RepeatData(Data=graft(cull_i_6), Length=simplify(graft(cull_i_2)))  # -> simplify(Data)
bnd = Bounds(Numbers=flatten(repeat_4))
dedomain = DeconstructDomain(Domain=bnd)  # -> Start, End
series = Series(Start=1, Step=1, Count=dedomain.End)
total_of_flrs = Panel(dedomain.End)
equals = Equality(FirstNumber=simplify(graft(series)), SecondNumber=flatten(panel_22))  # -> Equality, Inequality
equals_2 = Equality(FirstNumber=simplify(graft(series)), SecondNumber=flatten(repeat_4))  # -> Equality, Inequality
dispatch = Dispatch(List=flatten(repeat_2), DispatchPattern=simplify(equals_2.Equality))  # -> ListA, ListB
ma_2 = MassAddition(Input=simplify(dispatch.ListA))  # -> Result, PartialResults
ma_3 = MassAddition(Input=flatten(ma_2.Result))  # -> Result, PartialResults
total_sq_ft_per_flr = Panel(ma_2.Result)
total_sq_ft = Panel(ma_3.Result)

cull_i_7 = CullIndex(List=keysearch_3, Indices=mindex_2.Index, Wrap=True)  # -> simplify(List)
panel_23 = Panel(cull_i_7)
repeat_5 = RepeatData(Data=graft(cull_i_7), Length=graft(cull_i_2))  # -> simplify(Data)

cull_i_8 = CullIndex(List=keysearch_2, Indices=mindex_2.Index, Wrap=True)  # -> simplify(List)
panel_24 = Panel(cull_i_8)
repeat_6 = RepeatData(Data=graft(cull_i_8), Length=graft(cull_i_2))  # -> simplify(Data)
fsim = FindSimilarMember(Data=flatten(repeat_6), Set=flatten(repeat_5))  # -> Hit, Index

# ---- group: GH_ExcelReader / Size Square
# Size Circle
pi = Pi(Factor=1)
division_2 = Division(A=repeat_2, B=pi)
sqrt = SquareRoot(Value=division_2)  # -> flatten(Result)

# Size Square
sqrt_2 = SquareRoot(Value=repeat_2)  # -> flatten(Result)

# ---- group: GH_ExcelReader / Shift list to multiple distribution
bnd_2 = Bounds(Numbers=panel_16)
dedomain_2 = DeconstructDomain(Domain=bnd_2)  # -> Start, End
series_2 = Series(Start=0, Step=1, Count=dedomain_2.End)
repeat_7 = RepeatData(Data=series_2, Length=simplify(cull_i_2))  # -> simplify(Data)
addition = Addition(A=flatten(repeat_7), B=fsim.Index)

# ---- group: Claude Code Attempt V0.2
toggle = BooleanToggle(True)  # disabled
program_names = Text(repeat)  # disabled
item_3 = ListItem(List=flatten(repeat), Index=fsim.Index, Wrap=True)  # disabled
_02_floor_plan_solver = Python3Script(
    names=flatten(program_names),
    areas=flatten(repeat_2),
    floors=flatten(repeat_4),
    adj_a=flatten(repeat),
    adj_b=item_3,
    arrange_mode=toggle)  # -> out, centers, radii, labels, floor_id, env_rect; inputs names: list, areas: list, floors: list, adj_a: list, adj_b: list; disabled
#   port iters: If empty default: 300
# ---------- _02_floor_plan_solver: Python ----------
#! python3
# ============================================================================
# COMPONENT 2 — MULTI-FLOOR BUBBLE SOLVER (all floors, one execution)
# ----------------------------------------------------------------------------
# Force relaxation for room positioning. Solves every floor in a single run
# and emits GRAFTED trees (one branch per floor). Derives its own envelope
# from the rooms on each floor — no envelope wiring required.
#
# INPUTS:
#   names, areas, floors, adj_a, adj_b : List Access (from reader)
#   iters       : Item Access  (default 300)
#   efficiency  : Item Access  (default 0.80  -> net/efficiency = gross area)
#   aspect      : Item Access  (default 1.4   -> envelope width/height ratio)
#
#   arrange_mode : Item Access (int; default 0)
#       0 = STACKED   : floors stacked in Z, spaced by floor_height
#       1 = SPREAD    : floors laid side-by-side in plan (X or Y) with a gap
#   floor_height : Item Access (default 12.0) Z spacing for mode 0
#   spread_axis  : Item Access (str "x" or "y"; default "x") plan axis for mode 1
#   gap          : Item Access (default 20.0) gap between floor envelopes, mode 1
#
# OUTPUTS (DataTrees, one branch per floor):
#   centers  : Point3d   (offset by the chosen arrangement)
#   radii    : float
#   labels   : str
#   floor_id : int      actual floor number for each branch
#   env_rect : Rectangle3d  per-floor envelope, offset to match (for sheet/QA)
#
# NOTE: branch {i} is the i-th DISTINCT floor (sorted). floor_id maps branch
#       -> real floor number, since floor numbers may skip (e.g. 1, 2, 4).
#       Floors sort ascending, so lower floors get lower Z / earlier position.
# ============================================================================
import math
import Rhino.Geometry as rg
from Grasshopper import DataTree
from Grasshopper.Kernel.Data import GH_Path

# --- None-safe inputs -------------------------------------------------------
names  = names  or []
areas  = areas  or []
floors = floors or []
adj_a  = adj_a  or []
adj_b  = adj_b  or []
ITERS  = 300  if iters      is None else int(iters)
EFF    = 0.80 if efficiency is None else float(efficiency)
ASP    = 1.4  if aspect     is None else float(aspect)

MODE   = 0     if arrange_mode is None else int(arrange_mode)
FH     = 12.0  if floor_height is None else float(floor_height)
AXIS   = "x"   if spread_axis  is None else str(spread_axis).strip().lower()
GAP    = 20.0  if gap          is None else float(gap)

adj_pairs = list(zip(adj_a, adj_b))

# --- force constants --------------------------------------------------------
K_ATTRACT = 0.04    # spring pull along adjacency edges
K_REPEL   = 0.90    # overlap resolution between all room pairs
K_BOUND   = 0.15    # confinement to derived envelope

def solve_floor(nm, ar, edges, iters, eff, asp):
    rad = [math.sqrt(a / math.pi) for a in ar]

    # derived envelope from this floor's total area
    net   = sum(ar) if ar else 1.0
    gross = net / eff
    h = math.sqrt(gross / asp)
    w = asp * h
    xmin, xmax = -w / 2.0, w / 2.0
    ymin, ymax = -h / 2.0, h / 2.0

    # seed positions on a phyllotaxis spiral about the origin
    pos = []
    golden = math.pi * (3 - math.sqrt(5))
    for k in range(len(nm)):
        t  = k * golden
        rr = 0.5 * math.sqrt(k + 1)
        pos.append([rr * math.cos(t), rr * math.sin(t)])

    for _ in range(iters):
        force = [[0.0, 0.0] for _ in nm]

        # attraction along adjacencies (rest length = just touching)
        for a, b in edges:
            dx = pos[b][0] - pos[a][0]
            dy = pos[b][1] - pos[a][1]
            d = math.hypot(dx, dy) or 1e-6
            f = K_ATTRACT * (d - (rad[a] + rad[b]))
            ux, uy = dx / d, dy / d
            force[a][0] += f * ux; force[a][1] += f * uy
            force[b][0] -= f * ux; force[b][1] -= f * uy

        # pairwise repulsion (resolve overlaps)
        n = len(nm)
        for i in range(n):
            for j in range(i + 1, n):
                dx = pos[j][0] - pos[i][0]
                dy = pos[j][1] - pos[i][1]
                d = math.hypot(dx, dy) or 1e-6
                ov = (rad[i] + rad[j]) - d
                if ov > 0:
                    f = K_REPEL * ov
                    ux, uy = dx / d, dy / d
                    force[i][0] -= f * ux; force[i][1] -= f * uy
                    force[j][0] += f * ux; force[j][1] += f * uy

        # boundary confinement
        for i in range(n):
            if pos[i][0] - rad[i] < xmin: force[i][0] += K_BOUND * (xmin - (pos[i][0] - rad[i]))
            if pos[i][0] + rad[i] > xmax: force[i][0] -= K_BOUND * ((pos[i][0] + rad[i]) - xmax)
            if pos[i][1] - rad[i] < ymin: force[i][1] += K_BOUND * (ymin - (pos[i][1] - rad[i]))
            if pos[i][1] + rad[i] > ymax: force[i][1] -= K_BOUND * ((pos[i][1] + rad[i]) - ymax)

        for i in range(n):
            pos[i][0] += force[i][0]
            pos[i][1] += force[i][1]

    centers = [rg.Point3d(p[0], p[1], 0) for p in pos]
    return centers, rad, w, h    # w,h = envelope dimensions for arrangement

# --- iterate floors, build grafted trees ------------------------------------
centers  = DataTree[rg.Point3d]()
radii    = DataTree[float]()
labels   = DataTree[str]()
floor_id = DataTree[int]()
env_rect = DataTree[rg.Rectangle3d]()

unique_floors = sorted(set(int(f) for f in floors if f is not None)) if floors else []

# First pass: solve every floor at the origin, cache results + envelope dims.
solved = []   # (fidx, centers, radii, names, w, h)
for fidx in unique_floors:
    idx = [i for i, f in enumerate(floors) if int(f) == fidx]
    nm  = [str(names[i]) for i in idx]
    ar  = [float(areas[i]) for i in idx]
    local = {n: k for k, n in enumerate(nm)}
    edges = [(local[a], local[b]) for a, b in adj_pairs
             if a in local and b in local]
    cen, rad, w, h = solve_floor(nm, ar, edges, ITERS, EFF, ASP)
    solved.append((fidx, cen, rad, nm, w, h))

# Second pass: compute per-floor arrangement offset, then place geometry.
# SPREAD accumulates running position so unequal floor sizes stay clear.
run = 0.0
for bi, (fidx, cen, rad, nm, w, h) in enumerate(solved):
    path = GH_Path(bi)

    if MODE == 1:
        # side-by-side in plan, spaced by half-widths + gap
        if bi == 0:
            off_x, off_y, off_z = 0.0, 0.0, 0.0
            run = (w if AXIS == "x" else h) / 2.0
        else:
            prev_w, prev_h = solved[bi - 1][4], solved[bi - 1][5]
            step = (prev_w + w) / 2.0 + GAP if AXIS == "x" else (prev_h + h) / 2.0 + GAP
            run += step
            off_x = run if AXIS == "x" else 0.0
            off_y = run if AXIS == "y" else 0.0
            off_z = 0.0
    else:
        # MODE 0: stack in Z by floor height (ascending floors go up)
        off_x, off_y, off_z = 0.0, 0.0, bi * FH

    for c, r, n in zip(cen, rad, nm):
        centers.Add(rg.Point3d(c.X + off_x, c.Y + off_y, c.Z + off_z), path)
        radii.Add(r, path)
        labels.Add(n, path)

    # per-floor envelope rectangle, offset to match (origin-centered w x h)
    rect = rg.Rectangle3d(
        rg.Plane(rg.Point3d(off_x, off_y, off_z), rg.Vector3d.ZAxis),
        rg.Interval(-w / 2.0, w / 2.0),
        rg.Interval(-h / 2.0, h / 2.0))
    env_rect.Add(rect, path)
    floor_id.Add(fidx, path)
# ---------- end _02_floor_plan_solver ----------
number_slider = Slider(6, range=3..8)  # disabled
number_slider_2 = Slider(3, range=0.5..5)  # disabled
flatten = FlattenTree(Tree=repeat, Path="{0}")  # disabled
toggle_2 = BooleanToggle(True)  # disabled
flatten_2 = FlattenTree(Tree=repeat_2, Path="{0}")  # disabled
_03_rect_tiler = Python3Script(
    centers=_02_floor_plan_solver.centers,
    radii=_02_floor_plan_solver.radii,
    labels=_02_floor_plan_solver.labels,
    env_rect=_02_floor_plan_solver.env_rect,
    corridor_w=4,
    min_width_default=number_slider,
    adj_a=flatten(repeat),
    adj_b=item_3,
    max_aspect=number_slider_2,
    exterior_mode=toggle_2)  # -> out, rects, tile_rects, centers_out, out_labels, cluster_id, ring_crvs, spine_crvs, band_line_y; inputs centers: tree of Point3d, radii: tree of Double, labels: tree of String, env_rect: tree of Rectangle3d, num_clusters: Int32, room_min_w: tree, room_min_l: tree, adj_a: list, adj_b: list, max_aspect: Double, exterior_mode: Boolean, closet_max_area: Double; disabled
#   port env_rect: (default 1.2 room width/height ratio)
#   port num_clusters: blank/0 = auto (elbow); else forced k
#   port corridor_w: (default 1.2) — width of reserved circulation gaps
#   port size_modifier: (default 1.05) — multiplies each room's program area up front, padding for circulation before inset reclaims it
#   port min_width_default: (default 5.0) — minimum SHORT side for any room that has no explicit override
#   port room_min_w: (optional) — per-room minimum WIDTH, aligned with 'labels'. Blank/0 entries fall back to min_width_default.
#   port room_min_l: (optional) — per-room minimum LENGTH, aligned with 'labels'. Blank/0 = NO length constraint (no default).
#   port adj_a: (optional) — listed adjacency pairs from the reader. Used for SNAPPING: a room sharing a tile edge with a listed neighbour is pushed against that edge instead of floating in the middle of its slice.
#   port adj_b: (optional) — listed adjacency pairs from the reader. Used for SNAPPING: a room sharing a tile edge with a listed neighbour is pushed against that edge instead of floating in the middle of its slice.
#   port rects: (for shared-wall + sheet layout)
#   port tile_rects: FULL tiles before inset (for shared-edge/doors)
#   port centers_out: (for corridor router — marshals cleanly)
#   port ring_crvs: corridor ring per cluster
#   port band_line_y: (per room) the ring edge Y it opens onto
# ---------- _03_rect_tiler: Python ----------
#! python3
# ============================================================================
# COMPONENT 03 - CLUSTER / BRANCH-WING TILER
# ----------------------------------------------------------------------------
# Preserves the bubble-solver clustering and packs each cluster into a compact
# double-loaded wing with an internal corridor, places wings near their solver
# centroids, spreads them so they don't overlap, and connects every wing to a
# spine so all rooms reach one circulation network.
#
# Pipeline per floor:
#   1) cluster rooms (k-means on solver centers; auto-k elbow or forced)
#   2) pack each cluster as stacked, back-to-back double-loaded STEMS; rooms are
#      sized to exact area at a shared row depth, aligned on the edge facing the
#      building centroid, and snap-contacted so a corridor line has no gaps
#   3) place each wing near its solver cluster centroid; box-relax to remove
#      overlaps while keeping the relative arrangement
#   4) emit internal stems + an inward-edge COLLECTOR (ring_crvs), and a SPINE
#      of two flanking trunks joined by cross-links with a branch from each
#      collector (spine_crvs). Connectivity is by construction.
#
# exterior_mode: 1 = room-loaded (collector on the INWARD edge); 0 = corridor-
#   loaded (collector on the OUTWARD edge). Both reuse the same branch layout.
#
# NOTE: some corridor refinements are deferred (gap-routed spines, both-sided
#   collectors, asymmetric stem ends, true ring mode). See 00_PIPELINE_REFERENCE
#   / 00_WIRING_GUIDE 'Known limitations'. layout_ring() below is unused
#   scaffolding kept for a future true-ring rebuild.
#
# INPUTS:
#   centers  : Tree  hint Point3d   solver centers (hint required or -> Guid)
#   radii    : Tree  hint double    solver radii
#   labels   : Tree  hint Text      solver labels
#   env_rect : Tree  hint Rectangle solver env_rect (per-floor plane/offset)
#   adj_a, adj_b      : List Text   reader adjacency (passthrough to doors)
#   num_clusters      : Item int    blank/0 = auto (elbow), else forced k
#   corridor_w        : Item (2.0)  corridor / spine width
#   size_modifier     : Item (1.05) room up-size factor
#   min_width_default : Item (5.0)  minimum room width floor
#   max_aspect        : Item (3.0)  room aspect cap target
#   exterior_mode     : Item int    1 = room-loaded, 0 = corridor-loaded
#   closet_max_area   : Item (0)    0 = name-match only; else skip corridor for
#                                   rooms with area <= this
#   room_min_w, room_min_l : List double (optional) per-room minimums
#
# OUTPUTS (DataTrees, one branch per floor):
#   rects, tile_rects : Rectangle3d (rooms; identical, tile_rects for 04)
#   centers_out : Point3d   room centers (feeds 06)
#   out_labels  : str       room names in tiler order (feeds 04, 06)
#   cluster_id  : int       cluster index per room
#   ring_crvs   : Curve     internal stems + inward-edge collectors
#   spine_crvs  : Curve     flanking trunks + branches + cross-links
#   band_line_y : double    per-room corridor line Y it opens onto (feeds 04)
#   out         : str
# ============================================================================
import math
import Rhino.Geometry as rg
from Grasshopper import DataTree
from Grasshopper.Kernel.Data import GH_Path

KFORCE = 0    if num_clusters is None else int(num_clusters)
CW     = 2.0  if corridor_w   is None else float(corridor_w)
SIZE_MOD = 1.05 if size_modifier is None else float(size_modifier)
MINW   = 5.0  if min_width_default is None else float(min_width_default)
MAXA   = 3.0  if max_aspect   is None else float(max_aspect)
# exterior_mode: 0 = corridor-loaded exterior (ring wraps wing) -> RING internal
#                1 = room-loaded exterior -> BRANCH/comb internal corridor
EXTMODE = 0   if exterior_mode is None else int(exterior_mode)
# closets may skip corridor access: name contains a closet keyword OR area small
CLOSET_MAXAREA = 0.0 if closet_max_area is None else float(closet_max_area)
CLOSET_WORDS = ["closet", "clst"]

def as_tree(x, T):
    if hasattr(x, "Paths"): return x
    t = DataTree[T]()
    if x is None: return t
    if not isinstance(x, (list, tuple)): x = [x]
    for it in x:
        try:
            if T is float: t.Add(float(it), GH_Path(0))
            elif T is str: t.Add(str(it), GH_Path(0))
            else: t.Add(it, GH_Path(0))
        except: pass
    return t

centers  = as_tree(centers,  rg.Point3d)
radii    = as_tree(radii,    float)
labels   = as_tree(labels,   str)
env_rect = as_tree(env_rect, rg.Rectangle3d)

def flat(x):
    if x is None: return []
    if hasattr(x, "Paths"):
        o=[]
        for p in x.Paths: o.extend(list(x.Branch(p)))
        return o
    if not isinstance(x,(list,tuple)): return [x]
    return list(x)

_lbl_all = flat(labels)
_mw_raw = flat(room_min_w); _ml_raw = flat(room_min_l)
MINW_BY={}; MINL_BY={}
for i,nm in enumerate(_lbl_all):
    if nm is None: continue
    nm=str(nm)
    if i<len(_mw_raw):
        try:
            v=float(_mw_raw[i])
            if v>0: MINW_BY[nm]=v
        except: pass
    if i<len(_ml_raw):
        try:
            v=float(_ml_raw[i])
            if v>0: MINL_BY[nm]=v
        except: pass
def min_w_of(nm): return MINW_BY.get(nm,MINW)

def kmeans(pts,k,iters=60):
    if k>=len(pts): return [[i] for i in range(len(pts))]
    step=max(1,len(pts)//k)
    cent=[pts[min(i*step,len(pts)-1)] for i in range(k)]
    idx=[[] for _ in range(k)]
    for _ in range(iters):
        idx=[[] for _ in range(k)]
        for j,p in enumerate(pts):
            bi=0;bd=1e18
            for i in range(k):
                d=(p[0]-cent[i][0])**2+(p[1]-cent[i][1])**2
                if d<bd: bd=d;bi=i
            idx[bi].append(j)
        nc=[]
        for i,g in enumerate(idx):
            if g: nc.append((sum(pts[j][0] for j in g)/len(g),sum(pts[j][1] for j in g)/len(g)))
            else: nc.append(cent[i])
        if nc==cent: break
        cent=nc
    return idx

def auto_k(pts,kmin=2,kmax=10):
    prev=None;best=min(kmin,len(pts));hi=min(kmax,len(pts))
    for k in range(kmin,hi+1):
        idx=kmeans(pts,k)
        cent=[(sum(pts[j][0] for j in g)/len(g),sum(pts[j][1] for j in g)/len(g)) if g else (0,0) for g in idx]
        sp=sum(math.hypot(pts[j][0]-cent[i][0],pts[j][1]-cent[i][1]) for i in range(k) for j in idx[i])
        if prev is not None and prev>0 and (prev-sp)/prev<0.10: return max(kmin,k-1)
        prev=sp;best=k
    return best

def is_closet(nm, area):
    low = nm.lower()
    if any(w in low for w in CLOSET_WORDS):
        return True
    if CLOSET_MAXAREA > 0 and area <= CLOSET_MAXAREA:
        return True
    return False

def _row_depth(items, max_aspect):
    if not items: return MINW
    ar = [a for _, a in items]
    avg = sum(ar) / len(ar)
    d = max(math.sqrt(avg), math.sqrt(max(ar) / max_aspect), MINW)
    # cap depth so the SMALLEST room still gets width >= MINW; otherwise the
    # width clamp (max(a/d, MINW)) inflates that room's area badly.
    dmax = min(ar) / MINW
    d = min(d, max(dmax, MINW))
    return d

def _stem(rooms, cw, target_w=None):
    # one double-loaded stem. Search row partitions for the best worst-aspect,
    # then set each row depth = row_area / W so BOTH rows share width W exactly
    # (aligned) with 0% area error. Returns (rects, W, worst_aspect).
    rr = sorted(rooms, key=lambda r: -r[1])
    n = len(rr)
    if n == 0:
        return [], 0.0, 1.0
    if n == 1:
        nm, a = rr[0]
        d = max(math.sqrt(a), MINW)
        w = a / d
        if target_w and target_w > w:
            w = target_w; d = a / w
        return [(nm, 0.0, cw/2.0, w, cw/2.0 + d)], w, max(w, d)/max(min(w, d), 1e-9)

    from itertools import combinations
    idxs = list(range(n)); half = n // 2
    best = None
    # limit search for large stems to keep it fast
    r_lo = max(1, half - 1); r_hi = min(n - 1, half + 1)
    for r in range(r_lo, r_hi + 1):
        combos = combinations(idxs, r)
        # cap combinations examined for big stems
        cnt = 0
        for combo in combos:
            cnt += 1
            if cnt > 400: break
            cset = set(combo)
            top = [rr[i] for i in combo]
            bot = [rr[i] for i in idxs if i not in cset]
            if not top or not bot: continue
            ta = sum(a for _, a in top); ba = sum(a for _, a in bot)
            wt = MINW * ta / min(a for _, a in top)
            wb = MINW * ba / min(a for _, a in bot)
            W = max(wt, wb, math.sqrt(ta + ba))
            if target_w: W = max(W, target_w)
            td = ta / W; bd = ba / W
            wa = 0.0
            for row, depth in ((top, td), (bot, bd)):
                for nm, a in row:
                    w = a / depth
                    wa = max(wa, max(w, depth) / max(min(w, depth), 1e-9))
            if best is None or wa < best[0]:
                best = (wa, top, bot, W, td, bd)
    wa, top, bot, W, td, bd = best
    rects = []; x = 0.0
    for nm, a in top:
        w = a / td; rects.append((nm, x, cw/2.0, x + w, cw/2.0 + td)); x += w
    x = 0.0
    for nm, a in bot:
        w = a / bd; rects.append((nm, x, -cw/2.0 - bd, x + w, -cw/2.0)); x += w
    return rects, W, wa

def layout_branch(rooms, cw, max_aspect, inward="right"):
    # BRANCH/comb: double-loaded stems stacked BACK-TO-BACK (room backs touch,
    # no inter-stem gap). Each stem keeps its natural width (exact area); all
    # stems ALIGN on their inward-facing edge (toward the building centroid).
    # 'inward' is "right" or "left" -> which edge is flush.
    rr = sorted(rooms, key=lambda r: -r[1])
    n = len(rr)
    if n == 0: return {}, [], 0.0, 0.0
    total = sum(a for _, a in rr)
    side = math.sqrt(total * 1.3)
    avg = total / n
    depth = max(math.sqrt(avg), MINW)
    stem_h = 2 * depth + cw
    nstems = max(1, int(round(side / stem_h)))
    per = int(math.ceil(n / float(nstems)))
    stems = [rr[i:i+per] for i in range(0, n, per)]
    built = [_stem(s, cw) for s in stems]           # (rects, W, worst_aspect)
    max_W = max(b[1] for b in built) if built else MINW
    rects = {}; corrs = []; yy = 0.0
    for (sr, W, wa) in built:
        ylo = min(r[2] for r in sr)
        yhi = max(r[4] for r in sr)
        # inward-edge alignment: shift in X so the inward edge is flush.
        xshift = (max_W - W) if inward == "right" else 0.0
        for nm, x0, y0, x1, y1 in sr:
            rects[nm] = (x0 + xshift, y0 - ylo + yy, x1 + xshift, y1 - ylo + yy)
        # corridor stem at local y=0 (the aisle), shifted with the stem
        corrs.append(((xshift, 0.0 - ylo + yy), (xshift + W, 0.0 - ylo + yy)))
        yy += (yhi - ylo)                            # back-to-back: no gap

    # snap-contact pass: within every corridor-side row, pack rooms edge-to-edge
    # (toward the inward edge) so adjacent rooms in a line always touch. Widths
    # are unchanged, so area is preserved; this only removes sub-threshold gaps.
    bands = {}
    for nm, (x0, y0, x1, y1) in rects.items():
        bands.setdefault((round(y0, 3), round(y1, 3)), []).append([nm, x0, y0, x1, y1])
    for key, items in bands.items():
        items.sort(key=lambda r: r[1])
        if inward == "right":
            x = max_W
            for it in reversed(items):
                w = it[3] - it[1]; it[3] = x; it[1] = x - w; x = it[1]
        else:
            x = 0.0
            for it in items:
                w = it[3] - it[1]; it[1] = x; it[3] = x + w; x = it[3]
        for nm, x0, y0, x1, y1 in items:
            rects[nm] = (x0, y0, x1, y1)

    # COLLECTOR: a corridor along the inward edge tying all stems together. Each
    # stem's corridor line ends at the inward edge x, so the collector shares
    # those exact endpoints (connected by construction, no welding needed).
    inward_x = max_W if inward == "right" else 0.0
    stem_ys = [c[0][1] for c in corrs]           # each stem's aisle y
    if stem_ys:
        cy0, cy1 = min(stem_ys), max(stem_ys)
        cmy = (cy0 + cy1) / 2.0
        # collector split at each stem y AND at the mid-y (where the spine branch
        # attaches) so every junction is a shared endpoint.
        ys = sorted(set([cy0, cy1, cmy] + stem_ys))
        for i in range(len(ys) - 1):
            corrs.append(((inward_x, ys[i]), (inward_x, ys[i + 1])))

    return rects, corrs, max_W, yy, inward_x, (min(stem_ys) if stem_ys else 0.0), (max(stem_ys) if stem_ys else 0.0)

def layout_ring(rooms, cw, max_aspect):
    # NOTE: currently UNUSED. exterior_mode=0 (corridor-loaded) reuses the branch
    # layout with the corridor flipped to the outer edge (see rectify), because
    # true ring/loop packing stranded rooms and produced overlaps. Kept as a
    # starting point if a proper ring dissection is built later.
    # RING/loop: corridor rectangle between an outer ring of rooms and an inner
    # core. Every ring/core room faces the corridor. Returns the 7-tuple
    # (rects, corrs, W, H, conn_x, conn_y0, conn_y1) matching layout_branch:
    # the connection info is a short vertical stub on the ring's inward (right)
    # edge that the spine branches to.
    rr = sorted(rooms, key=lambda r: -r[1])
    n = len(rr)
    if n == 0: return {}, [], 0.0, 0.0, 0.0, 0.0, 0.0
    total = sum(a for _, a in rr)
    depth = max(math.sqrt(total / n), MINW)
    if n <= 4:
        rects = {}; x = 0.0
        for nm, a in rr:
            w = max(a / depth, min_w_of(nm)); rects[nm] = (x, cw, x + w, cw + depth); x += w
        corrs = [((0.0, cw), (x, cw))]
        return rects, corrs, x, cw + depth, x, cw, cw
    n_out = max(4, int(round(n * 0.6)))
    outer = rr[:n_out]; inner = rr[n_out:]
    q, rem = divmod(len(outer), 4)
    sides = []; k = 0
    for s in range(4):
        cnt = q + (1 if s < rem else 0)
        sides.append(outer[k:k+cnt]); k += cnt
    top, right, bottom, left = sides
    inner_w = sum(max(a / depth, MINW) for _, a in inner) if inner else depth * 2
    core_depth = depth
    rects = {}
    c = depth + cw                       # inner offset for corridor
    def row(items, y0, x0):
        x = x0
        for nm, a in items:
            w = max(a / depth, min_w_of(nm)); rects[nm] = (x, y0, x + w, y0 + depth); x += w
        return x
    def col(items, x0, y0):
        y = y0
        for nm, a in items:
            h = max(a / depth, min_w_of(nm)); rects[nm] = (x0, y, x0 + depth, y + h); y += h
        return y
    tw = row(top, c + core_depth + cw, c)
    bw = row(bottom, 0.0, c)
    span = max(tw, bw, c + inner_w + cw)
    col(left, 0.0, c)
    col(right, span, c)
    x = c + cw
    for nm, a in inner:
        w = max(a / depth, min_w_of(nm)); rects[nm] = (x, c, x + w, c + core_depth); x += w
    W = span + depth; H = c + core_depth + cw + depth
    # ring corridor loop (rectangle between outer rooms and core)
    ry0 = c; ry1 = c + core_depth
    corr = [((c, ry0), (span, ry0)),
            ((c, ry1), (span, ry1)),
            ((c, ry0), (c, ry1)),
            ((span, ry0), (span, ry1))]
    # connection stub: extend the ring's right edge out to the wing boundary (W)
    # so the spine can branch to (W, mid). Reported as conn (W, ry0, ry1).
    cmy = (ry0 + ry1) / 2.0
    corr.append(((span, cmy), (W, cmy)))
    return rects, corr, W, H, W, ry0, ry1

def rectify(rooms, inward="right"):
    # dispatch to the internal-corridor layout for the current exterior mode.
    # returns (rects, w, h, corrs, inward_x, coll_y0, coll_y1).
    #   exterior_mode 1 (room-loaded): branch layout, collector on INWARD edge
    #     (toward building centroid) so rooms load the exterior.
    #   exterior_mode 0 (corridor-loaded): SAME reliable branch layout, but the
    #     collector/corridor is placed on the OUTWARD edge (facing the perimeter).
    #     The earlier true-ring packing stranded rooms and overlapped; this reuses
    #     the solid branch geometry with the corridor flipped outward instead.
    simple = [(r[0], r[1]) for r in rooms]
    edge = inward if EXTMODE == 1 else ("left" if inward == "right" else "right")
    rects, corrs, w, h, ix, cy0, cy1 = layout_branch(simple, CW, MAXA, inward=edge)
    return rects, w, h, corrs, ix, cy0, cy1

def mst_edges(cents):
    # minimum spanning tree over cluster centroids -> which pairs get a corridor
    n=len(cents)
    if n<=1: return set()
    intree=[False]*n; intree[0]=True; E=set()
    for _ in range(n-1):
        best=None
        for i in range(n):
            if not intree[i]: continue
            for j in range(n):
                if intree[j]: continue
                d=(cents[i][0]-cents[j][0])**2+(cents[i][1]-cents[j][1])**2
                if best is None or d<best[0]: best=(d,i,j)
        if best: E.add(frozenset((best[1],best[2]))); intree[best[2]]=True
    return E

def spread_clusters(boxes,edges,cw,iters=400,tight=0.5):
    # boxes: [cx,cy,w,h] (already include ring). Pairs joined by an MST edge get
    # a corridor gap (cw); all other pairs only need to not overlap (tight),
    # so clusters with no corridor between them sit close and align.
    for _ in range(iters):
        moved=False
        for i in range(len(boxes)):
            for j in range(i+1,len(boxes)):
                need = cw if frozenset((i,j)) in edges else tight
                ax,ay,aw,ah=boxes[i]; bx,by,bw,bh=boxes[j]
                dx=bx-ax; dy=by-ay
                ox=(aw+bw)/2.0+need-abs(dx); oy=(ah+bh)/2.0+need-abs(dy)
                if ox>0 and oy>0:
                    moved=True
                    if ox<oy:
                        s=ox/2.0*(1 if dx>=0 else -1); boxes[i][0]-=s; boxes[j][0]+=s
                    else:
                        s=oy/2.0*(1 if dy>=0 else -1); boxes[i][1]-=s; boxes[j][1]+=s
        if not moved: break
    return boxes

rects       = DataTree[rg.Rectangle3d]()
tile_rects  = DataTree[rg.Rectangle3d]()
centers_out = DataTree[rg.Point3d]()
out_labels  = DataTree[str]()
cluster_id  = DataTree[int]()
ring_crvs   = DataTree[rg.Curve]()
spine_crvs  = DataTree[rg.Curve]()
band_line_y = DataTree[float]()
_diag=[]

def tile_floor(cens,rads,labs,er,path):
    n=len(cens)
    if n==0: return
    ox=oy=oz=0.0
    if er is not None:
        try:
            o=er.Plane.Origin; ox,oy,oz=o.X,o.Y,o.Z
        except: pass
    pts=[(cens[i].X-ox,cens[i].Y-oy) for i in range(n)]
    tgt=[math.pi*rads[i]*rads[i]*SIZE_MOD for i in range(n)]
    nm=[str(labs[i]) for i in range(n)]

    k=min(KFORCE,n) if (KFORCE and KFORCE>0) else auto_k(pts)
    idx=kmeans(pts,k)

    # building centroid from cluster centroids -> each cluster aligns the edge
    # facing the centroid ("inward"). Computed from solver cluster centroids.
    cl_cents = []
    for g in idx:
        if not g: continue
        cl_cents.append((sum(pts[j][0] for j in g)/len(g),
                         sum(pts[j][1] for j in g)/len(g)))
    bldg_cx = sum(c[0] for c in cl_cents)/len(cl_cents) if cl_cents else 0.0

    # rectify each cluster (generates internal corridor), inward toward centroid
    wings=[]   # (rects, w, h, cx, cy, ci, corrs, inward_x, coll_y0, coll_y1)
    for ci,g in enumerate(idx):
        if not g: continue
        rooms=[(nm[j],tgt[j],pts[j][0],pts[j][1]) for j in g]
        cxs=sum(pts[j][0] for j in g)/len(g); cys=sum(pts[j][1] for j in g)/len(g)
        inward = "right" if cxs <= bldg_cx else "left"
        rl,w,h,corrs, inward_x, coll_y0, coll_y1 = rectify(rooms, inward=inward)
        wings.append((rl,w,h,cxs,cys,ci,corrs,inward_x,coll_y0,coll_y1))

    # place wings at solver centroids, spread with MST-aware spacing
    ring_sizes = [(w[1] + 2*CW, w[2] + 2*CW) for w in wings]  # box incl. margin
    boxes=[[w[3],w[4],ring_sizes[i][0],ring_sizes[i][1]] for i,w in enumerate(wings)]
    cents0=[(w[3],w[4]) for w in wings]
    EDGES=mst_edges(cents0)
    boxes=spread_clusters(boxes,EDGES,CW)

    plane=rg.Plane(rg.Point3d(0,0,oz),rg.Vector3d.ZAxis)
    wing_centres=[]
    collector_world=[]   # (x, y0, y1) of each wing's inward collector in world
    for (rl,w,h,ccx,ccy,ci,corrs,inward_x,coll_y0,coll_y1),bx in zip(wings,boxes):
        xo=bx[0]-w/2.0; yo=bx[1]-h/2.0
        for rnm,(x0,y0,x1,y1) in rl.items():
            wx0=x0+xo+ox; wy0=y0+yo+oy; wx1=x1+xo+ox; wy1=y1+yo+oy
            rect=rg.Rectangle3d(plane,rg.Interval(wx0,wx1),rg.Interval(wy0,wy1))
            rects.Add(rect,path); tile_rects.Add(rect,path)
            centers_out.Add(rect.Center,path); out_labels.Add(rnm,path)
            cluster_id.Add(ci,path)
            best_cy = None; best_d = 1e18
            for (c0, c1) in corrs:
                cy = c0[1] + yo + oy
                d = abs((wy0 + wy1) / 2.0 - cy)
                if d < best_d: best_d = d; best_cy = cy
            band_line_y.Add(best_cy if best_cy is not None else (wy0 + wy1) / 2.0, path)
        wing_centres.append((bx[0]+ox,bx[1]+oy))
        collector_world.append((inward_x + xo + ox, coll_y0 + yo + oy, coll_y1 + yo + oy))
        # emit this wing's INTERNAL corridor segments (stems + collector)
        for (c0, c1) in corrs:
            cx0 = c0[0] + xo + ox; cy0 = c0[1] + yo + oy
            cx1 = c1[0] + xo + ox; cy1 = c1[1] + yo + oy
            ring_crvs.Add(rg.PolylineCurve([
                rg.Point3d(cx0, cy0, oz), rg.Point3d(cx1, cy1, oz)]), path)

    # spine: run ONLY along MST edges, routed through the GAP between the two
    # wings (not through their centres, which would cross rooms). For each edge
    # we route to the facing edges of the two wing boxes and place the corridor
    # in the gap between them.
    wing_box = []
    for (rl,w,h,ccx,ccy,ci,corrs,inward_x,coll_y0,coll_y1),bx in zip(wings,boxes):
        xo=bx[0]-w/2.0; yo=bx[1]-h/2.0
        wing_box.append((xo+ox, yo+oy, xo+w+ox, yo+h+oy))

    # SPINE = two flanking trunks in the gaps OUTSIDE the cluster mass, joined
    # by cross-links, with a branch from each collector to its nearer trunk. This
    # version is connectivity-validated (all test arrangements = one network) and
    # the trunks sit beyond the outer wing edges so they do not cross rooms.
    # KNOWN LIMITATION: a collector's branch to its trunk may still clip an
    # intervening cluster in dense diagonal arrangements, and the spine does not
    # yet route through the between-column gaps (see 00_WIRING_GUIDE 'Known
    # limitations'). Building the gap-routed, both-sided-collector spine is
    # deferred pending a shared-lattice rebuild of the corridor network.
    if collector_world and wing_box:
        allx0 = min(b[0] for b in wing_box); allx1 = max(b[2] for b in wing_box)
        ally0 = min(b[1] for b in wing_box); ally1 = max(b[3] for b in wing_box)
        vertical = (ally1 - ally0) >= (allx1 - allx0)
        if vertical:
            tL = allx0 - CW; tR = allx1 + CW
            ys = []
            for (cx, cy0, cy1) in collector_world:
                ys.append(cy0); ys.append(cy1)
            y0, y1 = min(ys), max(ys)
            bp = {tL: [], tR: []}
            for (cx, cy0, cy1) in collector_world:
                cmy = (cy0 + cy1) / 2.0
                t = tL if abs(cx - tL) <= abs(cx - tR) else tR
                spine_crvs.Add(rg.PolylineCurve([
                    rg.Point3d(cx, cmy, oz), rg.Point3d(t, cmy, oz)]), path)
                bp[t].append(cmy)
            for t in (tL, tR):
                bys = sorted(set([y0, y1] + bp[t]))
                for i in range(len(bys) - 1):
                    spine_crvs.Add(rg.PolylineCurve([
                        rg.Point3d(t, bys[i], oz), rg.Point3d(t, bys[i + 1], oz)]), path)
            spine_crvs.Add(rg.PolylineCurve([
                rg.Point3d(tL, y0, oz), rg.Point3d(tR, y0, oz)]), path)
            spine_crvs.Add(rg.PolylineCurve([
                rg.Point3d(tL, y1, oz), rg.Point3d(tR, y1, oz)]), path)
        else:
            tB = ally0 - CW; tT = ally1 + CW
            bp = {tB: [], tT: []}
            for (cx, cy0, cy1) in collector_world:
                cmy = (cy0 + cy1) / 2.0
                t = tB if abs(cmy - tB) <= abs(cmy - tT) else tT
                spine_crvs.Add(rg.PolylineCurve([
                    rg.Point3d(cx, cmy, oz), rg.Point3d(cx, t, oz)]), path)
                bp[t].append(cx)
            for t in (tB, tT):
                bxs = sorted(set([allx0, allx1] + bp[t]))
                for i in range(len(bxs) - 1):
                    spine_crvs.Add(rg.PolylineCurve([
                        rg.Point3d(bxs[i], t, oz), rg.Point3d(bxs[i + 1], t, oz)]), path)
            spine_crvs.Add(rg.PolylineCurve([
                rg.Point3d(allx0, tB, oz), rg.Point3d(allx0, tT, oz)]), path)
            spine_crvs.Add(rg.PolylineCurve([
                rg.Point3d(allx1, tB, oz), rg.Point3d(allx1, tT, oz)]), path)

    _diag.append("floor %s: rooms=%d clusters=%d" % (str(path),n,len(wings)))

cpaths=list(centers.Paths); _lps=list(labels.Paths); _eps=list(env_rect.Paths)
for bi,path in enumerate(cpaths):
    cens=list(centers.Branch(path)); rads=list(radii.Branch(path))
    if labels.PathExists(path): labs=list(labels.Branch(path))
    elif bi<len(_lps): labs=list(labels.Branch(_lps[bi]))
    else: labs=[]
    er=None
    if env_rect.PathExists(path) and env_rect.Branch(path).Count>0: er=env_rect.Branch(path)[0]
    elif bi<len(_eps) and env_rect.Branch(_eps[bi]).Count>0: er=env_rect.Branch(_eps[bi])[0]
    n=min(len(cens),len(rads),len(labs))
    tile_floor(cens[:n],rads[:n],labs[:n],er,path)

_head=["clusters=%s corridor_w=%.2f size_modifier=%.3f max_aspect=%.1f exterior=%s" %
       ("auto" if not KFORCE else str(KFORCE),CW,SIZE_MOD,MAXA,
        "corridor-loaded" if EXTMODE==0 else "room-loaded")]
out="\n".join(_head+_diag)
# ---------- end _03_rect_tiler ----------
fsim_2 = FindSimilarMember(Data=_03_rect_tiler.out_labels, Set=flatten)  # -> Hit, Index; disabled
item_4 = ListItem(List=flatten_2, Index=fsim_2.Index, Wrap=True)  # disabled
number_slider_3 = Slider(-0.92, range=-10..0)  # disabled
cir = Circle(Plane=_02_floor_plan_solver.centers, Radius=_02_floor_plan_solver.radii)  # disabled
proposed_area = Panel(item_4)  # disabled
swatch_2 = ColourSwatch(SwatchColor=RGB(0, 136, 255))  # disabled
rec = Rectangle(_03_rect_tiler.rects)  # disabled
rec_2 = Rectangle(_03_rect_tiler.tile_rects)  # disabled
pt_2 = Point(_03_rect_tiler.centers_out)  # disabled
crv_3 = Curve(_03_rect_tiler.ring_crvs)  # disabled
crv_4 = Curve(_03_rect_tiler.spine_crvs)  # disabled
panel_25 = Panel(_03_rect_tiler.out)  # disabled
sqr = Square(Value=_02_floor_plan_solver.radii)  # disabled
Y = UnitY(Factor=number_slider_3)  # disabled
area = Area(Geometry=rec)  # -> Area, Centroid; disabled
assigned_actual_area = Panel(area.Area)  # disabled
preview_3 = CustomPreview(Geometry=[crv_4, crv_3], Material=swatch_2)  # disabled
tag_2 = TextTag3D(Location=pt_2, Text=_03_rect_tiler.out_labels, Size=1, Justification=8)  # disabled
pi_2 = Pi(Factor=sqr)  # disabled
number_slider_4 = Slider(-3.29, range=-10..0)  # disabled
move = Move(Geometry=pt_2, Motion=Y)  # -> Geometry, Transform; disabled
subtraction = Subtraction(A=area.Area, B=item_4)  # disabled
division_3 = Division(A=subtraction, B=item_4)  # disabled
dim = Dimensions(Surface=rec)  # -> UDimension, VDimension; disabled
roundd = RoundToDecimalPlace(NumberX=subtraction, DecimalPlace=0, RoundType=0)  # -> Rounded, Difference; disabled
Y_2 = UnitY(Factor=number_slider_4)  # disabled
multiplication = Multiplication(A=division_3, B=100)  # disabled
_04_shared_walls = Python3Script(
    rects=_03_rect_tiler.tile_rects,
    labels=_03_rect_tiler.out_labels,
    band_line_y=_03_rect_tiler.band_line_y,
    adj_a=flatten(repeat),
    adj_b=item_3,
    ring_crvs=_03_rect_tiler.ring_crvs,
    spine_crvs=_03_rect_tiler.spine_crvs)  # -> out, room_doors, corridor_doors, wall_lines, satisfied; inputs rects: tree of Rectangle3d, labels: tree of String, band_line_y: tree of Double, adj_a: list, adj_b: list, ring_crvs: tree of Curve, spine_crvs: tree; disabled
#   port rects: full tiles from tiler 'tile_rects'
#   port band_line_y: (tiler 'band_line_y' - corridor line per room)
#   port satisfied: "RoomA | RoomB" listed adjacencies with a door
# ---------- _04_shared_walls: Python ----------
#! python3
# ============================================================================
# COMPONENT 04 - DOORS (cluster/band layout)
# ----------------------------------------------------------------------------
# Two kinds of doors:
#   1) ROOM-TO-ROOM: two rooms that are a LISTED adjacency AND share a wall get
#      a door in that shared wall.
#   2) CORRIDOR: every room gets a door on the edge facing its NEAREST corridor.
#      With ring_crvs + spine_crvs wired, the door goes on whichever of the four
#      edges faces the closest corridor segment. WITHOUT them, it falls back to
#      band_line_y and can only pick top/bottom edges -> side-facing doors come
#      out wrong. The 'out' panel reports corr_segs=N and warns when it is 0.
#
# INPUTS (Tree access unless noted):
#   rects       : Rectangle  (tiler 'rects')
#   labels      : Text       (tiler 'out_labels')
#   band_line_y : double     (tiler 'band_line_y'; float hint REQUIRED, not
#                             ':object' -> else "cannot convert to Double")
#   ring_crvs   : Curve      (tiler 'ring_crvs' - stems + collectors)
#   spine_crvs  : Curve      (tiler 'spine_crvs' - trunks + branches)
#   adj_a, adj_b : List Text (reader)
#   tol         : Item (0.10)
#   min_overlap : Item (2.50)
#
# OUTPUTS (DataTrees, one branch per floor):
#   room_doors     : Point3d  room-to-room doors (listed adjacency shared walls)
#   corridor_doors : Point3d  each room's door onto its band corridor
#   wall_lines     : Line     shared wall segments for room-to-room doors
#   satisfied      : str      "A | B" listed adjacencies with a room-to-room door
#   out            : str      diagnostics
# ============================================================================
import Rhino.Geometry as rg
from Grasshopper import DataTree
from Grasshopper.Kernel.Data import GH_Path

TOL = 0.10 if tol is None else float(tol)
MIN = 2.50 if min_overlap is None else float(min_overlap)

def as_tree(x, T):
    if hasattr(x, "Paths"): return x
    t = DataTree[T]()
    if x is None: return t
    if not isinstance(x, (list, tuple)): x = [x]
    # add one item at a time and coerce, so a stray Guid/None can't abort the
    # whole AddRange (numbers may arrive wrapped depending on the pin hint)
    for it in x:
        try:
            if T is float:
                t.Add(float(it), GH_Path(0))
            elif T is str:
                t.Add(str(it), GH_Path(0))
            else:
                t.Add(it, GH_Path(0))
        except:
            pass
    return t

rects       = as_tree(rects, rg.Rectangle3d)
labels      = as_tree(labels, str)
band_line_y = as_tree(band_line_y, float)
ring_crvs   = as_tree(ring_crvs, rg.Curve)
spine_crvs  = as_tree(spine_crvs, rg.Curve)

adj_a = adj_a or []
adj_b = adj_b or []
LISTED = set(frozenset((a, b)) for a, b in zip(adj_a, adj_b))

def bounds(rc):
    return rc.X.Min, rc.X.Max, rc.Y.Min, rc.Y.Max

room_doors     = DataTree[rg.Point3d]()
corridor_doors = DataTree[rg.Point3d]()
wall_lines     = DataTree[rg.Line]()
satisfied      = DataTree[str]()
_diag = []

_rp = list(rects.Paths)
_lp = list(labels.Paths)
_bp = list(band_line_y.Paths)

for bi, path in enumerate(_rp):
    rb = list(rects.Branch(path))
    lb = list(labels.Branch(path)) if labels.PathExists(path) else (
         list(labels.Branch(_lp[bi])) if bi < len(_lp) else [])
    yb = list(band_line_y.Branch(path)) if band_line_y.PathExists(path) else (
         list(band_line_y.Branch(_bp[bi])) if bi < len(_bp) else [])
    # coerce to real python lists (a single-element branch can arrive as a scalar)
    if not isinstance(rb, list): rb = [rb] if rb is not None else []
    if not isinstance(lb, list): lb = [lb] if lb is not None else []
    if not isinstance(yb, list): yb = [yb] if yb is not None else []
    lb = [str(x) if x is not None else "" for x in lb]
    _yb = []
    for v in yb:
        try: _yb.append(float(v))
        except: pass
    yb = _yb
    n = min(len(rb), len(lb))
    if n == 0:
        continue

    try:
        z = rb[0].Plane.Origin.Z
    except:
        z = 0.0

    # collect this floor's corridor segments (ring stems/collectors + spine) as
    # 2D line endpoints, for nearest-corridor door placement
    corr_segs = []
    def _seg_from(crv):
        try:
            a = crv.PointAtStart; b = crv.PointAtEnd
            return ((a.X, a.Y), (b.X, b.Y))
        except:
            return None
    for _src in (ring_crvs, spine_crvs):
        if _src.PathExists(path):
            for _c in _src.Branch(path):
                s = _seg_from(_c)
                if s: corr_segs.append(s)

    # 1) room-to-room doors on listed-adjacency shared walls
    n_room = 0
    for i in range(n):
        ax0, ax1, ay0, ay1 = bounds(rb[i])
        for j in range(i + 1, n):
            if frozenset((lb[i], lb[j])) not in LISTED:
                continue
            bx0, bx1, by0, by1 = bounds(rb[j])
            made = False
            for xa, xb in ((ax1, bx0), (bx1, ax0)):
                if abs(xa - xb) <= TOL:
                    lo, hi = max(ay0, by0), min(ay1, by1)
                    if hi - lo >= MIN:
                        x = (xa + xb) / 2.0; ym = (lo + hi) / 2.0
                        room_doors.Add(rg.Point3d(x, ym, z), path)
                        wall_lines.Add(rg.Line(rg.Point3d(x, lo, z), rg.Point3d(x, hi, z)), path)
                        made = True
            for ya_, yb_ in ((ay1, by0), (by1, ay0)):
                if abs(ya_ - yb_) <= TOL:
                    lo, hi = max(ax0, bx0), min(ax1, bx1)
                    if hi - lo >= MIN:
                        y = (ya_ + yb_) / 2.0; xm = (lo + hi) / 2.0
                        room_doors.Add(rg.Point3d(xm, y, z), path)
                        wall_lines.Add(rg.Line(rg.Point3d(lo, y, z), rg.Point3d(hi, y, z)), path)
                        made = True
            if made:
                satisfied.Add(lb[i] + " | " + lb[j], path)
                n_room += 1

    # 2) corridor door for every room, on the edge nearest its band line
    # If band_line_y didn't arrive (empty/misaligned), fall back to the mean Y
    # of all rooms on the floor as the corridor reference.
    if yb and len(yb) >= n:
        band_ref = None
    else:
        _ys = [(bounds(rb[i])[2] + bounds(rb[i])[3]) / 2.0 for i in range(n)]
        band_ref = sum(_ys) / len(_ys) if _ys else 0.0
        _diag.append("  note: band_line_y missing/short (%d vs %d rooms) -> using floor mean Y"
                     % (len(yb), n))

    n_corr = 0
    for i in range(n):
        x0, x1, y0, y1 = bounds(rb[i])
        cx = (x0 + x1) / 2.0; cy = (y0 + y1) / 2.0
        placed_door = False

        # preferred: put the door on the edge facing the NEAREST corridor segment
        if corr_segs:
            best = None
            for (a, b) in corr_segs:
                ax, ay = a; bx, by = b
                dx = bx - ax; dy = by - ay
                L2 = dx * dx + dy * dy
                t = 0.0 if L2 == 0 else max(0.0, min(1.0, ((cx-ax)*dx + (cy-ay)*dy)/L2))
                qx = ax + t*dx; qy = ay + t*dy
                d = (qx-cx)**2 + (qy-cy)**2
                if best is None or d < best[0]:
                    best = (d, qx, qy)
            if best is not None:
                _, qx, qy = best
                # corridor to the side -> left/right edge; else top/bottom
                if abs(qx - cx) > abs(qy - cy):
                    ex = x1 if qx > cx else x0
                    corridor_doors.Add(rg.Point3d(ex, cy, z), path)
                else:
                    ey = y1 if qy > cy else y0
                    corridor_doors.Add(rg.Point3d(cx, ey, z), path)
                placed_door = True
                n_corr += 1

        # fallback: band_line_y (or floor mean Y) picks the nearest horizontal edge
        if not placed_door:
            # No corridor geometry available (ring_crvs/spine_crvs not wired).
            # Fall back to band_line_y, but choose among ALL FOUR edges the one
            # nearest the band reference, not just top/bottom.
            by = yb[i] if (band_ref is None and i < len(yb)) else band_ref
            if by is None:
                by = cy
            # distance from each edge-midpoint to the band line (a horizontal ref)
            cands = [
                (abs(y0 - by), (cx, y0)),   # bottom edge
                (abs(y1 - by), (cx, y1)),   # top edge
            ]
            # if the band ref is essentially at this room's own y, the corridor is
            # more likely to the side; include left/right as tie-breakers
            best_edge = min(cands, key=lambda c: c[0])[1]
            corridor_doors.Add(rg.Point3d(best_edge[0], best_edge[1], z), path)
            n_corr += 1

    _diag.append("floor %s: rooms=%d room_doors=%d corridor_doors=%d corr_segs=%d%s"
                 % (str(path), n, n_room, n_corr, len(corr_segs),
                    "" if corr_segs else "  <-- NO corridor geometry: wire ring_crvs + spine_crvs into 04 so doors face the nearest corridor"))

_head = ["listed adjacency pairs: %d" % len(LISTED)]
out = "\n".join(_head + _diag)
# ---------- end _04_shared_walls ----------
_05_corridors = Python3Script(spine_crvs=_03_rect_tiler.spine_crvs, ring_crvs=crv_3)  # -> out, corridor_network; inputs spine_crvs: tree of Curve, ring_crvs: tree of Curve; disabled
#   port spine_crvs: (tiler 'spine_crvs' - per-band corridor lines)
#   port corridor_network: the unified, connected corridor network
# ---------- _05_corridors: Python ----------
#! python3
# ============================================================================
# COMPONENT 05 - CORRIDOR NETWORK
# ----------------------------------------------------------------------------
# The tiler emits a corridor network connected BY CONSTRUCTION:
#   - internal stems per cluster (ring_crvs), each ending on the cluster's
#     inward-edge COLLECTOR (also in ring_crvs, split at each stem so endpoints
#     coincide),
#   - a SPINE (spine_crvs) of two flanking trunks joined by cross-links, with a
#     branch from each collector to its nearer trunk.
# Because the tiler places all these on exact shared coordinates, no tolerance
# welding is needed. This component merges the curves into one network and
# reports connectivity (welding only as a verification safeguard).
#
# INPUTS (Tree access):
#   ring_crvs  : Curve   internal stems + collectors (from tiler)
#   spine_crvs : Curve   between-cluster spine + collector connectors
#   weld_tol   : Item    tolerance for the connectivity check (default 0.5)
#
# OUTPUTS (DataTrees, one branch per floor):
#   corridor_network : Curve  unified network
#   out              : str    diagnostics / connectivity
# ============================================================================
import math
import Rhino.Geometry as rg
from Grasshopper import DataTree
from Grasshopper.Kernel.Data import GH_Path

TOL = 0.5 if weld_tol is None else float(weld_tol)

def as_tree(x, T):
    if hasattr(x, "Paths"): return x
    t = DataTree[T]()
    if x is None: return t
    if not isinstance(x, (list, tuple)): x = [x]
    for it in x:
        try: t.Add(it, GH_Path(0))
        except: pass
    return t

ring_crvs  = as_tree(ring_crvs, rg.Curve)
spine_crvs = as_tree(spine_crvs, rg.Curve)

corridor_network = DataTree[rg.Curve]()
_diag = []

def endpoints(c):
    try:
        a = c.PointAtStart; b = c.PointAtEnd
        return (a.X, a.Y), (b.X, b.Y)
    except:
        return None

paths = set()
for p in ring_crvs.Paths: paths.add(p)
for p in spine_crvs.Paths: paths.add(p)

for path in sorted(paths, key=lambda p: p.ToString()):
    segs = []
    nr = ns = 0
    if ring_crvs.PathExists(path):
        for c in ring_crvs.Branch(path):
            corridor_network.Add(c, path); nr += 1
            ep = endpoints(c)
            if ep: segs.append(ep)
    if spine_crvs.PathExists(path):
        for c in spine_crvs.Branch(path):
            corridor_network.Add(c, path); ns += 1
            ep = endpoints(c)
            if ep: segs.append(ep)

    # connectivity check via spatial welding (verification only)
    def key(p): return (round(p[0] / TOL), round(p[1] / TOL))
    graph = {}
    for a, b in segs:
        ka, kb = key(a), key(b)
        graph.setdefault(ka, set()).add(kb)
        graph.setdefault(kb, set()).add(ka)
    comps = 0
    seen = set()
    for node in graph:
        if node in seen: continue
        comps += 1
        stack = [node]; seen.add(node)
        while stack:
            u = stack.pop()
            for v in graph[u]:
                if v not in seen: seen.add(v); stack.append(v)
    connected = (comps <= 1)
    _diag.append("floor %s: stems+collectors=%d spine=%d components=%d connected=%s"
                 % (str(path), nr, ns, comps, connected))
    if not connected:
        _diag.append("  (note: %d disconnected groups - check diagonal wing junctions)" % comps)

out = "\n".join(_diag) if _diag else "no corridors received"
# ---------- end _05_corridors ----------
_06_vertical_cores = Python3Script(
    centers=_03_rect_tiler.centers_out,
    labels=_03_rect_tiler.out_labels,
    env_rect=_02_floor_plan_solver.env_rect,
    vlink_a=flatten(repeat),
    vlink_b=flatten(item_3))  # -> out, core_pts, core_rects, core_assign, core_count; inputs centers: tree of Point3d, labels: tree of String, env_rect: tree of Rectangle3d, vlink_a: list of String, vlink_b: list of String; disabled
# ---------- _06_vertical_cores: Python ----------
#! python3
# ============================================================================
# COMPONENT 06 — VERTICAL CORES (cross-floor set-cover, arrangement-aware)
# ----------------------------------------------------------------------------
# Places the MINIMUM number of vertical cores (stair / elevator) such that every
# room involved in a vertical adjacency sits within max_dist of a core.
#
# CRITICAL: cores must stack at the same (x,y) in the REAL building. The solver
# may have offset floors for drawing (spread mode = XY offset, stacked mode = Z
# offset). This component therefore converts every room to FLOOR-LOCAL
# coordinates (subtracting each floor's arrangement offset), solves the cover
# there, then re-emits the cores in world coordinates for every floor.
#
# INPUTS:
#   centers  : Tree Access (Point3d)   — tiler 'centers_out' (one branch/floor)
#   labels   : Tree Access (Text)      — tiler 'out_labels'
#   env_rect : Tree Access (Rectangle) — solver 'env_rect' (gives floor offsets)
#   vlink_a, vlink_b : List Access     — vertical adjacency pairs (reader)
#   max_dist : Item Access (default 75.0) max plan distance room -> core
#   core_size: Item Access (default 12.0) core footprint side length
#
# OUTPUTS:
#   core_pts    : Tree[Point3d]     core locations, one branch per floor
#                                   (same (x,y) per floor + that floor's offset)
#   core_rects  : Tree[Rectangle3d] core footprints for drawing
#   core_assign : Tree[str]         "RoomName -> core{i}"
#   core_count  : int               number of cores (minimized)
#   out         : str               diagnostics (wire to a Panel)
# ============================================================================
import math
import Rhino.Geometry as rg
from Grasshopper import DataTree
from Grasshopper.Kernel.Data import GH_Path

MAXD = 75.0 if max_dist  is None else float(max_dist)
CSIZE = 12.0 if core_size is None else float(core_size)

def as_tree(x, T):
    if hasattr(x, "Paths"):
        return x
    t = DataTree[T]()
    if x is None:
        return t
    if not isinstance(x, (list, tuple)):
        x = [x]
    t.AddRange(x, GH_Path(0))
    return t

centers  = as_tree(centers,  rg.Point3d)
labels   = as_tree(labels,   str)
env_rect = as_tree(env_rect, rg.Rectangle3d)

vlink_a = vlink_a or []
vlink_b = vlink_b or []

_diag = []

# --- per-floor arrangement offsets from env_rect plane origins ---------------
cpaths = list(centers.Paths)
epaths = list(env_rect.Paths)
offsets = {}          # branch index -> (ox, oy, oz)
for bi, p in enumerate(cpaths):
    ox = oy = oz = 0.0
    er = None
    if env_rect.PathExists(p) and env_rect.Branch(p).Count > 0:
        er = env_rect.Branch(p)[0]
    elif bi < len(epaths) and env_rect.Branch(epaths[bi]).Count > 0:
        er = env_rect.Branch(epaths[bi])[0]
    if er is not None:
        try:
            o = er.Plane.Origin
            ox, oy, oz = o.X, o.Y, o.Z
        except:
            pass
    offsets[bi] = (ox, oy, oz)

if not offsets:
    _diag.append("!! no floors found on 'centers'")

# --- collect rooms in FLOOR-LOCAL coordinates -------------------------------
# local = world - that floor's arrangement offset. Rooms at the same building
# position on different floors therefore land on the same local (x,y).
local = {}        # (branch_index, name) -> (lx, ly)
name_floors = {}  # name -> list of branch indices
for bi, p in enumerate(cpaths):
    cb = list(centers.Branch(p))
    if labels.PathExists(p):
        lb = list(labels.Branch(p))
    else:
        lps = list(labels.Paths)
        lb = list(labels.Branch(lps[bi])) if bi < len(lps) else []
    lb = [str(x) if x is not None else "" for x in lb]
    ox, oy, oz = offsets.get(bi, (0.0, 0.0, 0.0))
    for i in range(min(len(cb), len(lb))):
        nm = lb[i]
        if not nm:
            continue
        local[(bi, nm)] = (cb[i].X - ox, cb[i].Y - oy)
        name_floors.setdefault(nm, []).append(bi)

# --- rooms participating in a vertical link ---------------------------------
linked = []       # (branch_index, name, lx, ly)
seen = set()
for a, b in zip(vlink_a, vlink_b):
    for nm in (a, b):
        if nm in name_floors:
            for bi in name_floors[nm]:
                key = (bi, nm)
                if key in local and key not in seen:
                    seen.add(key)
                    lx, ly = local[key]
                    linked.append((bi, nm, lx, ly))

_diag.append("floors: %d, rooms total: %d, vertical-link rooms: %d"
             % (len(cpaths), len(local), len(linked)))
if not linked:
    _diag.append("!! no vertical-link rooms matched. Check vlink_a/vlink_b names")
    _diag.append("   match the room names from the tiler labels.")

# --- greedy set-cover in FLOOR-LOCAL space ----------------------------------
def dist(p, q):
    return math.hypot(p[0] - q[0], p[1] - q[1])

uncovered = list(range(len(linked)))
core_xy = []            # local (x,y) per core
assign_txt = []         # "name -> coreN"
guard = 0
while uncovered and guard < 500:
    guard += 1
    best_ctr, best_cov = None, []
    for si in uncovered:
        sp = (linked[si][2], linked[si][3])
        cand = [i for i in uncovered if dist(sp, (linked[i][2], linked[i][3])) <= MAXD]
        if not cand:
            continue
        cx = sum(linked[i][2] for i in cand) / len(cand)
        cy = sum(linked[i][3] for i in cand) / len(cand)
        ctr = (cx, cy)
        cov = [i for i in cand if dist(ctr, (linked[i][2], linked[i][3])) <= MAXD]
        if len(cov) > len(best_cov):
            best_cov, best_ctr = cov, ctr
    if best_ctr is None:
        i = uncovered[0]
        best_ctr, best_cov = (linked[i][2], linked[i][3]), [i]
    ci = len(core_xy)
    core_xy.append(best_ctr)
    for i in best_cov:
        assign_txt.append("%s (floor %d) -> core%d" % (linked[i][1], linked[i][0], ci))
    uncovered = [i for i in uncovered if i not in set(best_cov)]

core_count = len(core_xy)
_diag.append("cores placed: %d (max_dist=%.1f)" % (core_count, MAXD))

# --- emit cores in WORLD coords, on EVERY floor -----------------------------
core_pts    = DataTree[rg.Point3d]()
core_rects  = DataTree[rg.Rectangle3d]()
core_assign = DataTree[str]()

half = CSIZE / 2.0
for bi, p in enumerate(cpaths):
    ox, oy, oz = offsets.get(bi, (0.0, 0.0, 0.0))
    plane = rg.Plane(rg.Point3d(0, 0, oz), rg.Vector3d.ZAxis)
    for (lx, ly) in core_xy:
        wx, wy = lx + ox, ly + oy
        core_pts.Add(rg.Point3d(wx, wy, oz), p)
        core_rects.Add(rg.Rectangle3d(plane,
                        rg.Interval(wx - half, wx + half),
                        rg.Interval(wy - half, wy + half)), p)

for s in assign_txt:
    core_assign.Add(s, GH_Path(0))

out = "\n".join(_diag)
# ---------- end _06_vertical_cores ----------
larger = LargerThan(FirstNumber=dim.UDimension, SecondNumber=dim.VDimension)  # -> LargerThan, OrEqualTo; disabled
move_2 = Move(Geometry=pt_2, Motion=Y_2)  # -> Geometry, Transform; disabled
concat = Concatenate(FragmentA=roundd.Rounded, FragmentB="sq.ft. off")  # disabled
concat_2 = Concatenate(FragmentA=multiplication, FragmentB="%")  # disabled
crv_5 = Curve(_05_corridors.corridor_network)  # disabled
panel_26 = Panel(_04_shared_walls.out)  # disabled
swatch_3 = ColourSwatch(SwatchColor=RGB(221, 0, 255))  # disabled
swatch_4 = ColourSwatch(SwatchColor=RGB(255, 0, 0))  # disabled
panel_27 = Panel(_05_corridors.out)  # disabled
tag_3 = TextTag3D(Location=move.Geometry, Text=concat, Size=1, Justification=2)  # disabled
tag_4 = TextTag3D(Location=move_2.Geometry, Text=concat_2, Size=1, Justification=2)  # disabled
preview_4 = CustomPreview(Geometry=crv_5, Material=swatch_2)  # disabled
preview_5 = CustomPreview(Geometry=_04_shared_walls.room_doors, Material=swatch_3)  # disabled
preview_6 = CustomPreview(Geometry=_04_shared_walls.corridor_doors, Material=swatch_4)  # disabled

# ---- group: Claude Code Attempt V0.1
flatten_3 = FlattenTree(Tree=repeat_2, Path="{0}")  # disabled
flatten_4 = FlattenTree(Tree=repeat, Path="{0}")  # disabled
toggle_3 = BooleanToggle(True)  # disabled
item_5 = ListItem(List=flatten(repeat), Index=fsim.Index, Wrap=True)  # disabled
toggle_4 = BooleanToggle(True)  # disabled
floor_plan_solver = Python3Script(
    names=flatten(repeat),
    areas=flatten(repeat_2),
    floors=flatten(repeat_4),
    adj_a=flatten(repeat),
    adj_b=item_5,
    arrange_mode=toggle_3)  # -> out, centers, radii, labels, floor_id, env_rect; inputs names: list, areas: list, floors: list, adj_a: list, adj_b: list; disabled; same code as _02_floor_plan_solver
rect_tiler = Python3Script(
    centers=floor_plan_solver.centers,
    radii=floor_plan_solver.radii,
    labels=floor_plan_solver.labels,
    env_rect=floor_plan_solver.env_rect,
    corridor_w=4,
    adj_a=flatten(repeat),
    adj_b=item_5,
    snap_to_adjacent=toggle_4)  # -> out, rects, tile_rects, centers_out, out_labels; inputs centers: tree of Point3d, radii: tree of Double, labels: tree of String, env_rect: tree of Rectangle3d, room_min_w: tree, room_min_l: tree, adj_a: list, adj_b: list, snap_to_adjacent: Boolean; disabled
#   port env_rect: (default 1.2 room width/height ratio)
#   port rects: (for shared-wall + sheet layout)
#   port tile_rects: FULL tiles before inset (for shared-edge/doors)
#   port centers_out: (for corridor router — marshals cleanly)
# ---------- rect_tiler: Python ----------
#! python3
# ============================================================================
# COMPONENT 03 (REPLACEMENT) — SLICE-AND-DICE TILER
# ----------------------------------------------------------------------------
# Replaces the old bubble->bbox rectangularize, which produced overlapping,
# gapped rectangles (Voronoi cells don't rectangularize cleanly). This tiles
# each floor's envelope into a GAPLESS, NON-OVERLAPPING set of rectangles with
# EXACT target areas, ordered by the bubble-solver seed positions so that
# rooms the solver placed near each other stay spatially adjacent.
#
# Guarantees, by construction:
#   - rooms tile the envelope exactly  (no gaps)
#   - rooms never overlap
#   - each room's rectangle area == its target area  (zero area error)
#
# INPUTS:
#   centers  : Tree Access (Point3d) — bubble-solver seed positions (ordering)
#   radii    : Tree Access (double)  — used to recover target area = pi*r^2
#   labels   : Tree Access (Text)    — room names
#   env_rect : Tree Access (Rectangle) — per-floor envelope from the solver
#       -> set type hints: centers=Point3d, radii=double, labels=Text,
#          env_rect=Rectangle ; all access = Tree
#   corridor_w  : Item Access (default 1.2) — width of reserved circulation gaps
#   size_modifier : Item Access (default 1.05) — multiplies each room's program
#                 area up front, padding for circulation before inset reclaims it
#   area_safety : Item Access (default 1.05) — extra room-area cushion on top of
#                 the perimeter-aware inflation
#   min_width_default : Item Access (default 5.0) — minimum SHORT side for any
#                 room that has no explicit override
#   max_aspect  : Item Access (optional, blank = off) — cap on long/short side
#                 ratio. Recommended 4.0: caps proportions at 4:1 for ~2% mean
#                 area cost. Tighter values (2.5) cost much more area (~7% mean,
#                 30%+ on the worst rooms), so prefer 3.5-4.0.
#   room_min_w  : List/Tree (optional) — per-room minimum WIDTH, aligned with
#                 'labels'. Blank/0 entries fall back to min_width_default.
#   room_min_l  : List/Tree (optional) — per-room minimum LENGTH, aligned with
#                 'labels'. Blank/0 = NO length constraint (no default).
#   adj_a, adj_b : List Access (optional) — listed adjacency pairs from the
#                 reader. Used for SNAPPING: a room sharing a tile edge with a
#                 listed neighbour is pushed against that edge instead of
#                 floating in the middle of its slice.
#   snap_to_adjacent : Item (default True) — enable/disable the snapping above.
#
# Rooms are INFLATED per-room before tiling, then each room is FITTED to its
# true target area inside its slice, respecting the minimum width/length.
#
# GUARANTEES:
#   - rooms never overlap
#   - no room is narrower than its minimum width
#   - room areas land close to target (typically within a few percent)
# NOT guaranteed: perfect envelope fill. Gaps are permitted and expected —
# leaving a gap is preferred over stretching a room into an unusable sliver.
#
# OUTPUTS (DataTrees, one branch per floor):
#   rects        : Rectangle3d  — final room rectangles
#   tile_rects   : Rectangle3d  — FULL tiles before fitting (shared-edge/doors)
#   centers_out  : Point3d      — room centers
#   out_labels   : str
#   out          : str          — diagnostics (wire to a Panel)
# ============================================================================
import math
import Rhino.Geometry as rg
from Grasshopper import DataTree
from Grasshopper.Kernel.Data import GH_Path

def as_tree(x, T):
    if hasattr(x, "Paths"):
        return x
    t = DataTree[T]()
    if x is None:
        return t
    if not isinstance(x, (list, tuple)):
        x = [x]
    t.AddRange(x, GH_Path(0))
    return t

centers  = as_tree(centers,  rg.Point3d)
radii    = as_tree(radii,    float)
labels   = as_tree(labels,   str)
env_rect = as_tree(env_rect, rg.Rectangle3d)

CW = 1.2  if corridor_w  is None else float(corridor_w)
SAFETY = 1.05 if area_safety is None else float(area_safety)
SIZE_MOD = 1.05 if size_modifier is None else float(size_modifier)
MIN_W_DEFAULT = 5.0 if min_width_default is None else float(min_width_default)
MAX_ASPECT = None if max_aspect is None else float(max_aspect)
SNAP_ADJ = True if snap_to_adjacent is None else bool(snap_to_adjacent)
EDGE_TOL = 0.11
AUTO_ENV = True if auto_envelope is None else bool(auto_envelope)
ENV_HEADROOM = 1.10 if env_headroom is None else float(env_headroom)
CORRIDOR_EDGE_FRAC = 0.6      # est. share of room edges needing a corridor setback
_env_report = []

# listed adjacency pairs — rooms sharing a tile edge with a listed neighbour are
# pushed AGAINST that edge (no corridor needed between them)
_aa = adj_a or []
_ab = adj_b or []
LISTED_PAIRS = set()
for _a, _b in zip(_aa, _ab):
    if _a is not None and _b is not None:
        LISTED_PAIRS.add(frozenset((str(_a), str(_b))))

# --- per-room minimum width / length overrides -------------------------------
# room_min_w / room_min_l are optional parallel lists (or trees) aligned with
# 'labels'. Blank / 0 / None entries fall back to the default (width) or to
# "no constraint" (length). Length has NO default by design.
def flat(x):
    if x is None:
        return []
    if hasattr(x, "Paths"):
        o = []
        for p in x.Paths:
            o.extend(list(x.Branch(p)))
        return o
    if not isinstance(x, (list, tuple)):
        return [x]
    return list(x)

_mw_raw = flat(room_min_w)
_ml_raw = flat(room_min_l)
_lbl_flat = flat(labels)

MINW_BY_NAME = {}
MINL_BY_NAME = {}
for i, nm in enumerate(_lbl_flat):
    if nm is None:
        continue
    nm = str(nm)
    if i < len(_mw_raw):
        v = _mw_raw[i]
        try:
            v = float(v)
            if v > 0:
                MINW_BY_NAME[nm] = v
        except:
            pass
    if i < len(_ml_raw):
        v = _ml_raw[i]
        try:
            v = float(v)
            if v > 0:
                MINL_BY_NAME[nm] = v
        except:
            pass

def min_w_of(name):
    return MINW_BY_NAME.get(name, MIN_W_DEFAULT)

def min_l_of(name):
    return MINL_BY_NAME.get(name, None)   # no default length

# --- recursive slice-and-dice (minimum-width + area-demand aware) ------------
# A slice must be (a) thick enough to host its rooms at their minimum width plus
# the corridor gap, AND (b) large enough in AREA for the rooms assigned to it.
# Checking thickness alone is not sufficient: a slice can be wide enough yet far
# too small in area, which starves its rooms and produces huge area deficits.
def _need_thick(items):
    return max(min_w_of(it[0]) for it in items) + CW

def _need_area(items):
    # each room needs at least its own area, and at least a minimum footprint
    tot = 0.0
    for it in items:
        mw = min_w_of(it[0])
        tot += max(it[1], mw * mw)
    return tot

def subdivide(items, x0, y0, x1, y1, out):
    """items: list of (name, area, cx, cy). Emits (name, x0, y0, x1, y1)."""
    if len(items) == 1:
        out.append((items[0][0], x0, y0, x1, y1))
        return

    w = x1 - x0
    h = y1 - y0
    total = sum(it[1] for it in items)

    def plan(axis):
        """Median-area cut along this axis -> (k, frac, ok)."""
        if axis == "x":
            items.sort(key=lambda it: it[2])
        else:
            items.sort(key=lambda it: it[3])
        half_a = total / 2.0
        acc = 0.0
        k = 0
        for i, it in enumerate(items):
            if acc + it[1] / 2.0 > half_a and i > 0:
                break
            acc += it[1]
            k = i + 1
        k = max(1, min(len(items) - 1, k))
        frac = sum(it[1] for it in items[:k]) / total
        span  = w if axis == "x" else h
        other = h if axis == "x" else w
        s1 = span * frac
        s2 = span - s1
        ok = (s1 >= _need_thick(items[:k]) and
              s2 >= _need_thick(items[k:]) and
              s1 * other >= _need_area(items[:k]) * 0.95 and
              s2 * other >= _need_area(items[k:]) * 0.95)
        return k, frac, ok

    order = ["x", "y"] if w >= h else ["y", "x"]
    chosen = None
    for axis in order:
        k, frac, ok = plan(axis)
        if ok:
            chosen = (axis, k, frac)
            break

    if chosen is None:
        # No cut satisfies both thickness and area. Cut the longer axis at the
        # area-proportional point, clamped so neither side is too thin. We never
        # fall back to an even split: that ignores area entirely and was the
        # cause of very large area deficits.
        axis = order[0]
        span = w if axis == "x" else h
        if axis == "x":
            items.sort(key=lambda it: it[2])
        else:
            items.sort(key=lambda it: it[3])
        half_a = total / 2.0
        acc = 0.0
        k = 0
        for i, it in enumerate(items):
            if acc + it[1] / 2.0 > half_a and i > 0:
                break
            acc += it[1]
            k = i + 1
        k = max(1, min(len(items) - 1, k))
        frac = sum(it[1] for it in items[:k]) / total
        n1 = _need_thick(items[:k])
        n2 = _need_thick(items[k:])
        if span >= n1 + n2:
            frac = min(max(frac, n1 / span), 1.0 - n2 / span)
        chosen = (axis, k, frac)

    axis, k, frac = chosen
    if axis == "x":
        items.sort(key=lambda it: it[2])
    else:
        items.sort(key=lambda it: it[3])
    left  = items[:k]
    right = items[k:]

    if axis == "x":
        xm = x0 + w * frac
        subdivide(left,  x0, y0, xm, y1, out)
        subdivide(right, xm, y0, x1, y1, out)
    else:
        ym = y0 + h * frac
        subdivide(left,  x0, y0, x1, ym, out)
        subdivide(right, x0, ym, x1, y1, out)

# global map of room name -> true target area, filled per floor; used by the
# diagnostics at the end to report actual-vs-target deviation.
_target_all = {}

# --- tile one floor ----------------------------------------------------------
def tile_floor(cens, rads, labs, er, out_path,
               t_rects, t_tiles, t_centers, t_labels):
    if not cens:
        return

    # TRUE target areas from the seed radii, times the user size modifier
    # (1.05 default: pads program area for circulation before inset reclaims it)
    targets = [math.pi * r * r * SIZE_MOD for r in rads]
    ntot = len(targets)

    # envelope bounds (world) --------------------------------------------------
    if er is not None:
        o = er.Plane.Origin
        ox, oy, oz = o.X, o.Y, o.Z
        ex0, ex1 = ox + er.X.Min, ox + er.X.Max
        ey0, ey1 = oy + er.Y.Min, oy + er.Y.Max
        ez = oz
    else:
        approx = sum(((math.sqrt(t) + CW/2.0) ** 2) for t in targets)
        s = math.sqrt(approx) if approx > 0 else 1.0
        cx = sum(c.X for c in cens) / len(cens)
        cy = sum(c.Y for c in cens) / len(cens)
        ez = cens[0].Z
        ex0, ex1, ey0, ey1 = cx - s/2, cx + s/2, cy - s/2, cy + s/2

    env_area = (ex1 - ex0) * (ey1 - ey0)
    half = CW / 2.0

    # ---- envelope capacity check --------------------------------------------
    # The envelope must hold: every room's target area, PLUS the area consumed
    # by corridor setbacks, PLUS any area forced by minimum widths. If it can't,
    # every room shrinks and the LARGE rooms absorb most of the loss in absolute
    # terms (a 850 sf classroom losing 25% loses 210 sf; a 50 sf closet loses 12).
    # Growing the envelope is the only real fix, so do it unless told not to.
    demand_area = 0.0
    for i in range(ntot):
        mw = min_w_of(labs[i])
        demand_area += max(targets[i], mw * mw)
    # corridor setback cost: roughly half-corridor along each room's perimeter.
    # With per-edge insetting only some edges are set back, so use a fraction.
    setback_cost = 0.0
    for t in targets:
        hh = math.sqrt(t / 1.4); ww = 1.4 * hh
        setback_cost += (2.0 * half * (ww + hh) - 4.0 * half * half) * CORRIDOR_EDGE_FRAC
    needed = (demand_area + setback_cost) * ENV_HEADROOM

    _env_grew = 0.0
    if AUTO_ENV and env_area > 0 and needed > env_area:
        g = math.sqrt(needed / env_area)
        cx = (ex0 + ex1) / 2.0
        cy = (ey0 + ey1) / 2.0
        hw = (ex1 - ex0) * g / 2.0
        hh2 = (ey1 - ey0) * g / 2.0
        ex0, ex1 = cx - hw, cx + hw
        ey0, ey1 = cy - hh2, cy + hh2
        _env_grew = g
        env_area = (ex1 - ex0) * (ey1 - ey0)
    _env_report.append((str(out_path), env_area, needed, _env_grew))

    def do_tile(inflate):
        tinf = sum(inflate)
        sc = env_area / tinf if tinf > 0 else 1.0
        its = [(labs[i], inflate[i] * sc, cens[i].X, cens[i].Y) for i in range(ntot)]
        o = []
        subdivide(its, ex0, ey0, ex1, ey1, o)
        return o

    # name -> true target area (used by the fitting step below)
    target_by_name = {}
    for i in range(ntot):
        target_by_name[labs[i]] = targets[i]
        _target_all[labs[i]] = targets[i]

    # initial perimeter-aware inflation, then one correction pass so the SLICES
    # are sized sensibly. Final room area is set by the fitting step below, so
    # heavy iteration here is unnecessary.
    inflate = [((math.sqrt(t) + half) ** 2) * SAFETY for t in targets]
    out = do_tile(inflate)
    for _ in range(1):
        post = {}
        for name, x0, y0, x1, y1 in out:
            w = max((x1 - x0) - CW, 0.5)
            h = max((y1 - y0) - CW, 0.5)
            post[name] = w * h
        new_inflate = []
        for i in range(ntot):
            actual = post.get(labs[i], targets[i])
            new_inflate.append(inflate[i] * (targets[i] / max(actual, 1e-6)))
        inflate = new_inflate
        out = do_tile(inflate)

    # ---- per-edge inset: only set back edges that actually need a corridor --
    # An edge shared with a LISTED adjacency needs no corridor: the two rooms
    # should touch (shared wall + door). Every other edge gets the half-corridor
    # setback. This both compacts the plan and returns the area that a blanket
    # inset would have thrown away (~11% of program area in testing).
    tile_by_name = {}
    for name, x0, y0, x1, y1 in out:
        tile_by_name[name] = (x0, y0, x1, y1)

    def edge_insets(name, x0, y0, x1, y1):
        """Return (left, right, bottom, top) inset amounts for this tile."""
        L = R = B = T = half            # default: corridor setback
        if SNAP_ADJ:
            for onm, (ox0, oy0, ox1, oy1) in tile_by_name.items():
                if onm == name:
                    continue
                if frozenset((name, onm)) not in LISTED_PAIRS:
                    continue
                # shared vertical edges
                if abs(ox1 - x0) <= EDGE_TOL and min(y1, oy1) - max(y0, oy0) > 2.5:
                    L = 0.0
                if abs(ox0 - x1) <= EDGE_TOL and min(y1, oy1) - max(y0, oy0) > 2.5:
                    R = 0.0
                # shared horizontal edges
                if abs(oy1 - y0) <= EDGE_TOL and min(x1, ox1) - max(x0, ox0) > 2.5:
                    B = 0.0
                if abs(oy0 - y1) <= EDGE_TOL and min(x1, ox1) - max(x0, ox0) > 2.5:
                    T = 0.0
        return L, R, B, T

    plane = rg.Plane(rg.Point3d(0, 0, ez), rg.Vector3d.ZAxis)
    for name, x0, y0, x1, y1 in out:
        tile = rg.Rectangle3d(plane, rg.Interval(x0, x1), rg.Interval(y0, y1))

        iL, iR, iB, iT = edge_insets(name, x0, y0, x1, y1)
        ax0, ax1 = x0 + iL, x1 - iR
        ay0, ay1 = y0 + iB, y1 - iT
        availw = max(ax1 - ax0, 0.0)
        availh = max(ay1 - ay0, 0.0)

        tgt  = target_by_name.get(name, availw * availh)
        minw = min_w_of(name)
        minl = min_l_of(name)

        # Shrink the available rectangle proportionally down to the target area,
        # so the room keeps its slice's proportions and stays compact.
        rw, rh = availw, availh
        if availw > 1e-9 and availh > 1e-9:
            slice_area = availw * availh
            if tgt < slice_area:
                k = math.sqrt(tgt / slice_area)
                rw, rh = availw * k, availh * k
            if min(rw, rh) < minw:
                if rw < rh:
                    rw = min(minw, availw)
                    rh = min(tgt / rw if rw > 1e-9 else rh, availh)
                else:
                    rh = min(minw, availh)
                    rw = min(tgt / rh if rh > 1e-9 else rw, availw)
            if minl is not None:
                if rw >= rh:
                    rw = min(max(rw, minl), availw)
                    rh = min(tgt / rw if rw > 1e-9 else rh, availh)
                else:
                    rh = min(max(rh, minl), availh)
                    rw = min(tgt / rh if rh > 1e-9 else rw, availw)

        rw = min(rw, availw)
        rh = min(rh, availh)

        if MAX_ASPECT is not None and rw > 1e-9 and rh > 1e-9:
            if rw / rh > MAX_ASPECT:
                rw = min(rw, rh * MAX_ASPECT)
            elif rh / rw > MAX_ASPECT:
                rh = min(rh, rw * MAX_ASPECT)

        # Anchor against the edges that have NO setback, so the room actually
        # touches its listed neighbours instead of floating in the middle.
        if iL == 0.0 and iR > 0.0:   ix0 = ax0
        elif iR == 0.0 and iL > 0.0: ix0 = ax1 - rw
        else:                        ix0 = (ax0 + ax1) / 2.0 - rw / 2.0
        if iB == 0.0 and iT > 0.0:   iy0 = ay0
        elif iT == 0.0 and iB > 0.0: iy0 = ay1 - rh
        else:                        iy0 = (ay0 + ay1) / 2.0 - rh / 2.0

        ix1 = ix0 + rw
        iy1 = iy0 + rh
        if ix1 - ix0 < 0.5:
            cx = (ax0 + ax1) / 2.0; ix0, ix1 = cx - 0.25, cx + 0.25
        if iy1 - iy0 < 0.5:
            cy = (ay0 + ay1) / 2.0; iy0, iy1 = cy - 0.25, cy + 0.25
        room = rg.Rectangle3d(plane, rg.Interval(ix0, ix1), rg.Interval(iy0, iy1))

        t_rects.Add(room, out_path)
        t_tiles.Add(tile, out_path)
        t_centers.Add(room.Center, out_path)
        t_labels.Add(name, out_path)

def env_world_bounds(er):
    o = er.Plane.Origin
    return (o.X + er.X.Min, o.X + er.X.Max,
            o.Y + er.Y.Min, o.Y + er.Y.Max, o.Z)   # include envelope Z

def point_in_env(pt, b, z_tol=1e-3):
    # match XY, and Z too (stacked mode floors share XY but differ in Z)
    in_xy = b[0] <= pt.X <= b[1] and b[2] <= pt.Y <= b[3]
    return in_xy and abs(pt.Z - b[4]) <= z_tol

# --- per-floor ---------------------------------------------------------------
rects       = DataTree[rg.Rectangle3d]()
tile_rects  = DataTree[rg.Rectangle3d]()
centers_out = DataTree[rg.Point3d]()
out_labels  = DataTree[str]()

center_paths = list(centers.Paths)
env_paths    = list(env_rect.Paths)

# Detect the FLATTENED case: rooms collapsed to a single branch but multiple
# envelopes exist (i.e. List access flattened the grafted solver tree).
# Recover floors by assigning each room to the envelope that contains its seed.
flattened = (len(center_paths) == 1 and len(env_paths) > 1)

if flattened:
    cens = list(centers.Branch(center_paths[0]))
    rads = list(radii.Branch(center_paths[0]))
    labs = list(labels.Branch(center_paths[0]))

    envs = []
    for ep in env_paths:
        if env_rect.Branch(ep).Count > 0:
            er = env_rect.Branch(ep)[0]
            envs.append((ep, er, env_world_bounds(er)))

    for bi, (ep, er, bnds) in enumerate(envs):
        gc, gr, gl = [], [], []
        for i in range(len(cens)):
            if point_in_env(cens[i], bnds):
                gc.append(cens[i]); gr.append(rads[i]); gl.append(labs[i])
        tile_floor(gc, gr, gl, er, GH_Path(bi),
                   rects, tile_rects, centers_out, out_labels)
else:
    # normal path: one branch per floor
    for path in center_paths:
        cens = list(centers.Branch(path))
        rads = list(radii.Branch(path))
        labs = list(labels.Branch(path))
        er = None
        if env_rect.PathExists(path) and env_rect.Branch(path).Count > 0:
            er = env_rect.Branch(path)[0]
        tile_floor(cens, rads, labs, er, path,
                   rects, tile_rects, centers_out, out_labels)

# --- diagnostics -------------------------------------------------------------
_d = []
_d.append("mode: %s" % ("FLATTENED-recovery" if flattened else "per-branch"))
_d.append("input branches: centers=%d env_rect=%d"
          % (len(center_paths), len(env_paths)))
_d.append("output branches: %d" % len(list(rects.Paths)))
_d.append("corridor_w=%.2f size_modifier=%.3f area_safety=%.3f"
          % (CW, SIZE_MOD, SAFETY))
_d.append("min_width_default=%.2f  per-room width overrides=%d  length overrides=%d"
          % (MIN_W_DEFAULT, len(MINW_BY_NAME), len(MINL_BY_NAME)))
_d.append("max_aspect=%s   snap_to_adjacent=%s   listed_pairs=%d"
          % ("off" if MAX_ASPECT is None else "%.2f" % MAX_ASPECT,
             SNAP_ADJ, len(LISTED_PAIRS)))
_d.append("auto_envelope=%s  env_headroom=%.2f" % (AUTO_ENV, ENV_HEADROOM))
for (pth, ea_, need_, grew_) in _env_report:
    if grew_ > 0:
        _d.append("  floor %s: envelope GROWN x%.2f (program needed %.0f sf)"
                  % (pth, grew_, need_))
    else:
        _d.append("  floor %s: envelope %.0f sf, program needs %.0f sf%s"
                  % (pth, ea_, need_, "  (tight!)" if need_ > ea_ * 0.95 else ""))
# area deviation report (actual - target), which is what plan labels usually show
_devs = []
for p in rects.Paths:
    try:
        _lb = list(out_labels.Branch(p))
    except:
        _lb = []
    for i, rc in enumerate(rects.Branch(p)):
        a = (rc.X.Max - rc.X.Min) * (rc.Y.Max - rc.Y.Min)
        nm = str(_lb[i]) if i < len(_lb) else ""
        t = _target_all.get(nm)
        if t:
            _devs.append((a - t, nm, a, t))
if _devs:
    _devs.sort()
    _abs = sorted(abs(d[0]) for d in _devs)
    _mean = sum(_abs) / len(_abs)
    _d.append("area deviation (actual-target): mean|dev|=%.1f  worst_under=%.1f  worst_over=%.1f"
              % (_mean, _devs[0][0], _devs[-1][0]))
    _bad = [d for d in _devs if abs(d[0]) > 0.25 * d[3]]
    if _bad:
        _d.append("!! %d room(s) off target by >25%%:" % len(_bad))
        for d in _bad[:5]:
            _d.append("     %s actual=%.0f target=%.0f dev=%.0f" % (d[1], d[2], d[3], d[0]))
        _d.append("   (envelope too tight — raise efficiency, or lower")
        _d.append("    min_width_default / size_modifier)")
_thin = []
for p in rects.Paths:
    for i, rc in enumerate(rects.Branch(p)):
        w = rc.X.Max - rc.X.Min
        h = rc.Y.Max - rc.Y.Min
        s = min(w, h)
        nm = ""
        try:
            nm = str(out_labels.Branch(p)[i])
        except:
            pass
        if s < min_w_of(nm) - 0.01:
            _thin.append("%s(%.1f)" % (nm, s))
if _thin:
    _d.append("!! %d room(s) below minimum width: %s"
              % (len(_thin), ", ".join(_thin[:8])))
    _d.append("   (slice too narrow to honour the minimum — reduce room count,")
    _d.append("    raise efficiency, or lower min_width_default)")
else:
    _d.append("minimum width satisfied for all rooms")
for p in rects.Paths:
    n = rects.Branch(p).Count
    ta = 0.0
    asp_worst = 0.0
    for rc in rects.Branch(p):
        w = rc.X.Max - rc.X.Min
        h = rc.Y.Max - rc.Y.Min
        ta += w * h
        if min(w, h) > 1e-9:
            asp_worst = max(asp_worst, max(w, h) / min(w, h))
    ea = 0.0
    for rc in tile_rects.Branch(p):
        ea += (rc.X.Max - rc.X.Min) * (rc.Y.Max - rc.Y.Min)
    fill = (100.0 * ta / ea) if ea > 0 else 0.0
    _d.append("  floor %s: rooms=%d room_area=%.1f fill=%.0f%% worst_aspect=%.1f"
              % (str(p), n, ta, fill, asp_worst))
if len(center_paths) == 1 and len(env_paths) <= 1:
    _d.append("NOTE: only one branch received. If you expected multiple floors,")
    _d.append("      set centers/radii/labels/env_rect pins to TREE access.")
out = "\n".join(_d)
# ---------- end rect_tiler ----------
fsim_3 = FindSimilarMember(Data=rect_tiler.out_labels, Set=flatten_4)  # -> Hit, Index; disabled
number_slider_5 = Slider(-0.92, range=-10..0)  # disabled
item_6 = ListItem(List=flatten_3, Index=fsim_3.Index, Wrap=True)  # disabled
rec_3 = Rectangle(rect_tiler.rects)  # disabled
rec_4 = Rectangle(rect_tiler.tile_rects)  # disabled
pt_3 = Point(rect_tiler.centers_out)  # disabled
panel_28 = Panel(rect_tiler.out)  # disabled
panel_29 = Panel(item_6)  # disabled
sqr_2 = Square(Value=floor_plan_solver.radii)  # disabled
area_2 = Area(Geometry=rec_3)  # -> Area, Centroid; disabled
Y_3 = UnitY(Factor=number_slider_5)  # disabled
panel_30 = Panel(rect_tiler.out_labels)  # disabled
pi_3 = Pi(Factor=sqr_2)  # disabled
panel_31 = Panel(area_2.Area)  # disabled
move_3 = Move(Geometry=pt_3, Motion=Y_3)  # -> Geometry, Transform; disabled
subtraction_2 = Subtraction(A=area_2.Area, B=item_6)  # disabled
shared_walls = Python3Script(tiles=rect_tiler.tile_rects, labels=rect_tiler.out_labels, adj_a=flatten(repeat), adj_b=item_5)  # -> out, door_pts, wall_lines, satisfied; inputs tiles: tree of Rectangle3d, labels: tree of String, adj_a: list, adj_b: list; disabled
# ---------- shared_walls: Python ----------
#! python3
# ============================================================================
# COMPONENT 04 — SHARED-WALL DOORS (listed adjacencies only)
# ----------------------------------------------------------------------------
# Places a door ONLY where two rooms (a) share a wall AND (b) are a listed
# adjacency pair in adj_a/adj_b. Touching-but-not-listed rooms get NO door.
# Reports which listed adjacencies were satisfied by a shared wall, so the
# corridor router knows which listed pairs still need a corridor.
#
# Uses the FULL tiles (tile_rects) for wall geometry, since walls are shared
# on the full-tile edges (the inset rooms don't touch).
#
# INPUTS:
#   tiles   : Tree Access (Rectangle) — full tiles from tiler 'tile_rects'
#   labels  : Tree Access (Text)      — room names ('out_labels')
#   adj_a, adj_b : List Access (from reader) — listed adjacency pairs
#   tol         : Item Access (default 0.10) coincident-edge gap
#   min_overlap : Item Access (default 2.50) min shared length for a door
#
# OUTPUTS (DataTrees, one branch per floor):
#   door_pts     : Point3d   doors on listed-adjacency shared walls
#   wall_lines   : Line      the shared wall segments (listed pairs only)
#   satisfied    : str       "RoomA | RoomB" listed adjacencies with a door
# ============================================================================
import Rhino.Geometry as rg
from Grasshopper import DataTree
from Grasshopper.Kernel.Data import GH_Path

TOL = 0.10 if tol         is None else float(tol)
MIN = 2.50 if min_overlap is None else float(min_overlap)

def as_tree(x, T):
    if hasattr(x, "Paths"):
        return x
    t = DataTree[T]()
    if x is None:
        return t
    if not isinstance(x, (list, tuple)):
        x = [x]
    t.AddRange(x, GH_Path(0))
    return t

tiles  = as_tree(tiles, rg.Rectangle3d)
labels = as_tree(labels, str)

adj_a = adj_a or []
adj_b = adj_b or []
listed = set(frozenset((a, b)) for a, b in zip(adj_a, adj_b))

def bounds(rc):
    return rc.X.Min, rc.X.Max, rc.Y.Min, rc.Y.Max

def detect(tiles_b, labels_b):
    dpts, wlines, sat = [], [], []
    n = len(tiles_b)
    z = 0.0
    if n:
        try:
            z = tiles_b[0].Plane.Origin.Z
        except:
            z = 0.0
    for i in range(n):
        ax0, ax1, ay0, ay1 = bounds(tiles_b[i])
        for j in range(i + 1, n):
            if frozenset((labels_b[i], labels_b[j])) not in listed:
                continue                      # not a listed adjacency -> no door
            bx0, bx1, by0, by1 = bounds(tiles_b[j])

            made = False
            for xa, xb in ((ax1, bx0), (bx1, ax0)):
                if abs(xa - xb) <= TOL:
                    lo, hi = max(ay0, by0), min(ay1, by1)
                    if hi - lo >= MIN:
                        x = (xa + xb) / 2; ym = (lo + hi) / 2
                        dpts.append(rg.Point3d(x, ym, z))
                        wlines.append(rg.Line(rg.Point3d(x, lo, z), rg.Point3d(x, hi, z)))
                        made = True
            for ya, yb in ((ay1, by0), (by1, ay0)):
                if abs(ya - yb) <= TOL:
                    lo, hi = max(ax0, bx0), min(ax1, bx1)
                    if hi - lo >= MIN:
                        y = (ya + yb) / 2; xm = (lo + hi) / 2
                        dpts.append(rg.Point3d(xm, y, z))
                        wlines.append(rg.Line(rg.Point3d(lo, y, z), rg.Point3d(hi, y, z)))
                        made = True
            if made:
                sat.append(labels_b[i] + " | " + labels_b[j])
    return dpts, wlines, sat

door_pts   = DataTree[rg.Point3d]()
wall_lines = DataTree[rg.Line]()
satisfied  = DataTree[str]()

_diag = []
_diag.append("listed adjacency pairs: %d" % len(listed))
if not listed:
    _diag.append("  !! 'listed' is EMPTY -> adj_a/adj_b not wired or empty.")
    _diag.append("     With no listed pairs, every touching pair is skipped")
    _diag.append("     and NO doors can be produced.")

# name-overlap check: do reader names match tiler labels at all?
_all_labels = set()
for p in tiles.Paths:
    for l in labels.Branch(p):
        if l: _all_labels.add(str(l))
_listed_names = set()
for pr in listed:
    for nm in pr: _listed_names.add(nm)
_overlap = _all_labels & _listed_names
_diag.append("tiler labels: %d, names in adjacency: %d, overlapping: %d"
             % (len(_all_labels), len(_listed_names), len(_overlap)))
if _listed_names and not _overlap:
    _diag.append("  !! NO NAME OVERLAP -> reader names != tiler labels.")
    _diag.append("     Check for case/whitespace differences.")
    _ex_l = sorted(_all_labels)[:3]
    _ex_a = sorted(_listed_names)[:3]
    _diag.append("     tiler e.g.: %s" % _ex_l)
    _diag.append("     adj   e.g.: %s" % _ex_a)

_tile_paths  = list(tiles.Paths)
_label_paths = list(labels.Paths)
if len(_tile_paths) != len(_label_paths):
    _diag.append("  !! branch count mismatch: tiles=%d labels=%d"
                 % (len(_tile_paths), len(_label_paths)))

for _bi, path in enumerate(_tile_paths):
    tb = list(tiles.Branch(path))
    # match labels by PATH if it exists, else by branch INDEX (handles the
    # case where one input got grafted to {0;0} and the other is {0})
    if labels.PathExists(path):
        lb = list(labels.Branch(path))
    elif _bi < len(_label_paths):
        lb = list(labels.Branch(_label_paths[_bi]))
    else:
        lb = []
    lb = [str(x) if x is not None else "" for x in lb]
    if not tb or not lb:
        _diag.append("floor %s: SKIPPED (tiles=%d labels=%d)"
                     % (str(path), len(tb), len(lb)))
        continue
    if len(lb) < len(tb):
        _diag.append("  !! floor %s: fewer labels (%d) than tiles (%d)"
                     % (str(path), len(lb), len(tb)))
        tb = tb[:len(lb)]
    # how many listed pairs even exist on this floor?
    onfloor = set(str(x) for x in lb if x)
    n_listed_here = sum(1 for pr in listed if len(pr & onfloor) == 2)

    d, w, s = detect(tb, lb)
    for x in d: door_pts.Add(x, path)
    for x in w: wall_lines.Add(x, path)
    for x in s:
        if x:                      # never emit null/empty -> 05 would crash
            satisfied.Add(str(x), path)

    _diag.append("floor %s: rooms=%d listed_pairs_on_floor=%d doors=%d satisfied=%d"
                 % (str(path), len(tb), n_listed_here, len(d), len(s)))
    if n_listed_here > 0 and len(s) == 0:
        _diag.append("  -> listed pairs exist here but NONE share a wall;")
        _diag.append("     they will all be routed as corridors in 05.")

out = "\n".join(_diag)
# ---------- end shared_walls ----------
tag_5 = TextTag3D(Location=move_3.Geometry, Text=subtraction_2, Size=1, Justification=2)  # disabled
tag_6 = TextTag3D(Location=pt_3, Text=rect_tiler.out_labels, Size=1, Justification=8)  # disabled
corridors = Python3Script(
    tiles=rect_tiler.tile_rects,
    rooms=rect_tiler.rects,
    labels=rect_tiler.out_labels,
    satisfied=shared_walls.satisfied,
    adj_a=flatten(repeat),
    adj_b=flatten(item_5))  # -> out, corridor_crvs, spine_crvs, branch_crvs, door_pts; inputs tiles: tree of Rectangle3d, rooms: tree of Rectangle3d, labels: tree of String, satisfied: tree of String, adj_a: list, adj_b: list; disabled
# ---------- corridors: Python ----------
#! python3
# ============================================================================
# COMPONENT 05 — CORRIDOR ROUTER (tile-edge graph + spine)
# ----------------------------------------------------------------------------
# Robust corridor generation on the TILE-EDGE GRAPH: corridors run along tile
# boundaries (which sit in the inset gap by construction) rather than a fragile
# raster. Because tile boundaries always form a connected network, every room
# can reach circulation — no interior room is ever stranded.
#
# Produces:
#   1. Corridors for listed adjacencies (adj_a/adj_b) NOT already connected by
#      a shared-wall door -> routed along the edge graph.
#   2. Orphan rooms (no satisfied listed adjacency) -> routed to the corridor
#      network hub.
#   3. A SPINE classification: corridor segments carrying many rooms are the
#      trunk (spine_crvs); the rest are branches (branch_crvs). This gives the
#      Image-2 central-spine-with-branches read.
#   4. A door where each connected room meets its corridor.
#
# INPUTS:
#   tiles   : Tree Access (Rectangle) — FULL tiles from tiler 'tile_rects'
#   rooms   : Tree Access (Rectangle) — INSET rooms from tiler 'rects'
#   labels  : Tree Access (Text)      — 'out_labels'
#   satisfied : Tree Access (Text)    — 'satisfied' from shared-wall (04)
#   adj_a, adj_b : List Access (from reader)
#   spine_min : Item (default 3)  — min rooms sharing a segment to call it spine
#
# OUTPUTS (DataTrees, one branch per floor):
#   corridor_crvs : Curve    ALL corridor centerlines
#   spine_crvs    : Curve    trunk segments (>= spine_min rooms)
#   branch_crvs   : Curve    branch segments
#   door_pts      : Point3d  doors from rooms onto corridors
#   out           : str      diagnostics (wire to a Panel)
# ============================================================================
import math
import Rhino.Geometry as rg
from Grasshopper import DataTree
from Grasshopper.Kernel.Data import GH_Path
from collections import deque, defaultdict

SPINE_MIN = 3 if spine_min is None else int(spine_min)
SNAP = 0.01

def as_tree(x, T):
    if hasattr(x, "Paths"):
        return x
    t = DataTree[T]()
    if x is None:
        return t
    if not isinstance(x, (list, tuple)):
        x = [x]
    t.AddRange(x, GH_Path(0))
    return t

tiles     = as_tree(tiles, rg.Rectangle3d)
rooms     = as_tree(rooms, rg.Rectangle3d)
labels    = as_tree(labels, str)
satisfied = as_tree(satisfied, str)

adj_a = adj_a or []
adj_b = adj_b or []
adj_pairs = list(zip(adj_a, adj_b))

def rb(rc):
    return rc.X.Min, rc.X.Max, rc.Y.Min, rc.Y.Max

def snap(v):
    return round(v / SNAP) * SNAP

corridor_crvs = DataTree[rg.Curve]()
spine_crvs    = DataTree[rg.Curve]()
branch_crvs   = DataTree[rg.Curve]()
door_pts      = DataTree[rg.Point3d]()
_diag = []

for path in tiles.Paths:
    tb = list(tiles.Branch(path))
    rl = list(rooms.Branch(path))
    lb = list(labels.Branch(path))
    if not tb:
        continue
    z = tb[0].Plane.OriginZ

    tile = {lb[i]: rb(tb[i]) for i in range(len(tb))}
    room = {lb[i]: rb(rl[i]) for i in range(len(rl))}

    # --- build tile-edge graph ------------------------------------------------
    xs = sorted(set(snap(v) for t in tile.values() for v in (t[0], t[1])))
    ys = sorted(set(snap(v) for t in tile.values() for v in (t[2], t[3])))
    nodes = set()
    edges = defaultdict(set)

    def add_edge(p, q):
        if p == q:
            return
        edges[p].add(q); edges[q].add(p)
        nodes.add(p); nodes.add(q)

    for nm, (x0, x1, y0, y1) in tile.items():
        x0, x1, y0, y1 = snap(x0), snap(x1), snap(y0), snap(y1)
        xseg = [x for x in xs if x0 <= x <= x1]
        yseg = [y for y in ys if y0 <= y <= y1]
        for i in range(len(xseg) - 1):
            add_edge((xseg[i], y0), (xseg[i+1], y0))
            add_edge((xseg[i], y1), (xseg[i+1], y1))
        for i in range(len(yseg) - 1):
            add_edge((x0, yseg[i]), (x0, yseg[i+1]))
            add_edge((x1, yseg[i]), (x1, yseg[i+1]))

    def room_nodes(nm):
        x0, x1, y0, y1 = [snap(v) for v in tile[nm]]
        out = []
        for x in xs:
            if x0 <= x <= x1:
                if (x, y0) in nodes: out.append((x, y0))
                if (x, y1) in nodes: out.append((x, y1))
        for y in ys:
            if y0 <= y <= y1:
                if (x0, y) in nodes: out.append((x0, y))
                if (x1, y) in nodes: out.append((x1, y))
        return out

    def bfs(starts, goals):
        goalset = set(goals); prev = {}; q = deque()
        for s in starts:
            prev[s] = None; q.append(s)
        hit = None
        while q:
            u = q.popleft()
            if u in goalset:
                hit = u; break
            for v in edges[u]:
                if v not in prev:
                    prev[v] = u; q.append(v)
        if hit is None:
            return None
        p = []; u = hit
        while u is not None:
            p.append(u); u = prev[u]
        return p[::-1]

    # door where a corridor node meets a room's inset wall
    def door_on(nm, node):
        b = room[nm]
        px = min(max(node[0], b[0]), b[1])
        py = min(max(node[1], b[2]), b[3])
        dl, dr = abs(px - b[0]), abs(px - b[1])
        dbm, dt = abs(py - b[2]), abs(py - b[3])
        m = min(dl, dr, dbm, dt)
        if m == dl: px = b[0]
        elif m == dr: px = b[1]
        elif m == dbm: py = b[2]
        else: py = b[3]
        return rg.Point3d(px, py, z)

    # --- which listed adjacencies still need a corridor? ---------------------
    sat = set()
    if satisfied.PathExists(path):
        for s in satisfied.Branch(path):
            if not s:                     # skip None / empty entries
                continue
            s = str(s)
            if " | " not in s:            # skip malformed entries
                continue
            a, b = s.split(" | ", 1)
            sat.add(frozenset((a.strip(), b.strip())))

    edge_use = defaultdict(int)     # for spine classification
    routed = 0; failed = 0
    connected = set()

    def register(route_nodes):
        for k in range(len(route_nodes) - 1):
            edge_use[frozenset((route_nodes[k], route_nodes[k+1]))] += 1

    for a, b in adj_pairs:
        if a not in tile or b not in tile:
            continue
        if frozenset((a, b)) in sat:
            connected.add(a); connected.add(b); continue
        r = bfs(room_nodes(a), room_nodes(b))
        if not r:
            failed += 1; continue
        register(r)
        door_pts.Add(door_on(a, r[0]), path)
        door_pts.Add(door_on(b, r[-1]), path)
        connected.add(a); connected.add(b)
        routed += 1

    # --- orphan rooms -> route to network hub (graph centroid) ---------------
    orphans = 0
    if nodes:
        cx = sum(nd[0] for nd in nodes) / len(nodes)
        cy = sum(nd[1] for nd in nodes) / len(nodes)
        hub = min(nodes, key=lambda p: (p[0]-cx)**2 + (p[1]-cy)**2)
        for nm in tile:
            if nm in connected:
                continue
            r = bfs(room_nodes(nm), [hub])
            if not r:
                orphans += 1; continue
            register(r)
            door_pts.Add(door_on(nm, r[0]), path)
            connected.add(nm)

    # --- materialize corridor segments, classify spine vs branch -------------
    for e, use in edge_use.items():
        p, q = tuple(e)
        crv = rg.PolylineCurve([rg.Point3d(p[0], p[1], z), rg.Point3d(q[0], q[1], z)])
        corridor_crvs.Add(crv, path)
        if use >= SPINE_MIN:
            spine_crvs.Add(crv, path)
        else:
            branch_crvs.Add(crv, path)

    _diag.append("floor %s: routed=%d failed=%d orphans=%d spine_edges=%d total_edges=%d"
                 % (str(path), routed, failed, orphans,
                    sum(1 for u in edge_use.values() if u >= SPINE_MIN),
                    len(edge_use)))

out = "\n".join(_diag) if _diag else "no floors processed"
# ---------- end corridors ----------
vertical_cores = Python3Script(
    centers=rect_tiler.centers_out,
    labels=rect_tiler.out_labels,
    env_rect=floor_plan_solver.env_rect,
    vlink_a=flatten(repeat),
    vlink_b=flatten(item_5))  # -> out, core_pts, core_rects, core_assign, core_count; inputs centers: tree of Point3d, labels: tree of String, env_rect: tree of Rectangle3d, vlink_a: list of String, vlink_b: list of String; disabled; same code as _06_vertical_cores
crv_6 = Curve(corridors.corridor_crvs)  # disabled
crv_7 = Curve(corridors.spine_crvs)  # disabled
crv_8 = Curve(corridors.branch_crvs)  # disabled
pt_4 = Point(corridors.door_pts)  # disabled

# ---- group: Claude Code v0.2.1
number_slider_6 = Slider(300, range=100..1000)  # disabled
program_names_2 = Text(repeat)  # disabled
room_area = Number(repeat_2)  # disabled
flr_per_room = Integer(repeat_4)  # disabled
dept = Text(repeat_5)  # disabled
toggle_5 = BooleanToggle(True)  # disabled
item_7 = ListItem(List=flatten(program_names_2), Index=fsim.Index, Wrap=True)  # disabled
number_slider_7 = Slider(1.1, range=0.5..2)  # disabled
_02_floor_plan_solver_2 = Python3Script(
    names=flatten(program_names_2),
    areas=flatten(room_area),
    floors=flatten(flr_per_room),
    adj_a=flatten(program_names_2),
    adj_b=item_7,
    iters=number_slider_6,
    arrange_mode=toggle_5)  # -> out, centers, radii, labels, floor_id, env_rect; inputs names: list, areas: list, floors: list, adj_a: list, adj_b: list; disabled; same code as _02_floor_plan_solver
number_slider_8 = Slider(1, range=1..20)  # disabled
number_slider_9 = Slider(27, range=1..50)  # disabled
number_slider_10 = Slider(1, range=1..20)  # disabled
number_slider_11 = Slider(69, range=20..100)  # disabled
dispatch_2 = Dispatch(List=flatten(dept), DispatchPattern=simplify(equals_2.Equality))  # -> ListA, ListB; disabled
txt_8 = Text(_02_floor_plan_solver_2.labels)  # disabled
rec_5 = Rectangle(_02_floor_plan_solver_2.env_rect)  # disabled
pt_5 = Point(_02_floor_plan_solver_2.centers)  # disabled
num_4 = Number(_02_floor_plan_solver_2.radii)  # disabled
number_slider_12 = Slider(1.25, range=1..1.25)  # disabled
cir_2 = Circle(Plane=pt_5, Radius=num_4)  # disabled
len_2 = TextLength(Text=txt_8)  # disabled
division_4 = Division(A=_02_floor_plan_solver_2.radii, B=len_2)  # disabled
multiplication_2 = Multiplication(A=division_4, B=number_slider_12)  # disabled
Y_4 = UnitY(Factor=multiplication_2)  # disabled
move_4 = Move(Geometry=pt_5, Motion=Y_4)  # -> Geometry, Transform; disabled
tag_7 = TextTag3D(Location=pt_5, Text=txt_8, Size=division_4, Justification=5)  # disabled
tag_8 = TextTag3D(Location=move_4.Geometry, Text=dispatch_2.ListA, Size=division_4, Justification=5)  # disabled
py3 = Python3Script(
    centers=_02_floor_plan_solver_2.centers,
    labels=_02_floor_plan_solver_2.labels,
    depts=flatten(dept),
    names=flatten(program_names_2),
    areas=flatten(room_area),
    adj_a=flatten(program_names_2),
    adj_b=flatten(item_7))  # -> out, rooms, room_lbl, room_dept, cluster_id, dev_pct, env_rect; inputs centers: tree of Point3d, labels: tree of String, depts: tree of String, names: list of String, areas: list of Double, adj_a: list of String, adj_b: list of String, n_clusters: Int32, w_prox: Double, w_adj: Double, w_dept: Double, max_aspect: Int32, room_gap: Double, row_gap: Double, cluster_gap: Double, floor_gap: Double, spread_axis: String, kmeans_iters: Int32; disabled
# ---------- py3: Python ----------
#! python3
# ============================================================================
# COMPONENT 3 — CLUSTER TILER  (all floors, one execution)
# ----------------------------------------------------------------------------
# Turns the soft bubble layout from 02 into HARD, rectilinear rooms grouped
# into clusters and packed into a neat tiled pattern.
#
# PIPELINE CONTRACT:
#   01 reader -> names / areas / floors / adjacency / DEPARTMENT #
#   02 solver -> grafted per-floor: centers, labels, radii, env_rect, depts
#   03 tiler  -> (this) clustered, edge-aligned rectangular rooms
#
# CLUSTERING  (weighted blend of three signals, K-means with target k):
#   Each room becomes a feature vector combining:
#     - PROXIMITY : its (x, y) position in the solver bubble diagram
#     - ADJACENCY : pulled toward the mean position of its adjacent rooms
#     - DEPARTMENT: a categorical coordinate so same-dept rooms attract
#   Weights W_PROX / W_ADJ / W_DEPT scale each signal. K-means (seeded from
#   department centroids) partitions rooms into up to N_CLUSTERS groups.
#   n_clusters is a MAX — small floors yield fewer (empty clusters dropped).
#
# ROOM SHAPING:
#   Every room is an axis-aligned rectangle with area preserved EXACTLY and
#   aspect ratio clamped to the band [1:2 .. 2:1]. Aspect flexes freely inside
#   that band to help rooms tile edge-to-edge; small gaps are allowed when a
#   perfect fit isn't possible (exact area wins over zero-gap).
#
# CLUSTER LAYOUT:
#   Clusters are placed in a COARSE GRID (rows x cols) across the floor, in an
#   order that follows their solver centroids (top-left to bottom-right), so
#   the tiled result echoes the bubble arrangement.
#
# INPUTS ----------------------------------------------------------------------
#   centers : DataTree[Point3d]     List Access   (grafted, from 02)
#   labels  : DataTree[str]         List Access   (grafted, from 02)
#   depts   : DataTree[str|int]     List Access   (grafted, from 02) REQUIRED
#   names   : str   List Access     (flat, from 01) area lookup keys
#   areas   : float List Access     (flat, from 01)
#   adj_a   : str   List Access     (flat, from 01) adjacency edge list
#   adj_b   : str   List Access     (flat, from 01)
#
#   n_clusters : Item Access (int;   default 8)   MAX clusters per floor
#   w_prox     : Item Access (float; default 1.0) proximity weight
#   w_adj      : Item Access (float; default 0.6) adjacency weight
#   w_dept     : Item Access (float; default 1.2) department weight
#
#   max_aspect : Item Access (float; default 2.0) aspect band = [1/max .. max]
#   room_gap   : Item Access (float; default 0.0) gap between rooms in a row
#   row_gap    : Item Access (float; default 0.0) gap between rows in a cluster
#   cluster_gap: Item Access (float; default 6.0) gap between cluster blocks
#   floor_gap  : Item Access (float; default 20.0) gap between floors in plan
#   spread_axis: Item Access (str "x"/"y"; default "x") floor spread direction
#   kmeans_iters: Item Access (int; default 40)  k-means refinement passes
#
# OUTPUTS (DataTrees, one branch per floor) ----------------------------------
#   rooms      : Rectangle3d   packed rectangular room boundary
#   room_lbl   : str           room name
#   room_dept  : str           department # of the room
#   cluster_id : int           CLUSTER NUMBER per room  (0-based, per floor)
#   dev_pct    : float         area deviation %  (~0 — area is exact)
#   env_rect   : Rectangle3d   per-floor bounding rectangle of packed result
#   out        : str           diagnostics
# ============================================================================
import math
import Rhino.Geometry as rg
from Grasshopper import DataTree
from Grasshopper.Kernel.Data import GH_Path

# --- None-safe inputs -------------------------------------------------------
centers = centers or []
labels  = labels  or []
depts   = depts   or []
names   = names or []
areas   = areas or []
adj_a   = adj_a or []
adj_b   = adj_b or []

N_CLUSTERS   = 8    if n_clusters  is None else max(1, int(n_clusters))
W_PROX       = 1.0  if w_prox      is None else float(w_prox)
W_ADJ        = 0.6  if w_adj       is None else float(w_adj)
W_DEPT       = 1.2  if w_dept      is None else float(w_dept)

MAX_ASP      = 2.0  if max_aspect  is None else float(max_aspect)
ROOM_GAP     = 0.0  if room_gap    is None else float(room_gap)
ROW_GAP      = 0.0  if row_gap     is None else float(row_gap)
CLUS_GAP     = 6.0  if cluster_gap is None else float(cluster_gap)
FLOOR_GAP    = 20.0 if floor_gap   is None else float(floor_gap)
AXIS         = "x"  if spread_axis is None else str(spread_axis).strip().lower()
KM_ITERS     = 40   if kmeans_iters is None else int(kmeans_iters)

if MAX_ASP < 1.0:
    MAX_ASP = 1.0 / MAX_ASP          # accept 0.5 meaning 1:2
MIN_ASP = 1.0 / MAX_ASP              # aspect band = [MIN_ASP .. MAX_ASP]

# --- flat area lookup by room name (name-based; tiler reorders) -------------
area_of = {}
for n, a in zip(names, areas):
    area_of[str(n)] = float(a)

# adjacency map name -> set(names)
adj = {}
for a, b in zip(adj_a, adj_b):
    a, b = str(a), str(b)
    adj.setdefault(a, set()).add(b)
    adj.setdefault(b, set()).add(a)


# ----------------------------------------------------------------------------
# department parsing: leading numeric token before any dot.
#   "5" -> "5"    "1.1.1" -> "1"    "3.2" -> "3"
# The Dept # column is REQUIRED (per pipeline decision); if a cell is blank we
# fall back to the room-name prefix so the run still completes.
# ----------------------------------------------------------------------------
def parse_dept(raw, room_name):
    s = str(raw).strip() if raw is not None else ""
    if s:
        head = s.split(".")[0].strip()
        if head != "":
            return head
    tok = str(room_name).strip().split()
    if tok:
        lead = tok[0].split(".")[0]
        if lead.isdigit():
            return lead
    return "_"


# ----------------------------------------------------------------------------
# room sizing: exact area, aspect clamped to [MIN_ASP .. MAX_ASP]
#   band_h is the row band height the packer wants this room to sit in.
#   We keep h = band_h if the resulting aspect is legal; otherwise clamp to
#   the nearest legal rectangle (area still exact).
# ----------------------------------------------------------------------------
def room_dims(area, band_h):
    if area <= 0:
        return 0.0, 0.0
    if band_h <= 0:
        h = math.sqrt(area / MAX_ASP)      # widest legal box
        return area / h, h
    w = area / band_h
    asp = w / band_h                        # >1 wide, <1 tall
    if asp > MAX_ASP:                       # too wide -> cap width
        h = math.sqrt(area / MAX_ASP)
        return area / h, h
    if asp < MIN_ASP:                       # too tall -> cap height
        w2 = math.sqrt(area * MAX_ASP)      # w/h = MAX_ASP  (area = w*h)
        return w2, area / w2
    return w, band_h


# ----------------------------------------------------------------------------
# weighted-affinity K-MEANS clustering
#   feature per room = [ W_PROX*x_n, W_PROX*y_n,          proximity
#                        W_ADJ *ax_n, W_ADJ *ay_n,        adjacency pull
#                        W_DEPT*onehot(dept)... ]         department
#   coordinates are normalised so weights are comparable across signals.
# ----------------------------------------------------------------------------
def build_features(nm_list, center_of, dept_of):
    n = len(nm_list)
    px = [center_of.get(nm, rg.Point3d(0, 0, 0)).X for nm in nm_list]
    py = [center_of.get(nm, rg.Point3d(0, 0, 0)).Y for nm in nm_list]

    # adjacency pull: mean position of each room's neighbours (self if none)
    ax, ay = [], []
    for i, nm in enumerate(nm_list):
        nbs = [o for o in adj.get(nm, ()) if o in center_of]
        if nbs:
            ax.append(sum(center_of[o].X for o in nbs) / len(nbs))
            ay.append(sum(center_of[o].Y for o in nbs) / len(nbs))
        else:
            ax.append(px[i]); ay.append(py[i])

    # normalise plan coords to 0..1 so weights are unit-comparable
    def norm(vals):
        lo, hi = min(vals), max(vals)
        rng = (hi - lo) or 1.0
        return [(v - lo) / rng for v in vals]
    nx, ny = norm(px), norm(py)
    nax, nay = norm(ax), norm(ay)

    # department one-hot (categorical). Each distinct dept becomes an axis;
    # two rooms in the same dept share a "1" there -> lower distance.
    dept_list = [dept_of[nm] for nm in nm_list]
    uniq = sorted(set(dept_list))
    dcol = {d: k for k, d in enumerate(uniq)}
    D = len(uniq)

    feats = []
    for i in range(n):
        f = [W_PROX * nx[i], W_PROX * ny[i],
             W_ADJ  * nax[i], W_ADJ  * nay[i]]
        oh = [0.0] * D
        oh[dcol[dept_list[i]]] = W_DEPT
        f.extend(oh)
        feats.append(f)
    return feats, dept_list, uniq


def kmeans(feats, k, iters, seed_labels):
    n = len(feats)
    if n == 0:
        return []
    k = min(k, n)
    dim = len(feats[0])

    # seed centroids from department groups (seed_labels), so clusters start
    # aligned to departments, then proximity/adjacency refine them.
    seed_groups = {}
    for i, s in enumerate(seed_labels):
        seed_groups.setdefault(s, []).append(i)
    seeds = sorted(seed_groups.keys(),
                   key=lambda s: -len(seed_groups[s]))    # biggest depts first
    cents = []
    for s in seeds[:k]:
        idxs = seed_groups[s]
        cents.append([sum(feats[i][d] for i in idxs) / len(idxs)
                      for d in range(dim)])
    # if fewer departments than k, pad with spread-out real points
    di = 0
    while len(cents) < k:
        cents.append(list(feats[di % n]))
        di += 1

    def dist2(a, b):
        return sum((a[d] - b[d]) ** 2 for d in range(dim))

    labels = [0] * n
    for _ in range(max(1, iters)):
        changed = False
        for i in range(n):
            best, bd = 0, None
            for c in range(k):
                d = dist2(feats[i], cents[c])
                if bd is None or d < bd:
                    bd, best = d, c
            if labels[i] != best:
                labels[i] = best
                changed = True
        # recompute centroids
        for c in range(k):
            members = [i for i in range(n) if labels[i] == c]
            if members:
                cents[c] = [sum(feats[i][d] for i in members) / len(members)
                            for d in range(dim)]
        if not changed:
            break

    # drop empty clusters -> dense 0..m-1 ids
    used = []
    for lab in labels:
        if lab not in used:
            used.append(lab)
    remap = {old: i for i, old in enumerate(used)}
    return [remap[l] for l in labels]


# ----------------------------------------------------------------------------
# pack one cluster into gridded rows -> placements in local coords (LL at 0,0)
# ----------------------------------------------------------------------------
def pack_cluster(cluster_names, center_of):
    total_area = sum(area_of.get(n, 0.0) for n in cluster_names)
    if total_area <= 0:
        return [], 0.0, 0.0

    n = len(cluster_names)
    ncols = max(1, int(round(math.sqrt(n))))
    nrows = int(math.ceil(n / float(ncols)))
    band_h = math.sqrt(total_area) / max(1, nrows)
    target_w = math.sqrt(total_area)

    # order rooms by solver position: top rows first, then left-to-right
    def sort_key(nm):
        p = center_of.get(nm, rg.Point3d(0, 0, 0))
        return (-round(p.Y, 3), round(p.X, 3))
    ordered = sorted(cluster_names, key=sort_key)

    def flush_row(row, row_top):
        cx = 0.0
        laid = []
        for nm in row:
            a = area_of.get(nm, 0.0)
            w, h = room_dims(a, band_h)
            laid.append((nm, cx, row_top - h, w, h))
            cx += w + ROOM_GAP
        row_width = (cx - ROOM_GAP) if row else 0.0
        return laid, row_width

    row, row_w = [], 0.0
    row_top = 0.0
    max_w = 0.0
    laid_all = []
    for nm in ordered:
        a = area_of.get(nm, 0.0)
        w, _h = room_dims(a, band_h)
        if row and (row_w + w) > target_w:
            laid, rw = flush_row(row, row_top)
            laid_all.extend(laid)
            max_w = max(max_w, rw)
            row_top -= (band_h + ROW_GAP)
            row, row_w = [], 0.0
        row.append(nm)
        row_w += w + ROOM_GAP
    if row:
        laid, rw = flush_row(row, row_top)
        laid_all.extend(laid)
        max_w = max(max_w, rw)
        row_top -= (band_h + ROW_GAP)

    block_h = -row_top - ROW_GAP if laid_all else 0.0
    block_w = max_w
    shifted = [(nm, xx, yy + block_h, w, h) for (nm, xx, yy, w, h) in laid_all]
    return shifted, block_w, block_h


# ----------------------------------------------------------------------------
# branch reconstruction (grafted DataTree -> per-floor lists)
# ----------------------------------------------------------------------------
def get_branches(tree_like):
    br = getattr(tree_like, "Branches", None)
    if br is not None:
        return [list(b) for b in br]
    return [list(tree_like)]

cen_branches = get_branches(centers)
lbl_branches = get_branches(labels)
dep_branches = get_branches(depts)

nfloors = min(len(cen_branches), len(lbl_branches))

# --- outputs ----------------------------------------------------------------
rooms      = DataTree[rg.Rectangle3d]()
room_lbl   = DataTree[str]()
room_dept  = DataTree[str]()
cluster_id = DataTree[int]()
dev_pct    = DataTree[float]()
env_out    = DataTree[rg.Rectangle3d]()

_d = []
_d.append("clusters(max)=%d  weights: prox=%.2f adj=%.2f dept=%.2f"
          % (N_CLUSTERS, W_PROX, W_ADJ, W_DEPT))
_d.append("aspect band = 1:%.2f .. %.2f:1   floors=%d  spread=%s"
          % (MAX_ASP, MAX_ASP, nfloors, AXIS))
if not depts:
    _d.append("!! depts input empty — Dept # column required. "
              "Falling back to room-name prefix.")

floor_run = 0.0
prev_extent = 0.0

for bi in range(nfloors):
    path = GH_Path(bi)
    cen = cen_branches[bi]
    lbl = [str(x) for x in lbl_branches[bi]]
    dep_raw = dep_branches[bi] if bi < len(dep_branches) else []

    center_of = {}
    for c, n in zip(cen, lbl):
        center_of[n] = c

    # department per room (parsed), aligned to labels order
    dept_of = {}
    for i, nm in enumerate(lbl):
        raw = dep_raw[i] if i < len(dep_raw) else None
        dept_of[nm] = parse_dept(raw, nm)

    floor_names = lbl

    # --- cluster ---
    feats, dept_list, uniq = build_features(floor_names, center_of, dept_of)
    cl_labels = kmeans(feats, N_CLUSTERS, KM_ITERS, dept_list)
    cmap = {nm: cl_labels[i] for i, nm in enumerate(floor_names)}
    nclusters = (max(cl_labels) + 1) if cl_labels else 0

    # group rooms by cluster
    clusters = {}
    for nm in floor_names:
        clusters.setdefault(cmap[nm], []).append(nm)

    # --- coarse grid of cluster blocks -------------------------------------
    # order clusters by centroid (top-left -> bottom-right), then flow into a
    # grid whose column count ~ sqrt(#clusters). Column widths / row heights
    # size to the largest block in each column / row so blocks align.
    def centroid(ci):
        pts = [center_of.get(n, rg.Point3d(0, 0, 0)) for n in clusters[ci]]
        return (sum(p.X for p in pts) / len(pts),
                sum(p.Y for p in pts) / len(pts))
    cl_ids = sorted(clusters.keys(),
                    key=lambda ci: (-round(centroid(ci)[1], 3),
                                    round(centroid(ci)[0], 3)))

    # pack every cluster once to learn its block size
    packed = {}
    for ci in cl_ids:
        placements, bw, bh = pack_cluster(clusters[ci], center_of)
        packed[ci] = (placements, bw, bh)

    m = len(cl_ids)
    gcols = max(1, int(round(math.sqrt(m))))
    grows = int(math.ceil(m / float(gcols)))

    # arrange cluster ids into grid cells (row-major, following centroid order)
    grid = [[None] * gcols for _ in range(grows)]
    for idx, ci in enumerate(cl_ids):
        grid[idx // gcols][idx % gcols] = ci

    # column widths and row heights = max block in that column / row
    col_w = [0.0] * gcols
    row_h = [0.0] * grows
    for r in range(grows):
        for c in range(gcols):
            ci = grid[r][c]
            if ci is None:
                continue
            _, bw, bh = packed[ci]
            col_w[c] = max(col_w[c], bw)
            row_h[r] = max(row_h[r], bh)

    # per-floor spread offset (place floors beside each other in plan)
    if bi == 0:
        floor_off_x = floor_off_y = 0.0
    else:
        floor_run += prev_extent + FLOOR_GAP
        floor_off_x = floor_run if AXIS == "x" else 0.0
        floor_off_y = floor_run if AXIS == "y" else 0.0

    # place blocks. y runs downward from the top (row 0 at top).
    floor_xmin = floor_ymin = 1e18
    floor_xmax = floor_ymax = -1e18

    # top y of the whole floor block stack
    total_h = sum(row_h) + CLUS_GAP * (grows - 1 if grows > 0 else 0)
    y_top = total_h
    for r in range(grows):
        x_left = 0.0
        for c in range(gcols):
            ci = grid[r][c]
            if ci is not None:
                placements, bw, bh = packed[ci]
                # top-align block within its row cell
                ox = floor_off_x + x_left
                oy = floor_off_y + (y_top - row_h[r])   # cell bottom
                # lift block so its top sits at row cell top
                lift = row_h[r] - bh
                for (nm, lx, ly, w, h) in placements:
                    x0 = ox + lx
                    y0 = oy + ly + lift
                    rect = rg.Rectangle3d(
                        rg.Plane(rg.Point3d(x0, y0, 0), rg.Vector3d.ZAxis),
                        rg.Interval(0.0, w),
                        rg.Interval(0.0, h))
                    rooms.Add(rect, path)
                    room_lbl.Add(nm, path)
                    room_dept.Add(dept_of.get(nm, ""), path)
                    cluster_id.Add(ci, path)
                    target = area_of.get(nm, 0.0)
                    actual = w * h
                    dev = 0.0 if target <= 0 else (actual - target) / target * 100.0
                    dev_pct.Add(dev, path)
                    floor_xmin = min(floor_xmin, x0)
                    floor_ymin = min(floor_ymin, y0)
                    floor_xmax = max(floor_xmax, x0 + w)
                    floor_ymax = max(floor_ymax, y0 + h)
            x_left += col_w[c] + CLUS_GAP
        y_top -= (row_h[r] + CLUS_GAP)

    # per-floor envelope + spread bookkeeping
    if floor_xmax > floor_xmin:
        fw = floor_xmax - floor_xmin
        fh = floor_ymax - floor_ymin
        env = rg.Rectangle3d(
            rg.Plane(rg.Point3d(floor_xmin, floor_ymin, 0), rg.Vector3d.ZAxis),
            rg.Interval(0.0, fw), rg.Interval(0.0, fh))
        env_out.Add(env, path)
        prev_extent = fw if AXIS == "x" else fh
    else:
        prev_extent = 0.0

    _d.append("  branch {%d}: rooms=%d depts=%d clusters=%d grid=%dx%d"
              % (bi, len(floor_names), len(uniq), nclusters, grows, gcols))

if not centers:
    _d.append("!! no centers received — check solver wiring / List access")

out = "\n".join(_d)
# ---------- end py3 ----------

# ----
rec_6 = Rectangle(_02_floor_plan_solver.env_rect)

# ---- group: Claude Code_V0.3.0 / Multiple Seed (Data Allocation and Preview)
number_slider_13 = Slider(2, range=0..10)

# ---- group: Claude Code_V0.3.0
number_slider_14 = Slider(0, range=0..100)
number_slider_15 = Slider(1, range=0..2.5)
number_slider_16 = Slider(2.4, range=0..2.5)
number_slider_17 = Slider(2.5, range=0..2.5)
number_slider_18 = Slider(20, range=0..100)
number_slider_19 = Slider(2, range=0.5..2.5)
number_slider_20 = Slider(8, range=6..10)
number_slider_21 = Slider(12, range=8..15)

list_2 = ValueList({"X Axis": 0, "Y Axis": 1}, selected="X Axis")
comp03_tiler = Python3Script(
    centers=pt,
    radii=num_3,
    labels=txt_6,
    colors=col_2,
    uid_out=txt_7,
    dept_out=int_5,
    areas=num,
    uids_flat=txt,
    adj_source=txt_5,
    adj_target=txt_2,
    floor_pref=int_4,
    shared=bool,
    boundary=crv_2,
    unit_system=panel_8,
    n_clusters=Slider(6, range=1..10),
    w_prox=number_slider_16,
    w_adj=number_slider_17,
    w_dept=number_slider_15,
    spread_axis=list_2,
    seed=number_slider_18,
    run=Toggle(True))  # -> out, rooms, room_lbl, room_uid, room_dept, room_color, cluster_id, access_edge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; inputs centers: tree of Point3d, radii: tree of Double, labels: tree of String, colors: tree of Color, uid_out: tree of String, dept_out: tree of Int32, areas: list of Double, uids_flat: list of String, adj_source: list of String, adj_target: list of String, floor_pref: list of Int32, shared: list of Boolean, boundary: Curve, plate_w: Double, plate_l: Double, floor_efficiency: Double, max_floors: Int32, unit_system: String, n_clusters: Int32, w_prox: Double, w_adj: Double, w_dept: Double, area_tol: Double, channel_gap: Double, room_gap: Double, spread_axis: Int32, floor_gap: Double, kmeans_iters: Int32, seed: Int32, run: Boolean
#   port centers: Grafted per-floor from Comp02.
#   port radii: Grafted per-floor from Comp02.
#   port labels: Grafted per-floor from Comp02.
#   port colors: Grafted per-floor from Comp02.
#   port dept_out: Grafted per-floor from Comp02.
# ---------- comp03_tiler: Python ----------
#! python3
# ==============================================================================
# COMPONENT 03  |  CLUSTER TILER  (soft bubbles -> hard rectilinear rooms)
# ------------------------------------------------------------------------------
# Rhino 8 / Grasshopper CPython script component.
# Consumes the grafted per-floor bubble layout from Component 02 and converts it
# into hard, rectilinear rooms grouped into clusters, aligned into bands, and
# laid out with reserved corridor channels. Emits corridor-READY geometry
# (access-edge tags + reserved gaps) but NO corridor geometry -- that is Part 2.
#
# PIPELINE CONTRACT (current):
#   01 Reader  -> flat: uid, label, dept, area, floor, color, adj_source/target
#   02 Solver  -> grafted per-floor: centers, radii, labels, colors, uid_out,
#                 dept_out, env_rect  (branch index = floor rank)
#   03 Tiler   -> (this) clustered exact-area rooms, band-aligned, corridor-ready
#
# ------------------------------------------------------------------------------
# METHOD
#   Per floor (each grafted branch):
#     1) CLUSTER rooms via weighted K-means. Feature vector blends:
#          PROXIMITY : solver (x,y) center           * w_prox
#          ADJACENCY : mean position of adjacent uids * w_adj   (adjacency-dominant)
#          DEPARTMENT: categorical dept coordinate    * w_dept
#        k = min(n_clusters, n_rooms); seeded from dept centroids; empties dropped.
#     2) SHAPE each room to EXACT area, aspect flexed within 1:2..2:1, long axis
#        chosen from the room's local spread in the bubble cloud.
#     3) BAND-ALIGN: within a cluster, sort rooms into rows (by Y), order each
#        row by X, stack rows; snap shared edges AFTER shaping. A snap that would
#        change area by more than area_tol (default 5%) is NOT fully applied --
#        a small gap is left instead (area preserved over gap-free).
#     4) LAYOUT clusters in a coarse grid per floor, reserving corridor channels
#        (channel_gap, default ~7 ft) between rows and between clusters.
#     5) TAG each room's access_edge = the face pointing at the nearest reserved
#        channel (0=+X,1=+Y,2=-X,3=-Y). Corridors/doors in Part 2 consume this.
#     6) OFFSET each floor block by a running floor_run accumulator along
#        spread_axis with floor_gap, mirroring the solver's separated view.
#
# ------------------------------------------------------------------------------
# INPUTS
#   centers    : Point3d | Tree | from 02 (grafted per floor)
#   radii      : float   | Tree | from 02
#   labels     : str     | Tree | from 02
#   colors     : Colour  | Tree | from 02
#   uid_out    : str     | Tree | from 02  (name-based lookups; tiler reorders)
#   dept_out   : int     | Tree | from 02
#   areas      : float   | List | from 01 'area'  (flat; looked up by uid)
#   uids_flat  : str     | List | from 01 'uid'   (flat; index-aligned to areas)
#   adj_source : str     | List | from 01 (edge tails, uid)
#   adj_target : str     | List | from 01 (edge heads, uid)
#
#   floor_pref : int     | List | from 01 'floor_pref' (0 = no preference)
#   shared     : bool    | List | from 01 'shared_out' (keeps chains on one floor)
#
#   boundary   : Curve   | Item | floor plate outline from Rhino. Optional if
#                                 plate_w/plate_l are given. Same plate is used
#                                 for every floor (per-floor plates come later).
#   plate_w    : float   | Item | plate width  (unit_system) if no boundary curve
#   plate_l    : float   | Item | plate length (unit_system) if no boundary curve
#   floor_efficiency : float | Item | usable fraction of the plate after corridors
#                                 and structure. Default 0.65. One value, all floors.
#   max_floors : int     | Item | safety stop for the unbounded floor loop. Default 20.
#
#   unit_system: str     | Item | "feet" or "meters" (areas' units)
#   n_clusters : int     | Item | MAX clusters per floor. Default 6.
#   w_prox     : float   | Item | proximity weight. Default 1.0
#   w_adj      : float   | Item | adjacency weight. Default 2.5 (dominant)
#   w_dept     : float   | Item | department weight. Default 1.0
#   area_tol   : float   | Item | alignment budget as area fraction. Default 0.05
#   channel_gap: float   | Item | reserved corridor gap (unit_system). Default 7.0
#   room_gap   : float   | Item | min gap between rooms in a band. Default 0.5
#   spread_axis: int     | Item | 0=X, 1=Y floor offset direction. Default 0
#   floor_gap  : float   | Item | gap between floor blocks (unit_system). Default 30
#   kmeans_iters : int   | Item | K-means iterations. Default 50
#   seed       : int     | Item | RNG seed. Default 42
#   run        : bool    | Item | solve toggle
#
# ------------------------------------------------------------------------------
# OUTPUTS (GRAFTED PER FLOOR, branch = floor rank; index-aligned across room outs)
#   rooms      : Rectangle3d(Curve) | Tree | hard rectilinear rooms
#   room_lbl   : str     | Tree | label per room (branch-aligned)
#   room_uid   : str     | Tree | uid per room  (name-based lookups downstream)
#   room_dept  : int     | Tree | dept token per room
#   room_color : Colour  | Tree | color per room
#   cluster_id : int     | Tree | cluster index per room (within its floor)
#   access_edge: int     | Tree | 0=+X 1=+Y 2=-X 3=-Y face onto nearest channel
#   dev_pct    : float   | Tree | signed area deviation % per room (should be <= tol)
#   cluster_rect : Rectangle3d(Curve) | Tree | bbox per cluster (for Part 2)
#   env_rect   : Rectangle3d(Curve) | Tree | floor envelope
#   room_floor : int     | Tree | assigned floor number per room (branch-aligned)
#   plate_rect : Curve   | Tree | the plate outline echoed at each floor's origin
#   depts      : int     | List | passthrough
#   info       : str     | Item | diagnostics (incl. floor fill % and overflow log)
#
# ------------------------------------------------------------------------------
# FLOOR ASSIGNMENT (Stage 3)
#   Comp02 now emits ONE global bubble cloud; this component decides floors.
#     1) CHAIN GROUPING: a "Shared Access" room is glued to its adjacency parent
#        (transitively: vestibule -> restroom -> classroom). Each chain is an
#        ATOMIC unit -- it can never be split across floors, or Comp06's direct
#        doors would have no adjacent parent.
#     2) CAPACITY: usable = plate_area * floor_efficiency. Same for every floor.
#     3) OVERSIZED: a chain whose own area exceeds one plate's capacity is given
#        its own floor and reported as an overage (it cannot fit anywhere else).
#     4) PINNED: chains with a floor_pref go to that floor. If the floor is full
#        they overflow DOWN first (pref-1, pref-2, ... 1), then UP, and every
#        displacement is logged.
#     5) UNPINNED: floors fill bottom-up. Each floor is seeded with the largest
#        remaining chain, then grown by AFFINITY = w_adj * adjacency ties to
#        rooms already on the floor + w_prox * bubble proximity + w_dept * same-
#        dept mass. Same weights that drive the clustering.
#     6) STOP: unbounded floor count, bounded by max_floors plus a no-progress
#        guard so a pathological chain can never spin the loop.
#   Floors are then tiled exactly as before, one branch per assigned floor.
#
# ------------------------------------------------------------------------------
# CONVENTIONS / GOTCHAS
#   - "#! python3" required. Rhino.Geometry throughout.
#   - Tree inputs on Tree Access; flat inputs on List Access; scalars on Item.
#   - Name-based lookups by uid (the tiler REORDERS rooms vs solver order).
#   - int(math.ceil(...)) for integer counts; isinstance() for type checks.
#   - Exact area first, align after; area_tol is the alignment budget.
# ==============================================================================

import Rhino
import Rhino.Geometry as rg
import System
import math
import random
from Grasshopper import DataTree
from Grasshopper.Kernel.Data import GH_Path


def _get(name, default):
    return globals()[name] if (name in globals() and globals()[name] is not None) else default


def _unit_scale(sys_name):
    name = (sys_name or "feet").strip().lower()
    src_m = 1.0 if name.startswith("m") else 0.3048
    doc = Rhino.RhinoDoc.ActiveDoc
    try:
        umeters = Rhino.RhinoMath.UnitScale(Rhino.UnitSystem.Meters, doc.ModelUnitSystem)
    except Exception:
        umeters = 1.0
    return src_m * umeters


# ---- tree helpers ----------------------------------------------------------
def _branches(tree):
    """Yield (path, [values]) for a GH DataTree, robust to CPython marshaling."""
    out = []
    if tree is None:
        return out
    try:
        paths = list(tree.Paths)
    except Exception:
        return out
    for p in paths:
        vals = list(tree.Branch(p))
        out.append((p, vals))
    return out


# ---- outputs ---------------------------------------------------------------
rooms = DataTree[object]()
room_lbl = DataTree[object]()
room_uid = DataTree[object]()
room_dept = DataTree[object]()
room_color = DataTree[object]()
cluster_id = DataTree[object]()
access_edge = DataTree[object]()
dev_pct = DataTree[object]()
cluster_rect = DataTree[object]()
env_rect = DataTree[object]()
room_floor = DataTree[object]()
plate_rect = DataTree[object]()
depts = []
info = ""


def _plate_metrics(boundary_crv, pw_model, pl_model):
    """Return (area_model, bbox_w, bbox_h, source) for the floor plate.
    Prefers a Rhino boundary curve; falls back to plate_w x plate_l."""
    if boundary_crv is not None:
        try:
            bb = boundary_crv.GetBoundingBox(True)
            bw = bb.Max.X - bb.Min.X
            bh = bb.Max.Y - bb.Min.Y
            amp = rg.AreaMassProperties.Compute(boundary_crv)
            area = abs(amp.Area) if amp is not None else (bw * bh)
            if area > 0:
                return area, bw, bh, "boundary curve"
        except Exception:
            pass
    if pw_model > 0 and pl_model > 0:
        return pw_model * pl_model, pw_model, pl_model, "plate_w x plate_l"
    return 0.0, 0.0, 0.0, "none"


def _kmeans(feats, k, iters, seed):
    """Lloyd's K-means on feature rows (list of tuples). Returns label per row.
    Seeded deterministically; empty clusters are re-seeded to the farthest point."""
    n = len(feats)
    dim = len(feats[0]) if n else 0
    if n == 0 or k <= 1:
        return [0] * n
    k = min(k, n)
    random.seed(seed)

    # ---- seed: k-means++ style spread for stability ----
    cents = [list(feats[random.randrange(n)])]
    while len(cents) < k:
        d2 = []
        for f in feats:
            best = min(sum((f[t] - c[t]) ** 2 for t in range(dim)) for c in cents)
            d2.append(best)
        tot = sum(d2)
        if tot <= 1e-12:
            cents.append(list(feats[random.randrange(n)]))
            continue
        r = random.uniform(0, tot)
        acc = 0.0
        pick = 0
        for i, v in enumerate(d2):
            acc += v
            if acc >= r:
                pick = i
                break
        cents.append(list(feats[pick]))

    labels = [0] * n
    for _ in range(max(1, iters)):
        # assign
        changed = False
        for i, f in enumerate(feats):
            best_c, best_d = 0, None
            for c in range(k):
                d = sum((f[t] - cents[c][t]) ** 2 for t in range(dim))
                if best_d is None or d < best_d:
                    best_d, best_c = d, c
            if labels[i] != best_c:
                changed = True
            labels[i] = best_c
        # update
        for c in range(k):
            members = [feats[i] for i in range(n) if labels[i] == c]
            if not members:
                # re-seed empty cluster to the point farthest from its centroid
                far_i, far_d = 0, -1.0
                for i, f in enumerate(feats):
                    d = sum((f[t] - cents[labels[i]][t]) ** 2 for t in range(dim))
                    if d > far_d:
                        far_d, far_i = d, i
                cents[c] = list(feats[far_i])
                continue
            cents[c] = [sum(m[t] for m in members) / len(members) for t in range(dim)]
        if not changed:
            break
    return labels


def _shape_exact(area_model, long_axis_horizontal):
    """Return (w, h) for a rectangle of EXACT area, aspect within 1:2..2:1.
    Picks a near-square-ish ratio but respects requested long-axis orientation."""
    if area_model <= 0:
        area_model = 1.0
    # target aspect ~ golden-ish but clamped to band; use 1.4 as a pleasant default
    ratio = 1.4  # long:short
    ratio = max(1.0, min(2.0, ratio))
    short = math.sqrt(area_model / ratio)
    long = area_model / short
    if long_axis_horizontal:
        return long, short
    return short, long


def _build():
    global depts
    lines = []

    unit_system = _get("unit_system", "feet")
    lin = _unit_scale(unit_system)
    n_clusters = int(_get("n_clusters", 6))
    w_prox = float(_get("w_prox", 1.0))
    w_adj = float(_get("w_adj", 2.5))
    w_dept = float(_get("w_dept", 1.0))
    area_tol = float(_get("area_tol", 0.05))
    channel_gap = float(_get("channel_gap", 7.0)) * lin
    room_gap = float(_get("room_gap", 0.5)) * lin
    spread_axis = int(_get("spread_axis", 0))
    floor_gap = float(_get("floor_gap", 30.0)) * lin
    kmeans_iters = int(_get("kmeans_iters", 50))
    seed = int(_get("seed", 42))
    floor_efficiency = float(_get("floor_efficiency", 0.65))
    max_floors = int(_get("max_floors", 20))
    plate_w_in = float(_get("plate_w", 0.0) or 0.0)
    plate_l_in = float(_get("plate_l", 0.0) or 0.0)

    # ---- flat lookups from Comp01 -----------------------------------------
    uids_flat = list(_get("uids_flat", []))
    areas_flat = list(_get("areas", []))
    area_by_uid = {}
    for i in range(min(len(uids_flat), len(areas_flat))):
        area_by_uid[uids_flat[i]] = float(areas_flat[i])

    asrc = list(_get("adj_source", []))
    atgt = list(_get("adj_target", []))
    # undirected adjacency map for the clustering signal
    adj_map = {}
    for s, t in zip(asrc, atgt):
        adj_map.setdefault(s, []).append(t)
        adj_map.setdefault(t, []).append(s)

    # ---- grafted inputs from Comp02 ---------------------------------------
    centers_b = _branches(_get("centers", None))
    if not centers_b:
        return "Waiting: no 'centers' tree from Component 02."
    radii_b = dict((str(p), v) for p, v in _branches(_get("radii", None)))
    labels_b = dict((str(p), v) for p, v in _branches(_get("labels", None)))
    colors_b = dict((str(p), v) for p, v in _branches(_get("colors", None)))
    uid_b = dict((str(p), v) for p, v in _branches(_get("uid_out", None)))
    dept_b = dict((str(p), v) for p, v in _branches(_get("dept_out", None)))

    depts_in = list(_get("depts", []))

    floor_run = 0.0
    total_rooms = 0
    total_over = 0
    dept_set = set()

    # ======================================================================
    # FLOOR ASSIGNMENT  (Comp02 now emits ONE global cloud)
    # ======================================================================
    # ---- flatten every branch of the incoming cloud into global arrays ----
    g_ctr = []; g_rad = []; g_lbl = []; g_col = []; g_uid = []; g_dept = []
    for (p, ctrs) in centers_b:
        k = str(p)
        rr_ = radii_b.get(k, [1.0] * len(ctrs))
        lb_ = labels_b.get(k, [""] * len(ctrs))
        cl_ = colors_b.get(k, [System.Drawing.Color.Gray] * len(ctrs))
        uu_ = uid_b.get(k, ["?%d" % i for i in range(len(ctrs))])
        dd_ = dept_b.get(k, [-1] * len(ctrs))
        for i in range(len(ctrs)):
            g_ctr.append(ctrs[i])
            g_rad.append(rr_[i] if i < len(rr_) else 1.0)
            g_lbl.append(lb_[i] if i < len(lb_) else "")
            g_col.append(cl_[i] if i < len(cl_) else System.Drawing.Color.Gray)
            g_uid.append(uu_[i] if i < len(uu_) else "?%d" % i)
            g_dept.append(dd_[i] if i < len(dd_) else -1)
    N = len(g_uid)
    if N == 0:
        return "Waiting: bubble cloud from Component 02 is empty."
    gidx_of = {g_uid[i]: i for i in range(N)}

    # ---- plate capacity ---------------------------------------------------
    plate_area, plate_bw, plate_bh, plate_src = _plate_metrics(
        _get("boundary", None), plate_w_in * lin, plate_l_in * lin)
    if plate_area <= 0:
        return ("Waiting: no floor plate. Wire a 'boundary' curve, or set "
                "plate_w and plate_l.")
    capacity = plate_area * max(1e-6, floor_efficiency)

    # ---- floor preference + shared flags, joined by uid -------------------
    pref_list = list(_get("floor_pref", []))
    shared_list = list(_get("shared", []))
    pref_by_uid = {}
    for i in range(min(len(uids_flat), len(pref_list))):
        try:
            pref_by_uid[uids_flat[i]] = int(pref_list[i])
        except (ValueError, TypeError):
            pref_by_uid[uids_flat[i]] = 0
    shared_by_uid = {}
    for i in range(min(len(uids_flat), len(shared_list))):
        shared_by_uid[uids_flat[i]] = bool(shared_list[i])

    # directed parent (source -> its Conn.Primary target)
    parent_of = {}
    for s, t in zip(asrc, atgt):
        parent_of[s] = t

    # ---- ATOMIC CHAINS: glue each shared room to its parent ---------------
    # union-find over rooms; a shared room unions with its parent, so a whole
    # classroom/restroom/vestibule chain collapses to one group.
    par = {u: u for u in g_uid}

    def _find(u):
        while par[u] != u:
            par[u] = par[par[u]]
            u = par[u]
        return u

    def _union(a, b):
        ra, rb = _find(a), _find(b)
        if ra != rb:
            par[rb] = ra

    for u in g_uid:
        if shared_by_uid.get(u, False):
            p = parent_of.get(u)
            if p in par:
                _union(p, u)

    groups = {}
    for u in g_uid:
        groups.setdefault(_find(u), []).append(u)

    # ---- group attributes -------------------------------------------------
    grp = []
    pref_conflicts = []
    for root, mem in groups.items():
        a_model = sum(area_by_uid.get(u, 100.0) for u in mem) * (lin * lin)
        prefs = [pref_by_uid.get(u, 0) for u in mem]
        nz = sorted(set(p for p in prefs if p > 0))
        gp = nz[0] if nz else 0
        if len(nz) > 1:
            pref_conflicts.append("{} members disagree {} -> using {}".format(
                root, nz, gp))
        # area-weighted bubble centroid
        tw = 0.0; cx = 0.0; cy = 0.0
        for u in mem:
            w_ = area_by_uid.get(u, 100.0)
            i_ = gidx_of[u]
            cx += g_ctr[i_].X * w_; cy += g_ctr[i_].Y * w_; tw += w_
        cx = cx / tw if tw else 0.0
        cy = cy / tw if tw else 0.0
        grp.append(dict(root=root, mem=mem, area=a_model, pref=gp,
                        cx=cx, cy=cy, dept=g_dept[gidx_of[root]],
                        n=len(mem)))

    # ---- assignment -------------------------------------------------------
    floor_of_group = {}        # root -> floor number (1-based)
    floor_used = {}            # floor -> area consumed (capacity tracker)
    overflow_log = []
    overage_log = []
    pinned_unplaced = []       # pinned chains that fit nowhere under the cap

    def _fits(f, a):
        return floor_used.get(f, 0.0) + a <= capacity + 1e-9

    def _place(g, f):
        floor_of_group[g["root"]] = f
        floor_used[f] = floor_used.get(f, 0.0) + g["area"]

    # 1) OVERSIZED chains: cannot fit any plate -> own floor, reported.
    oversized = [g for g in grp if g["area"] > capacity]
    normal = [g for g in grp if g["area"] <= capacity]

    # 2) PINNED chains: preferred floor, overflow DOWN then UP.
    pinned = sorted([g for g in normal if g["pref"] > 0],
                    key=lambda g: (g["pref"], -g["area"]))
    for g in pinned:
        want = g["pref"]
        if _fits(want, g["area"]):
            _place(g, want)
            continue
        placed = False
        for f in range(want - 1, 0, -1):          # DOWN first
            if _fits(f, g["area"]):
                _place(g, f)
                overflow_log.append("{} pref {} -> {} (down, floor {} full)".format(
                    g["root"], want, f, want))
                placed = True
                break
        if not placed:
            f = want + 1
            while f <= max_floors:                 # then UP
                if _fits(f, g["area"]):
                    _place(g, f)
                    overflow_log.append("{} pref {} -> {} (up, no room below)".format(
                        g["root"], want, f))
                    placed = True
                    break
                f += 1
        if not placed:
            pinned_unplaced.append(g)

    # 3) UNPINNED chains: fill bottom-up by affinity.
    free = [g for g in normal if g["pref"] <= 0]

    def _floor_members(f):
        out = []
        for r_, ff in floor_of_group.items():
            if ff == f:
                out.extend(groups[r_])
        return out

    xs_all = [p.X for p in g_ctr]; ys_all = [p.Y for p in g_ctr]
    cloud_span = max((max(xs_all) - min(xs_all)), (max(ys_all) - min(ys_all))) or 1.0

    def _affinity(g, f):
        mem_f = _floor_members(f)
        if not mem_f:
            return 0.0
        mem_set = set(mem_f)
        # adjacency ties from this chain to rooms already on the floor
        ties = 0
        for u in g["mem"]:
            for v in adj_map.get(u, []):
                if v in mem_set:
                    ties += 1
        ties_n = ties / float(max(1, len(g["mem"])))
        # bubble proximity to the floor's centroid (normalized by cloud span)
        fx = sum(g_ctr[gidx_of[u]].X for u in mem_f) / len(mem_f)
        fy = sum(g_ctr[gidx_of[u]].Y for u in mem_f) / len(mem_f)
        d = math.hypot(g["cx"] - fx, g["cy"] - fy)
        prox_n = 1.0 / (1.0 + d / max(1e-9, cloud_span))
        # same-dept mass already on the floor
        same = sum(1 for u in mem_f if g_dept[gidx_of[u]] == g["dept"])
        dept_n = same / float(max(1, len(mem_f)))
        return w_adj * ties_n + w_prox * prox_n + w_dept * dept_n

    f_cur = 1
    guard = 0
    while free and f_cur <= max_floors:
        guard += 1
        if guard > max_floors * (len(grp) + 2):
            overflow_log.append("no-progress guard tripped; stopping fill")
            break
        # anything still fitting on this floor?
        candidates = [g for g in free if _fits(f_cur, g["area"])]
        if not candidates:
            f_cur += 1
            continue
        if not _floor_members(f_cur):
            # empty floor -> seed with the largest chain that fits
            pick = max(candidates, key=lambda g: g["area"])
        else:
            pick = max(candidates, key=lambda g: (_affinity(g, f_cur), g["area"]))
        _place(pick, f_cur)
        free.remove(pick)

    unplaced = list(free) + list(pinned_unplaced)

    # 4) OVERSIZED chains get their own floors on top, still under the cap.
    top = max(list(floor_used.keys()) + [0])
    for g in oversized:
        if top + 1 > max_floors:
            unplaced.append(g)
            continue
        top += 1
        _place(g, top)
        overage_log.append(
            "{} area {:,.0f} {}2 exceeds plate capacity {:,.0f} -> own floor {} "
            "({:.0f}% over)".format(
                g["root"], g["area"] / (lin * lin), unit_system,
                capacity / (lin * lin), top,
                (g["area"] / capacity - 1.0) * 100.0))

    n_unplaced_rooms = sum(g["n"] for g in unplaced)
    for g in unplaced:
        overflow_log.append("{} ({} rooms) UNPLACED - hit max_floors={}".format(
            g["root"], g["n"], max_floors))

    # ---- expand groups back to per-room floor assignment ------------------
    floor_of_uid = {}
    for r_, f in floor_of_group.items():
        for u in groups[r_]:
            floor_of_uid[u] = f
    floors_used = sorted(set(floor_of_uid.values()))
    members_by_floor = {f: [] for f in floors_used}
    for i in range(N):
        f = floor_of_uid.get(g_uid[i])
        if f is not None:
            members_by_floor[f].append(i)

    _fit_report = []

    # ======================================================================
    # TILE each assigned floor (unchanged logic, one branch per floor)
    # ======================================================================
    for rank, fl_no in enumerate(floors_used):
        idxs = members_by_floor[fl_no]
        n = len(idxs)
        if n == 0:
            continue
        ctr_list = [g_ctr[i] for i in idxs]
        rr = [g_rad[i] for i in idxs]
        lb = [g_lbl[i] for i in idxs]
        cl = [g_col[i] for i in idxs]
        uu = [g_uid[i] for i in idxs]
        dd = [g_dept[i] for i in idxs]

        # room records for THIS floor
        recs = []
        for i in range(n):
            pt = ctr_list[i]
            u = uu[i] if i < len(uu) else "?%d" % i
            a_in = area_by_uid.get(u, math.pi * (rr[i] ** 2) / (lin * lin) if i < len(rr) else 100.0)
            recs.append(dict(uid=u, x=pt.X, y=pt.Y,
                             label=lb[i] if i < len(lb) else u,
                             color=cl[i] if i < len(cl) else System.Drawing.Color.Gray,
                             dept=dd[i] if i < len(dd) else -1,
                             area_in=a_in))
            dept_set.add(recs[-1]["dept"])

        # ---- clustering feature vectors -----------------------------------
        # normalize positions to keep weights comparable
        xs = [r["x"] for r in recs]
        ys = [r["y"] for r in recs]
        spanx = (max(xs) - min(xs)) or 1.0
        spany = (max(ys) - min(ys)) or 1.0

        def _adj_mean(u, fallback):
            nbrs = adj_map.get(u, [])
            pts = [(rr2["x"], rr2["y"]) for rr2 in recs for rr2u in [rr2["uid"]] if rr2u in nbrs]
            if not pts:
                return fallback
            return (sum(p[0] for p in pts) / len(pts),
                    sum(p[1] for p in pts) / len(pts))

        feats = []
        for r in recs:
            amx, amy = _adj_mean(r["uid"], (r["x"], r["y"]))
            feats.append((
                w_prox * (r["x"] / spanx),
                w_prox * (r["y"] / spany),
                w_adj * (amx / spanx),
                w_adj * (amy / spany),
                w_dept * float(r["dept"]),
            ))

        k = min(n_clusters, n)
        labels_k = _kmeans(feats, k, kmeans_iters, seed + rank)

        # compact cluster ids (drop empties)
        used = sorted(set(labels_k))
        remap = {c: i for i, c in enumerate(used)}
        for i in range(n):
            recs[i]["cid"] = remap[labels_k[i]]
        n_cl = len(used)

        # ---- shape + band-align each cluster ------------------------------
        # cluster local layouts first (origin-local), then place in a coarse grid.
        cluster_blocks = []  # list of dict: cid, rooms[list], w, h
        for cid in range(n_cl):
            members = [r for r in recs if r["cid"] == cid]
            if not members:
                continue
            # rows by Y (band-sort): split into ceil(sqrt) rows
            members.sort(key=lambda r: (-r["y"], r["x"]))
            nrows = max(1, int(math.ceil(math.sqrt(len(members)))))
            per_row = int(math.ceil(len(members) / float(nrows)))

            # shape each room to exact area
            for r in members:
                a_model = r["area_in"] * (lin * lin)
                # long axis horizontal if the room sits wider than tall in bubble
                r["w"], r["h"] = _shape_exact(a_model, True)
                r["a_model"] = a_model

            # lay rooms into rows, left->right, rows top->bottom
            rows = [members[i:i + per_row] for i in range(0, len(members), per_row)]
            # row height = max room height in that row (band alignment)
            cur_y = 0.0
            block_w = 0.0
            placed = []
            for ri, row in enumerate(rows):
                row_h = max(r["h"] for r in row)
                cur_x = 0.0
                for r in row:
                    # band-align: snap room height up to row_h if within area_tol,
                    # adjusting width to hold area; else leave a gap (keep exact).
                    target_h = row_h
                    new_w = r["a_model"] / target_h
                    # aspect clamp 1:2..2:1
                    asp = max(new_w, target_h) / max(1e-9, min(new_w, target_h))
                    dev = abs((new_w * target_h) - r["a_model"]) / r["a_model"]
                    if asp <= 2.0 and dev <= area_tol:
                        r["w"], r["h"] = new_w, target_h
                    # else keep exact w,h (small vertical gap remains -> allowed)
                    r["px"] = cur_x
                    r["py"] = cur_y - r["h"]
                    cur_x += r["w"] + room_gap
                    placed.append(r)
                block_w = max(block_w, cur_x - room_gap)
                cur_y -= row_h + channel_gap  # reserve BRANCH channel between rows
            block_h = -cur_y - channel_gap + channel_gap  # net height
            block_h = abs(cur_y) - channel_gap if len(rows) > 0 else 0.0
            cluster_blocks.append(dict(cid=cid, rooms=placed,
                                       w=block_w, h=abs(cur_y)))

        # ---- place clusters in a coarse grid, reserving TRUNK channels ----
        n_blocks = len(cluster_blocks)
        gcols = max(1, int(math.ceil(math.sqrt(n_blocks))))
        # column widths / row heights for the cluster grid
        col_w = [0.0] * gcols
        grow = int(math.ceil(n_blocks / float(gcols)))
        row_h = [0.0] * grow
        for bi, blk in enumerate(cluster_blocks):
            gc = bi % gcols
            gr = bi // gcols
            col_w[gc] = max(col_w[gc], blk["w"])
            row_h[gr] = max(row_h[gr], blk["h"])

        # cumulative offsets with channel_gap*? -> use a wider trunk gap
        trunk_gap = channel_gap * 1.5
        col_x = [0.0] * gcols
        for c in range(1, gcols):
            col_x[c] = col_x[c - 1] + col_w[c - 1] + trunk_gap
        row_y = [0.0] * grow
        for rr2 in range(1, grow):
            row_y[rr2] = row_y[rr2 - 1] - (row_h[rr2 - 1] + trunk_gap)

        # floor world offset (running accumulator)
        ox = floor_run if spread_axis == 0 else 0.0
        oy = floor_run if spread_axis == 1 else 0.0
        z = 0.0
        path_out = GH_Path(rank)

        floor_minx = 1e18
        floor_miny = 1e18
        floor_maxx = -1e18
        floor_maxy = -1e18

        for bi, blk in enumerate(cluster_blocks):
            gc = bi % gcols
            gr = bi // gcols
            bx = ox + col_x[gc]
            by = oy + row_y[gr]

            # cluster bbox accumulation
            cminx = 1e18
            cminy = 1e18
            cmaxx = -1e18
            cmaxy = -1e18

            for r in blk["rooms"]:
                x0 = bx + r["px"]
                y0 = by + r["py"]
                w = r["w"]
                h = r["h"]
                plane = rg.Plane(rg.Point3d(x0, y0, z), rg.Vector3d.ZAxis)
                rect = rg.Rectangle3d(plane, w, h)
                rooms.Add(rect.ToNurbsCurve(), path_out)
                room_lbl.Add(r["label"], path_out)
                room_uid.Add(r["uid"], path_out)
                room_floor.Add(int(fl_no), path_out)
                room_dept.Add(r["dept"], path_out)
                room_color.Add(r["color"], path_out)
                cluster_id.Add(r["cid"], path_out)

                # area deviation
                dev = ((w * h) - r["a_model"]) / r["a_model"] * 100.0
                dev_pct.Add(dev, path_out)
                if abs(dev) > area_tol * 100.0 + 1e-6:
                    total_over += 1

                # access_edge: face toward nearest reserved channel.
                # rooms in a cluster open onto the branch channel below/above;
                # simplest robust rule -> the room's -Y edge (row channel side),
                # unless it's the top row, then +Y. Refined later in Part 2.
                cx = x0 + w * 0.5
                cy = y0 + h * 0.5
                # distance to block edges
                dl = (x0) - bx
                dr = (bx + blk["w"]) - (x0 + w)
                db = (y0) - (by - blk["h"])
                dtp = (by) - (y0 + h)
                dists = [(dr, 0), (dtp, 1), (dl, 2), (db, 3)]
                dists.sort(key=lambda t: t[0])
                access_edge.Add(dists[0][1], path_out)

                total_rooms += 1
                cminx = min(cminx, x0); cminy = min(cminy, y0)
                cmaxx = max(cmaxx, x0 + w); cmaxy = max(cmaxy, y0 + h)

            # cluster rect
            if cmaxx > cminx:
                plane = rg.Plane(rg.Point3d(cminx, cminy, z), rg.Vector3d.ZAxis)
                cluster_rect.Add(rg.Rectangle3d(plane, cmaxx - cminx, cmaxy - cminy).ToNurbsCurve(), path_out)
                floor_minx = min(floor_minx, cminx); floor_miny = min(floor_miny, cminy)
                floor_maxx = max(floor_maxx, cmaxx); floor_maxy = max(floor_maxy, cmaxy)

        # floor envelope
        if floor_maxx > floor_minx:
            plane = rg.Plane(rg.Point3d(floor_minx, floor_miny, z), rg.Vector3d.ZAxis)
            env_rect.Add(rg.Rectangle3d(plane, floor_maxx - floor_minx, floor_maxy - floor_miny).ToNurbsCurve(), path_out)
            # echo the plate at this floor's origin so the fit is visible in Rhino
            pp = rg.Plane(rg.Point3d(ox, oy, z), rg.Vector3d.ZAxis)
            plate_rect.Add(rg.Rectangle3d(pp, plate_bw, plate_bh).ToNurbsCurve(), path_out)
            # BBOX FIT CHECK (Stage 3 reports; Stage 4 will reflow to fit)
            ew = floor_maxx - floor_minx
            eh = floor_maxy - floor_miny
            fits = (ew <= plate_bw + 1e-6) and (eh <= plate_bh + 1e-6)
            _fit_report.append(
                "  Floor {}: {:.0f}x{:.0f} vs plate {:.0f}x{:.0f} {}  {}".format(
                    fl_no, ew / lin, eh / lin, plate_bw / lin, plate_bh / lin,
                    unit_system, "fits" if fits else "OVERFLOWS BBOX"))
            # advance floor_run by this floor's extent along spread_axis
            extent = (floor_maxx - floor_minx) if spread_axis == 0 else (floor_maxy - floor_miny)
            floor_run += extent + floor_gap

        fill = floor_used.get(fl_no, 0.0) / capacity * 100.0 if capacity else 0.0
        lines.append("  Floor {} (branch {{{}}}) : {} rooms, {} clusters, {:.0f}% of capacity".format(
            fl_no, rank, len(ctr_list), n_cl, fill))

    depts = depts_in if depts_in else sorted(d for d in dept_set if d is not None)

    _prog_sf = sum(area_by_uid.get(u, 0.0) for u in g_uid)
    header = ["Component 03 | Cluster Tiler + Floor Assignment"]
    if n_unplaced_rooms:
        header.append("*** WARNING: {} of {} ROOMS NOT PLACED ({} chains). "
                      "Raise max_floors (now {}) or enlarge the plate. ***".format(
                          n_unplaced_rooms, N, len(unplaced), max_floors))
    header += ["Total rooms placed : {} of {}".format(total_rooms, N),
              "Unit system: {}   model-units/input: {:.4f}".format(unit_system, lin),
              "Plate ({}): {:.0f}x{:.0f} {}  area {:,.0f}  x eff {:.0%} -> capacity {:,.0f} {}2/floor".format(
                  plate_src, plate_bw / lin, plate_bh / lin, unit_system,
                  plate_area / (lin * lin), floor_efficiency,
                  capacity / (lin * lin), unit_system),
              "Program {:,.0f} {}2 over {} chains -> {} floors (max_floors={})".format(
                  _prog_sf, unit_system, len(grp), len(floors_used), max_floors),
              "Chains: {} atomic groups from {} rooms ({} multi-room shared chains)".format(
                  len(grp), N, sum(1 for g in grp if g["n"] > 1)),
              "Weights  w_prox={}  w_adj={}  w_dept={}  (n_clusters max={})".format(w_prox, w_adj, w_dept, n_clusters),
              "area_tol={:.0%}  channel_gap={} {}  rooms over tol: {}".format(
                  area_tol, _get("channel_gap", 7.0), unit_system, total_over)]
    if _fit_report:
        header.append("BBOX FIT (Stage 3 reports only; tiler does not reflow yet):")
        header += _fit_report
    if overage_log:
        header.append("OVERAGE - chain larger than one plate ({}):".format(len(overage_log)))
        for o in overage_log:
            header.append("  " + o)
    if overflow_log:
        header.append("OVERFLOW / preference not honoured ({}):".format(len(overflow_log)))
        for o in overflow_log[:12]:
            header.append("  " + o)
        if len(overflow_log) > 12:
            header.append("  ... {} more".format(len(overflow_log) - 12))
    if pref_conflicts:
        header.append("NOTE chain members with conflicting floor_pref ({}):".format(len(pref_conflicts)))
        for c in pref_conflicts[:6]:
            header.append("  " + c)
    return "\n".join(header + lines)


_do_run = True if ('run' not in globals() or run is None) else bool(run)
if _do_run:
    info = _build()
else:
    info = "Idle: set run=True to tile."
# ---------- end comp03_tiler ----------
panel_32 = Panel(comp03_tiler.info)
panel_33 = Panel(comp03_tiler.out)
rec_7 = Rectangle(comp03_tiler.cluster_rect)
rec_8 = Rectangle(comp03_tiler.rooms)
txt_9 = Text(comp03_tiler.room_lbl)
col_3 = Colour(comp03_tiler.room_color)
int_7 = Integer(comp03_tiler.cluster_id)
bnd_3 = Bounds(Numbers=int_7)
dedomain_3 = DeconstructDomain(Domain=bnd_3)  # -> Start, End
gradient = Gradient(
    LowerLimit=dedomain_3.Start,
    UpperLimit=dedomain_3.End,
    Parameter=int_7,
    stops=[0: RGB(48, 18, 59), 0.0294: RGB(56, 40, 112), 0.0588: RGB(63, 62, 156), 0.0882: RGB(68, 82, 193), 0.118: RGB(70, 102, 221), 0.147: RGB(71, 122, 241)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])
dim_2 = Dimensions(Surface=rec_8)  # -> UDimension, VDimension
len_3 = TextLength(Text=txt_9)
area_3 = Area(Geometry=rec_8)  # -> Area, Centroid
division_5 = Division(A=dim_2.UDimension, B=len_3)
boundary_2 = BoundarySurfaces(Edges=rec_8)

# ----
crv_9 = Curve(comp03_tiler.plate_rect)

# ---- group: Claude Code_V0.3.0
panel_34 = Panel("feet")
linetypes_2 = QueryModelLinetypes(AutoUpdateState=True)
swatch_5 = ColourSwatch(SwatchColor=RGB(0, 0, 0))
list_3 = ItemSelector(linetypes_2, {"Model Linetype : (Continuous)"}, selected="Model Linetype : (Continuous)")

# ---- group: Claude Code_V0.3.0 / Multiple Seed (Data Allocation and Preview) (continued)
random = Random(Range="0 To 99", Number=number_slider_13, Seed=number_slider_14, Integers=True)
seeds_displayed = Panel(random)

# ---- group: Claude Code_V0.3.0 (continued)
comp02_bubblesolver_2 = Python3Script(
    uid=txt,
    area=num,
    color=col,
    label=txt_3,
    dept=int,
    adj_source=txt_5,
    adj_target=txt_2,
    depts=int_2,
    unit_system=panel_34,
    iterations=Slider(1000, range=100..1000),
    k_adj=Slider(0.08, range=0..1),
    k_repel=Slider(1, range=0..1),
    pad=Slider(1, range=1..3),
    seed=random,
    run=Toggle(True))  # -> out, centers, circles, radii, labels, colors, uid_out, dept_out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; inputs uid: list of String, area: list of Double, color: list of Color, label: list of String, dept: list of Int32, adj_source: list of String, adj_target: list of String, depts: list of Int32, unit_system: String, iterations: Int32, deoverlap_iters: Int32, k_adj: Double, k_repel: Double, pad: Double, seed: Int32, run: Boolean; disabled; same code as comp02_bubblesolver
panel_35 = Panel(comp02_bubblesolver_2.info)
panel_36 = Panel(comp02_bubblesolver_2.out)
pt_6 = Point(comp02_bubblesolver_2.centers)
num_5 = Number(comp02_bubblesolver_2.radii)
col_4 = Colour(comp02_bubblesolver_2.colors)
int_8 = Integer(comp02_bubblesolver_2.dept_out)
line_2 = Line(comp02_bubblesolver_2.adj_lines)
num_6 = Number(comp02_bubblesolver_2.max_overlap)
circle_2 = Circle(comp02_bubblesolver_2.circles)
txt_10 = Text(comp02_bubblesolver_2.labels)
txt_11 = Text(comp02_bubblesolver_2.uid_out)
crv_10 = Curve(comp02_bubblesolver_2.env_rect)
int_9 = Integer(comp02_bubblesolver_2.depts)

# ---- group: Claude Code_V0.3.0 / Multiple Seed (Data Allocation and Preview) / Env_Rec
partition_color = PartitionList(List=crv_10, Size=1)

# ---- group: Claude Code_V0.3.0 / Multiple Seed (Data Allocation and Preview) (continued)
dim_3 = Dimensions(Surface=crv_10)  # -> UDimension, VDimension
lng = ListLength(List=line_2)
bnd_4 = Bounds(Numbers=flatten(dim_3.VDimension))
division_6 = Division(A=lng, B=number_slider_13)
lng_2 = ListLength(List=comp02_bubblesolver_2.circles)
dedomain_4 = DeconstructDomain(Domain=bnd_4)  # -> Start, End
division_7 = Division(A=lng_2, B=number_slider_13)

# ---- group: Claude Code_V0.3.0 / Multiple Seed (Data Allocation and Preview) / Circle
partition = PartitionList(List=circle_2, Size=division_7)

# ---- group: Claude Code_V0.3.0 / Multiple Seed (Data Allocation and Preview) / Color
partition_color_2 = PartitionList(List=col_4, Size=division_7)

# ---- group: Claude Code_V0.3.0 / Multiple Seed (Data Allocation and Preview) / Label
partition_color_3 = PartitionList(List=txt_10, Size=division_7)

# ---- group: Claude Code_V0.3.0 / Multiple Seed (Data Allocation and Preview) / Radii
partition_color_4 = PartitionList(List=num_5, Size=division_7)

# ---- group: Claude Code_V0.3.0 / Multiple Seed (Data Allocation and Preview) / Line
partition_color_5 = PartitionList(List=line_2, Size=division_6)

# ---- group: Claude Code_V0.3.0 / Multiple Seed (Data Allocation and Preview) / Dept_out
partition_color_6 = PartitionList(List=int_8, Size=division_7)

# ---- group: Claude Code_V0.3.0 / Multiple Seed (Data Allocation and Preview) / uid_out
partition_color_7 = PartitionList(List=txt_11, Size=division_7)

# ---- group: Claude Code_V0.3.0 (continued)
multiplication_3 = Multiplication(A=dedomain_4.End, B=Slider(1.4, range=1..1.5))
rec_9 = Rectangle(comp03_tiler.env_rect)
txt_12 = Text(comp03_tiler.room_uid)
int_10 = Integer(comp03_tiler.room_dept)

# ---- group: Claude Code_V0.3.0 / Multiple Seed (Data Allocation and Preview) (continued)
series_3 = Series(Start=0, Step=multiplication_3, Count=number_slider_13)
Y_5 = UnitY(Factor=series_3)  # -> simplify(UnitVector)
lng_3 = ListLength(List=partition)
lng_4 = ListLength(List=flatten(lng_3))
expression_2 = Expression(x=partition_color_4, Expression="2*x")
len_4 = TextLength(Text=partition_color_3)
repeat_8 = RepeatData(Data=Y_5, Length=lng_4)
division_8 = Division(A=expression_2, B=len_4)
move_5 = Move(Geometry=partition, Motion=graft(repeat_8))  # -> Geometry, Transform
move_6 = Move(Geometry=partition_color, Motion=graft(repeat_8))  # -> Geometry, Transform
move_7 = Move(Geometry=partition_color_5, Motion=graft(repeat_8))  # -> Geometry, Transform
boundary_3 = BoundarySurfaces(Edges=move_5.Geometry)
area_4 = Area(Geometry=move_5.Geometry)  # -> Area, Centroid

# ---- group: Claude Code_V0.3.0
preview_7 = CustomPreview(Geometry=boundary_3, Material=partition_color_2)
preview_8 = CustomPreview(Geometry=move_7.Geometry, Material=partition_color_2)
tag_9 = TextTag3D(Location=area_4.Centroid, Text=partition_color_3, Size=division_8, Colour=swatch_5, Justification=5)
curve_preview_2 = CustomCurvePreview(Curve=move_6.Geometry, Linetype=list_3, Colour=swatch_5)

# ---- group: Claude Code_V0.3.0 / Centers
match = MatchTree(Tree=area_4.Centroid, Guide=partition)

# ---- group: Claude Code_V0.3.0
preview_9 = CustomPreview(Geometry=boundary_2, Material=gradient)
preview_10 = CustomPreview(Geometry=rec_7, Material=swatch)
preview_11 = CustomPreview(Geometry=rec_9, Material=swatch)
tag_10 = TextTag3D(Location=area_3.Centroid, Text=txt_9, Size=division_5, Colour=swatch, Justification=5)

list_4 = ValueList({"Bubble": "bubble", "Even": "even"}, selected="Bubble")
linetypes_3 = QueryModelLinetypes(AutoUpdateState=True)
comp04_corridororganizer = Python3Script(
    room_uid=txt_12,
    room_dept=int_10,
    room_color=col_3,
    cluster_id=int_7,
    uids_flat=txt,
    areas=num,
    adj_source=txt_5,
    adj_target=txt_2,
    shared=bool,
    sol_centers=pt,
    sol_uid=txt_7,
    unit_system=panel_8,
    split_mode=list_4,
    max_aspect=number_slider_19,
    trunk_gap=number_slider_20,
    envelope_aspect=Slider(1, range=0.5..3),
    snap_dist=number_slider_21,
    spread_axis=list_2,
    run=Toggle(True))  # -> out, rooms, room_lbl, room_uid_out, room_dept_out, room_color_out, cluster_id_out, access_edge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; inputs room_uid: tree of String, room_dept: tree of Int32, room_color: tree of Color, cluster_id: tree of Int32, uids_flat: list of String, areas: list of Double, adj_source: list of String, adj_target: list of String, shared: list of Boolean, sol_centers: tree of Point3d, sol_uid: tree of String, unit_system: String, split_mode: String, room_depth: Double, max_aspect: Double, branch_gap: Double, trunk_gap: Double, room_gap: Double, branch_gap_v: Double, envelope_aspect: Double, shelf_gap: Double, big_room_frac: Double, max_corridor_len: Double, break_gap: Double, snap_dist: Double, spread_axis: Int32, floor_gap: Double, run: Boolean
#   port room_lbl: (uid echoed; labels can be rejoined by uid)
# ---------- comp04_corridororganizer: Python ----------
#! python3
# ==============================================================================
# COMPONENT 04  |  CORRIDOR ORGANIZER  (double-loaded clusters + branch/trunk)
# ------------------------------------------------------------------------------
# Rhino 8 / Grasshopper CPython script component.
# Takes the clustered rooms from Component 03 and RE-LAYS-OUT each cluster as a
# double-loaded arrangement: two rows of rooms facing a central BRANCH channel,
# with the corridor-side (access) edge of every room pinned to ONE perfectly
# flat line. Rooms keep EXACT area; width is fixed per room, so the FAR edge
# falls wherever area puts it (accepted stagger, maximum clean corridor contact).
#
# Clusters are then PLACED BY ADJACENCY: the strongest-connected cluster pairs
# sit with facing edges toward each other across a reserved TRUNK channel, whose
# centerline connects the two branch corridors. Weaker adjacencies route the
# long way (documented, not forced).
#
# This component does NOT reshape rooms or re-cluster. It reads Comp03's cluster
# assignment + each room's exact area and rebuilds POSITIONS only. It emits
# reserved channel rectangles + corridor CENTERLINES (curves), not corridor
# width geometry -- the stem/width pass is Part 2.
#
# ------------------------------------------------------------------------------
# PIPELINE CONTRACT
#   01 Reader -> areas, uids_flat, adj_source, adj_target (flat lists)
#   03 Tiler  -> grafted per floor: rooms, room_uid, room_dept, room_color,
#                cluster_id, cluster_rect, env_rect
#   04 (this) -> grafted per floor: re-laid double-loaded rooms + corridors
#
# ------------------------------------------------------------------------------
# INPUTS
#   room_uid    : str   | Tree | from 03 (branch = floor rank)
#   room_dept   : int   | Tree | from 03
#   room_color  : Colour| Tree | from 03
#   room_lbl    : str   | Tree | from 03 label per room ("1.1 Classroom - K (1/4)").
#                                Looked up by uid and echoed on output.
#                                NOTE: wire Comp03's room_lbl into the INPUT named
#                                'lbl_in' (the output tree is also called room_lbl;
#                                the names must differ, as with shared/shared_out
#                                in Comp01). If absent, output falls back to uid.
#   cluster_id  : int   | Tree | from 03 (cluster index within floor)
#
#   uids_flat   : str   | List | from 01 'uid'  (index-aligned to areas)
#   areas       : float | List | from 01 'area' (exact SF per room)
#   adj_source  : str   | List | from 01 (edge tails, uid)
#   adj_target  : str   | List | from 01 (edge heads, uid)
#   shared      : bool  | List | from 01 'shared_out' (index-aligned to uids_flat)
#                                Rooms flagged Shared Access are GLUED next to
#                                their adjacency parent in "bubble" split so they
#                                share a wall (Comp06 places a direct door there).
#
#   sol_centers : Point3d| Tree | from 02 'centers' (solver bubble positions)
#   sol_uid     : str   | Tree | from 02 'uid_out'  (branch-aligned to centers)
#
#   unit_system : str   | Item | "feet" or "meters" (areas' units)
#   split_mode  : str   | Item | "bubble" or "even" (row split rule). Default "bubble"
#   room_depth  : float | Item | target/cap room depth (perp to corridor). Default 28
#   max_aspect  : float | Item | max room aspect (long:short) before depth grows. Default 2.5
#   branch_gap  : float | Item | reserved BRANCH channel width. Default 6.0
#   trunk_gap   : float | Item | reserved TRUNK channel width. Default 8.0
#   room_gap    : float | Item | gap between rooms along a row. Default 0.5
#   branch_gap_v: float | Item | vertical gap between stacked branches. Default 8.0
#   envelope_aspect : float | Item | target floor width:height for shelf wrap. Default 1.4
#   shelf_gap   : float | Item | vertical gap between shelves. Default 10.0
#   big_room_frac : float | Item | room-width fraction of run to extract. Default 0.6
#   max_corridor_len : float | Item | max branch run before a break split. Default 75
#   break_gap   : float | Item | gap inserted between room groups at a break. Default 6.0
#   snap_dist   : float | Item | merge verticals within this dist onto gap channels. Default 12.0
#   spread_axis : int   | Item | 0=X, 1=Y floor offset direction. Default 0
#   floor_gap   : float | Item | gap between floor blocks. Default 30.0
#   run         : bool  | Item | solve toggle
#
# ------------------------------------------------------------------------------
# OUTPUTS (GRAFTED PER FLOOR, branch = floor rank)
#   rooms       : Rectangle3d(Curve) | Tree | re-laid double-loaded rooms
#   room_lbl    : str   | Tree | label per room ("1.1 Classroom - K (1/4)", from 03)
#   room_uid_out: str   | Tree | uid per room (name-based lookups downstream)
#   room_dept_out: int  | Tree | dept per room
#   room_color_out: Colour| Tree | color per room
#   cluster_id_out: int | Tree | cluster per room
#   access_edge : int   | Tree | 0=+X 1=+Y 2=-X 3=-Y face onto branch channel
#   branch_ctr  : Curve | Tree | branch corridor centerline per cluster
#   branch_rect : Rectangle3d(Curve) | Tree | reserved branch channel rect
#   trunk_ctr   : Curve | Tree | trunk centerlines (shelf spine + gap-channel
#                                verticals + half-span break corridors)
#   trunk_weight: int   | Tree | rooms served per trunk_ctr segment (for widening)
#   cluster_rect_out : Rectangle3d(Curve) | Tree | re-laid cluster bbox
#   env_rect    : Rectangle3d(Curve) | Tree | floor envelope
#   depts       : int   | List | passthrough
#   info        : str   | Item | diagnostics (incl. weak adjacencies routed long)
#
# ------------------------------------------------------------------------------
# CONVENTIONS / GOTCHAS
#   - "#! python3" required. Rhino.Geometry throughout.
#   - Tree inputs on Tree Access; flat inputs on List Access; scalars Item.
#   - ACCESS EDGE IS PINNED FLAT: all rooms in a row share the same corridor-side
#     Y (top row) / Y (bottom row). Width fixed; depth = area/width; far edge
#     staggers. No tolerance on the access edge.
#   - Name-based lookups by uid. int(math.ceil()); isinstance() for types.
# ==============================================================================

import Rhino
import Rhino.Geometry as rg
import System
import math
from Grasshopper import DataTree
from Grasshopper.Kernel.Data import GH_Path


def _get(name, default):
    return globals()[name] if (name in globals() and globals()[name] is not None) else default


def _unit_scale(sys_name):
    name = (sys_name or "feet").strip().lower()
    src_m = 1.0 if name.startswith("m") else 0.3048
    doc = Rhino.RhinoDoc.ActiveDoc
    try:
        umeters = Rhino.RhinoMath.UnitScale(Rhino.UnitSystem.Meters, doc.ModelUnitSystem)
    except Exception:
        umeters = 1.0
    return src_m * umeters


def _branches(tree):
    out = []
    if tree is None:
        return out
    try:
        paths = list(tree.Paths)
    except Exception:
        return out
    for p in paths:
        out.append((p, list(tree.Branch(p))))
    return out


# ---- outputs ---------------------------------------------------------------
rooms = DataTree[object]()
room_lbl = DataTree[object]()
room_uid_out = DataTree[object]()
room_dept_out = DataTree[object]()
room_color_out = DataTree[object]()
cluster_id_out = DataTree[object]()
access_edge = DataTree[object]()
branch_ctr = DataTree[object]()
branch_rect = DataTree[object]()
trunk_ctr = DataTree[object]()
trunk_weight = DataTree[object]()
cluster_rect_out = DataTree[object]()
env_rect = DataTree[object]()
depts = []
info = ""


def _build():
    global depts
    lines = []

    unit_system = _get("unit_system", "feet")
    lin = _unit_scale(unit_system)
    split_mode = str(_get("split_mode", "bubble")).strip().lower()
    room_depth = float(_get("room_depth", 28.0)) * lin
    max_aspect = float(_get("max_aspect", 2.5))
    branch_gap = float(_get("branch_gap", 6.0)) * lin
    trunk_gap = float(_get("trunk_gap", 8.0)) * lin
    room_gap = float(_get("room_gap", 0.5)) * lin
    branch_gap_v = float(_get("branch_gap_v", 8.0)) * lin
    envelope_aspect = float(_get("envelope_aspect", 1.0))
    shelf_gap = float(_get("shelf_gap", 10.0)) * lin
    big_room_frac = float(_get("big_room_frac", 0.6))
    max_corridor_len = float(_get("max_corridor_len", 75.0)) * lin
    break_gap = float(_get("break_gap", 6.0)) * lin
    snap_dist = float(_get("snap_dist", 12.0)) * lin
    spread_axis = int(_get("spread_axis", 0))
    floor_gap = float(_get("floor_gap", 30.0)) * lin

    # ---- flat lookups ------------------------------------------------------
    uids_flat = list(_get("uids_flat", []))
    areas_flat = list(_get("areas", []))
    area_by_uid = {}
    for i in range(min(len(uids_flat), len(areas_flat))):
        area_by_uid[uids_flat[i]] = float(areas_flat[i])

    asrc = list(_get("adj_source", []))
    atgt = list(_get("adj_target", []))

    # ---- shared-access flag by uid (glue child rooms to their parent) ------
    shared_flat = list(_get("shared", []))
    shared_by_uid = {}
    for i in range(min(len(uids_flat), len(shared_flat))):
        shared_by_uid[uids_flat[i]] = bool(shared_flat[i])

    # room-level adjacency parent: uid -> its Conn.Primary target uid.
    # (Comp01 wires directed source->target; source PULLS toward target.)
    parent_of = {}
    for s, t in zip(asrc, atgt):
        parent_of[s] = t

    # ---- solver bubble positions by uid (for cluster footprint width) -----
    sol_pos = {}   # uid -> (x, y) from Comp02 centers
    sc_b = _branches(_get("sol_centers", None))
    su_b = dict((str(p), v) for p, v in _branches(_get("sol_uid", None)))
    for (p, pts) in sc_b:
        us = su_b.get(str(p), [])
        for i in range(min(len(pts), len(us))):
            sol_pos[us[i]] = (pts[i].X, pts[i].Y)

    # ---- grafted inputs from Comp03 ---------------------------------------
    uid_b = _branches(_get("room_uid", None))
    if not uid_b:
        return "Waiting: no 'room_uid' tree from Component 03."
    dept_b = dict((str(p), v) for p, v in _branches(_get("room_dept", None)))
    color_b = dict((str(p), v) for p, v in _branches(_get("room_color", None)))
    cid_b = dict((str(p), v) for p, v in _branches(_get("cluster_id", None)))

    # label per room, keyed by uid (from Comp03). Falls back to the uid at emit
    # time if the input is absent or a uid is missing. Robust to the input's
    # Access setting: if 'lbl_in' comes in as a Tree we pair labels to uids per
    # branch; if it arrives as a flat List (Access = List) we pair against the
    # flattened uid order. Either way the label is joined to the room by uid.
    label_by_uid = {}
    lbl_raw = _get("lbl_in", None)
    lbl_b = _branches(lbl_raw)
    _uid_by_key = dict((str(p), v) for p, v in uid_b)
    if lbl_b:
        # Tree input: pair per branch, but tolerate branch-key mismatch by
        # falling back to flattened order when a branch key has no uid match.
        matched_any = False
        for (p, lbls) in lbl_b:
            us = _uid_by_key.get(str(p), [])
            if us:
                matched_any = True
                for i in range(min(len(us), len(lbls))):
                    label_by_uid[us[i]] = lbls[i]
        if not matched_any:
            # branch keys didn't line up (e.g. depth mismatch {0;0} vs {0});
            # flatten both and pair by order.
            flat_uids = [u for _p, us in uid_b for u in us]
            flat_lbls = [l for _p, ls in lbl_b for l in ls]
            for i in range(min(len(flat_uids), len(flat_lbls))):
                label_by_uid[flat_uids[i]] = flat_lbls[i]
    elif lbl_raw is not None:
        # List/Item input: treat as a flat sequence aligned to flattened uids.
        try:
            flat_lbls = list(lbl_raw)
        except TypeError:
            flat_lbls = [lbl_raw]
        flat_uids = [u for _p, us in uid_b for u in us]
        for i in range(min(len(flat_uids), len(flat_lbls))):
            label_by_uid[flat_uids[i]] = flat_lbls[i]

    floor_run = 0.0
    total_rooms = 0
    weak_routed = []
    dept_set = set()
    _eff_report = []

    for (path, uid_list) in uid_b:
        key = str(path)
        rank = path.Indices[0] if path.Indices else 0
        n = len(uid_list)
        if n == 0:
            continue

        dd = dept_b.get(key, [-1] * n)
        cc = color_b.get(key, [System.Drawing.Color.Gray] * n)
        ci = cid_b.get(key, [0] * n)

        # room records for THIS floor
        recs = []
        for i in range(n):
            u = uid_list[i]
            a_in = area_by_uid.get(u, 100.0)
            recs.append(dict(uid=u, dept=dd[i] if i < len(dd) else -1,
                             color=cc[i] if i < len(cc) else System.Drawing.Color.Gray,
                             cid=int(ci[i]) if i < len(ci) else 0,
                             area_model=a_in * (lin * lin)))
            dept_set.add(recs[-1]["dept"])

        clusters = sorted(set(r["cid"] for r in recs))

        # ---- cluster adjacency graph (for placement) ----------------------
        cid_of_uid = {r["uid"]: r["cid"] for r in recs}
        pair_w = {}
        for s, t in zip(asrc, atgt):
            if s in cid_of_uid and t in cid_of_uid:
                a, b = cid_of_uid[s], cid_of_uid[t]
                if a == b:
                    continue
                kk = (min(a, b), max(a, b))
                pair_w[kk] = pair_w.get(kk, 0) + 1

        # ---- lay out each cluster locally (double-loaded, WRAPPING) -------
        # Each room targets room_depth; area preserved by WIDENING along the
        # corridor up to max_aspect, then (only if still too big) deepening.
        # Rows wrap into stacked branches when a run exceeds the cluster's
        # solver footprint width (faithful to Comp02 bubble extent).
        cluster_layout = {}
        for cid in clusters:
            members = [r for r in recs if r["cid"] == cid]
            m = len(members)
            if m == 0:
                continue

            # --- solver footprint width for this cluster (wrap target) ------
            xs = [sol_pos[r["uid"]][0] for r in members if r["uid"] in sol_pos]
            if len(xs) >= 2:
                foot_w = (max(xs) - min(xs))
            else:
                foot_w = 0.0
            # convert solver units to model units (solver already model units);
            # ensure a sane minimum so tiny clusters still hold a few rooms
            min_run = 3.0 * room_depth
            max_run = max(min_run, foot_w if foot_w > 0 else min_run)

            # --- per-room shaping: width & depth from area, depth-capped ----
            def _shape(area_model):
                """Return (w, depth) with access edge flat. Target depth =
                room_depth; widen (up to max_aspect) to hold area; if the
                room still doesn't fit, let depth grow beyond the cap."""
                depth = room_depth
                w = area_model / depth
                # aspect = long:short
                asp = max(w, depth) / max(1e-9, min(w, depth))
                if asp <= max_aspect:
                    return w, depth
                # too skinny/wide at target depth -> clamp aspect, grow depth
                # keep width at max_aspect * depth, solve depth for exact area
                # area = w * depth, w = max_aspect * depth  (wide-shallow case)
                if w > depth:
                    # wide room: w = max_aspect * depth -> depth = sqrt(area/max_aspect)
                    depth = math.sqrt(area_model / max_aspect)
                    w = area_model / depth
                else:
                    # tall room: depth = max_aspect * w -> w = sqrt(area/max_aspect)
                    w = math.sqrt(area_model / max_aspect)
                    depth = area_model / w
                return w, depth

            # --- ORDER members ------------------------------------------------
            # "bubble" (default): honour the solver's bubble layout AND keep each
            # adjacency chain contiguous, so a shared-access child (restroom,
            # vestibule) sits immediately beside its parent classroom and they
            # share a wall (Comp06 puts the direct door there). Without this the
            # rooms scatter and shared doors have no adjacent parent to open into.
            # "even": legacy width-balanced packing (kept for comparison).
            def _sol_x(rec):
                p = sol_pos.get(rec["uid"])
                return p[0] if p else 0.0

            member_uids = set(r["uid"] for r in members)
            rec_by_uid = {r["uid"]: r for r in members}

            if split_mode == "even":
                # legacy: solver order, then rows width-balanced (scatters chains)
                ordered = sorted(members, key=_sol_x)
            else:
                # bubble: build adjacency CHAINS. A chain is a parent followed by
                # every shared-access descendant that points (transitively) back
                # into this cluster. Chains are ordered left->right by the parent's
                # solver x so the branch still tracks the bubble diagram.
                #
                # child -> parent within this cluster (only for shared rooms; a
                # non-shared room stands alone even if it has a Conn.Primary, since
                # only shared rooms need a direct wall to their parent).
                child_to_parent = {}
                for r in members:
                    u = r["uid"]
                    if shared_by_uid.get(u, False):
                        par = parent_of.get(u)
                        if par in member_uids:
                            child_to_parent[u] = par
                # parent -> ordered list of its shared children
                kids_of = {}
                for child, par in child_to_parent.items():
                    kids_of.setdefault(par, []).append(child)
                for par in kids_of:
                    kids_of[par].sort(key=lambda u: _sol_x(rec_by_uid[u]))

                placed_uids = set()
                ordered = []

                def _emit_chain(u):
                    # depth-first: parent, then its shared children (each of which
                    # may itself have shared grandchildren -> vestibule off restroom)
                    if u in placed_uids or u not in rec_by_uid:
                        return
                    placed_uids.add(u)
                    ordered.append(rec_by_uid[u])
                    for kid in kids_of.get(u, []):
                        _emit_chain(kid)

                # chain roots = members that are NOT a shared child of another
                # member, taken left->right by solver x. Everything hangs off them.
                roots = [r for r in members if r["uid"] not in child_to_parent]
                roots.sort(key=_sol_x)
                for r in roots:
                    _emit_chain(r["uid"])
                # safety: sweep any member missed (cycles / orphans)
                for r in sorted(members, key=_sol_x):
                    _emit_chain(r["uid"])

            # pre-shape all rooms (order preserved)
            shaped = []
            for r in ordered:
                w, depth = _shape(r["area_model"])
                shaped.append(dict(rec=r, w=w, depth=depth,
                                   shared=shared_by_uid.get(r["uid"], False),
                                   parent=parent_of.get(r["uid"])))

            # --- big-room extraction: a room whose width alone exceeds a large
            # fraction of max_run dominates its branch. Pull these OUT into their
            # own single-room branches placed at the FAR edge (away from trunk),
            # so they stop walling off the smaller rooms. A shared-access room is
            # NEVER extracted -- it must stay beside its parent.
            big_thresh = big_room_frac * max_run
            big_rooms = [sr for sr in shaped if sr["w"] >= big_thresh and not sr["shared"]]
            normal = [sr for sr in shaped if not (sr["w"] >= big_thresh and not sr["shared"])]

            # --- pack rooms into rows, wrapping at max_run --------------------
            # KEEP CHAINS UNBROKEN: a parent and its shared children are an atomic
            # group; if the group won't fit the current row, wrap the WHOLE group
            # to the next row rather than splitting parent from child.
            groups = []          # list of lists of shaped-rooms (each an atom)
            k = 0
            while k < len(normal):
                grp = [normal[k]]
                # absorb immediately-following shared children of this room
                base_uid = normal[k]["rec"]["uid"]
                j = k + 1
                while j < len(normal) and normal[j]["shared"] and \
                        normal[j]["parent"] in (g["rec"]["uid"] for g in grp):
                    grp.append(normal[j])
                    j += 1
                groups.append(grp)
                k = j

            if split_mode == "even":
                # legacy behaviour: flat wrap, no atomic groups
                groups = [[sr] for sr in normal]

            rows = []
            cur = []
            cur_w = 0.0
            for grp in groups:
                gw = sum(g["w"] for g in grp) + room_gap * (len(grp) - 1)
                add_w = gw + (room_gap if cur else 0.0)
                if cur and (cur_w + add_w) > max_run:
                    rows.append(cur)
                    cur = list(grp)
                    cur_w = gw
                else:
                    cur.extend(grp)
                    cur_w += add_w
            if cur:
                rows.append(cur)

            # --- pair rows into branches --------------------------------------
            branches = []
            if split_mode == "even":
                # legacy: width-balance the pooled rows (scatters adjacency)
                for i in range(0, len(rows), 2):
                    pool = list(rows[i])
                    if i + 1 < len(rows):
                        pool += list(rows[i + 1])
                    pool.sort(key=lambda sr: -sr["w"])
                    top_row, bot_row = [], []
                    tw, bw = 0.0, 0.0
                    for sr in pool:
                        if tw <= bw:
                            top_row.append(sr); tw += sr["w"] + room_gap
                        else:
                            bot_row.append(sr); bw += sr["w"] + room_gap
                    branches.append(dict(top_row=top_row, bot_row=bot_row,
                                         count=len(top_row) + len(bot_row)))
            else:
                # bubble: consecutive rows become the two sides of a branch, IN
                # ORDER (no width sort, no re-deal). Adjacency chains stay intact
                # and neighbours stay neighbours; a shared child ends up directly
                # beside its parent in the same row.
                for i in range(0, len(rows), 2):
                    top_row = list(rows[i])
                    bot_row = list(rows[i + 1]) if i + 1 < len(rows) else []
                    branches.append(dict(top_row=top_row, bot_row=bot_row,
                                         count=len(top_row) + len(bot_row)))

            # --- ORDER branches by room count: MOST rooms nearest the trunk
            # (branches are stacked away from the trunk, so the first in this
            # list sits closest to trunk). Big single rooms go LAST (far edge).
            branches.sort(key=lambda b: -b["count"])
            for sr in big_rooms:
                branches.append(dict(top_row=[sr], bot_row=[], count=1, big=True))

            # --- assign local coordinates, stacking branches vertically ----
            # Breaks are decided ONCE per branch from the longer row's geometry,
            # then applied identically to both rows so the cross-corridor lines up.
            # A break inserts break_gap; the run length resets AT each break so no
            # segment exceeds max_corridor_len.
            # Each row breaks at ITS OWN room boundaries. The break corridor spans
            # only that row's half of the branch (centerline to that row's far
            # edge), so it never reaches into the other row's rooms. Rows meet at
            # the branch centerline (already a corridor) -> network stays connected.
            def _lay_row(row, y_access, grow_up, do_breaks):
                x = 0.0
                placed = []
                bxs = []
                run_start = 0.0
                for i, sr in enumerate(row):
                    w = sr["w"]; depth = sr["depth"]
                    if do_breaks and (x - run_start) + w > max_corridor_len and x > 0.0:
                        bxs.append(x + break_gap * 0.5)
                        x += break_gap
                        run_start = x
                    y0 = y_access if grow_up else y_access - depth
                    placed.append(dict(rec=sr["rec"], x=x, y=y0, w=w, h=depth,
                                       access_up=grow_up))
                    x += w + room_gap
                return placed, (x - room_gap if row else 0.0), bxs

            laid_branches = []
            cur_y = 0.0    # top of the current branch stack (descending)
            cluster_w = 0.0
            for br in branches:
                tmp_top, top_w, _ = _lay_row(br["top_row"], 0.0, True, False)
                tmp_bot, bot_w, _ = _lay_row(br["bot_row"], 0.0, False, False)
                top_depth = max((p["h"] for p in tmp_top), default=0.0)
                bot_depth = max((p["h"] for p in tmp_bot), default=0.0)

                # --- SINGLE-LOADED: face the corridor TOWARD the trunk ---------
                # A single-loaded branch has rooms on only one side. Place that
                # row on the branch's trunk-FACING side so its access corridor
                # points at the trunk (shortening the connection), not the edge.
                # The cluster's dense edge (loc_top) pins to the trunk, so the
                # trunk-facing side of a branch is its UPPER side (top_row) for
                # non-mirrored (bottom-band) and lower for mirrored (top-band).
                # We normalize to top_row here; the emit's mirror_y then points it
                # at the trunk for whichever band the cluster lands in.
                one_sided = (len(br["top_row"]) == 0) != (len(br["bot_row"]) == 0)
                if one_sided:
                    # consolidate the single row into top_row (trunk-facing after
                    # the cluster's dense-to-trunk orientation)
                    solo = br["top_row"] if br["top_row"] else br["bot_row"]
                    br["top_row"], br["bot_row"] = solo, []
                    tmp_top, top_w, _ = _lay_row(br["top_row"], 0.0, True, False)
                    tmp_bot, bot_w, _ = _lay_row(br["bot_row"], 0.0, False, False)
                    top_depth = max((p["h"] for p in tmp_top), default=0.0)
                    bot_depth = max((p["h"] for p in tmp_bot), default=0.0)
                    br["single_loaded"] = True

                bc_y = cur_y - top_depth - branch_gap * 0.5
                top_placed, top_w2, top_bxs = _lay_row(br["top_row"], bc_y + branch_gap * 0.5, True, True)
                bot_placed, bot_w2, bot_bxs = _lay_row(br["bot_row"], bc_y - branch_gap * 0.5, False, True)
                # breaks stay SIDE-TAGGED: top breaks span centerline->top edge,
                # bottom breaks span centerline->bottom edge (half-span each).
                top_break_xs = list(top_bxs)
                bot_break_xs = list(bot_bxs)

                bw = max(top_w2, bot_w2, 1.0)
                cluster_w = max(cluster_w, bw)
                laid_branches.append(dict(
                    top=top_placed, bot=bot_placed, w=bw,
                    top_break_xs=top_break_xs, bot_break_xs=bot_break_xs,
                    top_depth=top_depth, bot_depth=bot_depth, bc_y=bc_y,
                    single_loaded=bool(br.get("single_loaded")),
                    big=bool(br.get("big"))))

                # advance stack downward: this branch total height + vertical gap
                branch_total = top_depth + branch_gap + bot_depth
                cur_y = bc_y - bot_depth - branch_gap * 0.5 - branch_gap_v

            cluster_h = abs(cur_y) if laid_branches else 0.0
            # local vertical extent of the cluster's rooms (for shelf band align):
            # top row of first branch sits highest, bottom row of last lowest.
            loc_top = -1e18
            loc_bot = 1e18
            for lb in laid_branches:
                for p in lb["top"] + lb["bot"]:
                    loc_top = max(loc_top, p["y"] + p["h"])
                    loc_bot = min(loc_bot, p["y"])
            if loc_top < loc_bot:
                loc_top, loc_bot = 0.0, 0.0
            # DENSE end: branches[0] is the most-populated (sorted). Its rooms
            # define the edge that should sit AGAINST the trunk. branch[0] is at
            # the TOP of the local stack, so its far (upper) edge is the dense
            # edge = loc_top. We record dense_at_top so emit pins the dense edge
            # to the trunk regardless of band.
            cluster_layout[cid] = dict(branches=laid_branches, w=cluster_w, h=cluster_h,
                                       loc_top=loc_top, loc_bot=loc_bot,
                                       dense_at_top=True)

        # ---- place clusters by adjacency (greedy strongest-first) ---------
        # order clusters: seed with the most-connected, then append neighbors
        order = []
        remaining = set(cluster_layout.keys())
        if remaining:
            # seed = cluster with highest total adjacency weight
            deg = {c: 0 for c in remaining}
            for (a, b), w in pair_w.items():
                if a in deg:
                    deg[a] += w
                if b in deg:
                    deg[b] += w
            seed = max(remaining, key=lambda c: deg.get(c, 0))
            order.append(seed)
            remaining.discard(seed)
            while remaining:
                # pick the remaining cluster with strongest tie to placed set
                best_c, best_w = None, -1
                for c in remaining:
                    tie = 0
                    for p in order:
                        kk = (min(c, p), max(c, p))
                        tie += pair_w.get(kk, 0)
                    if tie > best_w:
                        best_w, best_c = tie, c
                order.append(best_c)
                remaining.discard(best_c)
                if best_w == 0:
                    weak_routed.append("floor {} cluster {} (no direct adjacency to placed)".format(rank, best_c))

        # ---- SHELF PACKING (Option A: double-loaded shelves) --------------
        ox = floor_run if spread_axis == 0 else 0.0
        oy = floor_run if spread_axis == 1 else 0.0
        z = 0.0
        path_out = GH_Path(rank)

        floor_minx = 1e18; floor_miny = 1e18
        floor_maxx = -1e18; floor_maxy = -1e18

        # target envelope width. Clusters are chunky 2D blocks placed on
        # DOUBLE-LOADED shelves: each shelf's width is the longer of its two
        # bands (top/bottom alternate), so a shelf holding k clusters spans
        # ~ (sum_cluster_w / 2) not the full sum. Its height is the two tallest
        # band clusters stacked. We search shelf-count n for the envelope aspect
        # closest to target.
        sum_cluster_w = sum(cluster_layout[c]["w"] for c in order)
        sum_cluster_w += trunk_gap * max(0, len(order) - 1)
        max_cluster_h = max((cluster_layout[c]["h"] for c in order), default=1.0)
        widest = max((cluster_layout[c]["w"] for c in order), default=sum_cluster_w)
        n_clusters_here = max(1, len(order))
        best_n = 1
        best_err = 1e18
        for n_try in range(1, n_clusters_here + 1):
            # clusters per shelf ~ n_clusters/n_try, split across 2 bands
            per_shelf = n_clusters_here / float(n_try)
            # width of a shelf ~ (per_shelf/2) * avg_cluster_w
            avg_w = sum_cluster_w / n_clusters_here
            ew = max(widest, (per_shelf / 2.0) * avg_w)
            # height ~ n_try shelves, each ~2 band-heights + gaps
            eh = n_try * (2.0 * max_cluster_h + trunk_gap + shelf_gap)
            asp = ew / eh if eh else 1.0
            err = abs(asp - envelope_aspect)
            if err < best_err:
                best_err, best_n = err, n_try
        # env_w threshold: the packing loop tracks per-band width (top/bottom
        # fill independently via fill-shorter-band), so a shelf wraps when the
        # shorter band would exceed env_w. best_n is chosen to approach the
        # target aspect; the widest single cluster always fits.
        env_w = max(widest, sum_cluster_w / max(1, best_n))

        # assign clusters to shelves. Clusters go to whichever BAND (top/bottom)
        # is currently SHORTER (fills gaps instead of stranding clusters on the
        # end of one band). A shelf wraps when the shorter band would still
        # exceed env_w after adding.
        shelves = []
        cur_items = []
        band_w = [0.0, 0.0]   # [top, bottom] running widths
        for cid in order:
            cw = cluster_layout[cid]["w"]
            b = 0 if band_w[0] <= band_w[1] else 1   # fill the shorter band
            add_w = cw + (trunk_gap if band_w[b] > 0 else 0.0)
            if cur_items and (band_w[b] + add_w) > env_w:
                shelves.append(dict(items=cur_items,
                                    width=max(band_w[0], band_w[1])))
                cur_items = []
                band_w = [0.0, 0.0]
                b = 0
                add_w = cw
            cur_items.append((cid, b))
            band_w[b] += add_w
        if cur_items:
            shelves.append(dict(items=cur_items, width=max(band_w[0], band_w[1])))

        # place shelves stacking upward; each shelf has a central trunk line,
        # TOP-band clusters sit above it, BOTTOM-band clusters below it.
        # Vertical corridors (gap channels + half-span breaks) are COLLECTED
        # here per floor, then consolidated (snap to gaps + merge) and emitted
        # after all shelves -- so we get one clean vertical per gap, not doubles.
        _vcorr = []   # each: dict(x, y0, y1, weight, kind) kind: gap|break
        _gap_xs = []  # trunk_gap channel center x-positions (snap targets)
        _room_spans = []  # (x0, x1) of each room, for the perimeter test

        # --- WEIGHTED CENTROID X (room count x cluster position) --------------
        # Pre-estimate each cluster's center x from the band packing so rooms can
        # fill TOWARD the building center. Weight by room count. Computed from
        # cluster positions (fixed by packing) -> no fill/centroid circularity.
        def _cluster_room_count(cid):
            return sum(len(b["top"]) + len(b["bot"]) for b in cluster_layout[cid]["branches"])
        _cx_est = {}
        for shelf in shelves:
            for band in (0, 1):
                cx = ox
                for cid, bd in shelf["items"]:
                    if bd != band:
                        continue
                    lay = cluster_layout[cid]
                    _cx_est[cid] = cx + lay["w"] * 0.5
                    cx += lay["w"] + trunk_gap
        _tot_w = sum(_cluster_room_count(c) for c in order) or 1
        centroid_x = sum(_cx_est.get(c, ox) * _cluster_room_count(c) for c in order) / _tot_w

        shelf_y = oy
        for si, shelf in enumerate(shelves):
            # shelf band depths: tallest top-band cluster above, bottom below
            top_ids = [cid for cid, b in shelf["items"] if b == 0]
            bot_ids = [cid for cid, b in shelf["items"] if b == 1]
            top_depth = max((cluster_layout[c]["loc_top"] - cluster_layout[c]["loc_bot"]
                             for c in top_ids), default=0.0)
            bot_depth = max((cluster_layout[c]["loc_top"] - cluster_layout[c]["loc_bot"]
                             for c in bot_ids), default=0.0)

            trunk_y = shelf_y + bot_depth + trunk_gap * 0.5   # shelf trunk datum

            # lay a band with SUB-STACKING: clusters pack into columns. The
            # first cluster in a column sits against the trunk (dense branch
            # facing it); shorter following clusters STACK behind it (away from
            # trunk) to fill the band height before moving to a new column.
            # Adjacency order preserved along the column fill.
            def _place_band(ids, band, band_depth):
                cx = ox
                centers_this = []
                i = 0
                while i < len(ids):
                    # start a new column with cluster ids[i] against the trunk
                    col = [ids[i]]
                    col_w = cluster_layout[ids[i]]["w"]
                    used_depth = cluster_layout[ids[i]]["loc_top"] - cluster_layout[ids[i]]["loc_bot"]
                    j = i + 1
                    # stack following clusters behind if they fit the remaining depth
                    while j < len(ids):
                        ch = cluster_layout[ids[j]]["loc_top"] - cluster_layout[ids[j]]["loc_bot"]
                        if used_depth + shelf_gap + ch <= band_depth + 1e-6:
                            col.append(ids[j])
                            col_w = max(col_w, cluster_layout[ids[j]]["w"])
                            used_depth += shelf_gap + ch
                            j += 1
                        else:
                            break
                    # place the column: first cluster at trunk, rest stacked away
                    depth_cursor = 0.0
                    for ci, cid in enumerate(col):
                        lay = cluster_layout[cid]
                        ch = lay["loc_top"] - lay["loc_bot"]
                        bx = cx
                        # FILL TOWARD CENTER: a cluster LEFT of the centroid packs
                        # its rooms right-to-left (mirror_x) so they sit toward the
                        # building center; a cluster RIGHT of centroid fills left-
                        # to-right (no mirror). Rooms therefore always pack inward.
                        cl_center = bx + lay["w"] * 0.5
                        mx = cl_center < centroid_x
                        if band == 0:
                            trunk_edge = (trunk_y + trunk_gap * 0.5) + depth_cursor
                            by = trunk_edge + lay["loc_top"]
                            _emit_cluster(cid, bx, by, mirror_y=True, mirror_x=mx)
                        else:
                            trunk_edge = (trunk_y - trunk_gap * 0.5) - depth_cursor
                            by = trunk_edge - lay["loc_top"]
                            _emit_cluster(cid, bx, by, mirror_y=False, mirror_x=mx)
                        centers_this.append(rg.Point3d(bx + lay["w"] * 0.5, trunk_y, z))
                        depth_cursor += ch + shelf_gap
                    # record the trunk_gap channel center AFTER this column (the
                    # reserved gap between this column and the next) as a snap
                    # target, WITH the band's y-span so an empty gap still gets a
                    # corridor from the spine to the furthest branch in this band.
                    gx = cx + col_w + trunk_gap * 0.5
                    if band == 0:
                        gy_near, gy_far = trunk_y, trunk_y + trunk_gap * 0.5 + used_depth
                    else:
                        gy_near, gy_far = trunk_y - trunk_gap * 0.5 - used_depth, trunk_y
                    _gap_xs.append((gx, min(gy_near, gy_far), max(gy_near, gy_far)))
                    cx += col_w + trunk_gap
                    i = j
                return centers_this

            # emit a single cluster at world origin (bx, by). mirror_y flips the
            # cluster vertically about its local origin so the dense branch faces
            # the trunk (used for top-band clusters). mirror_x flips the cluster
            # HORIZONTALLY so rooms fill toward the building center instead of
            # left-to-right from the cluster origin.
            def _emit_cluster(cid, bx, by, mirror_y=False, mirror_x=False):
                lay = cluster_layout[cid]
                cw_local = lay["w"]
                cminx = 1e18; cminy = 1e18; cmaxx = -1e18; cmaxy = -1e18
                n_branches = len(lay["branches"])
                for bi, br in enumerate(lay["branches"]):
                    is_big = bool(br.get("big"))
                    branch_room_count = 0
                    _top_y_ext = []   # world y-values of top-row rooms
                    _bot_y_ext = []   # world y-values of bottom-row rooms
                    _br_x_ext = []    # world x-values of this branch's rooms
                    # SINGLE-LOADED: flip so the branch corridor + access edge sit
                    # on the TRUNK-facing side of the rooms, not the outer edge.
                    # The trunk is toward loc_top (dense-to-trunk pin). After the
                    # cluster's mirror_y, the trunk-facing vertical direction is:
                    #   top-band (mirror_y=True): trunk is BELOW -> corridor below rooms
                    #   bottom-band (mirror_y=False): trunk is ABOVE -> corridor above rooms
                    # For single-loaded, force the access edge to point that way.
                    sl_flip = bool(br.get("single_loaded"))
                    for gi, group in enumerate((br["top"], br["bot"])):
                        for p in group:
                            r = p["rec"]
                            w = p["w"]; h = p["h"]
                            if mirror_x:
                                x0 = bx + (cw_local - (p["x"] + w))
                            else:
                                x0 = bx + p["x"]
                            if mirror_y:
                                y0 = by - (p["y"] + h)
                                acc_up = not p["access_up"]
                            else:
                                y0 = by + p["y"]
                                acc_up = p["access_up"]
                            # single-loaded: corridor faces trunk. top-band trunk is
                            # below (acc_up False); bottom-band trunk is above (True).
                            if sl_flip:
                                acc_up = True if not mirror_y else False
                            plane = rg.Plane(rg.Point3d(x0, y0, z), rg.Vector3d.ZAxis)
                            rooms.Add(rg.Rectangle3d(plane, w, h).ToNurbsCurve(), path_out)
                            room_lbl.Add(label_by_uid.get(r["uid"], r["uid"]), path_out)
                            room_uid_out.Add(r["uid"], path_out)
                            room_dept_out.Add(r["dept"], path_out)
                            room_color_out.Add(r["color"], path_out)
                            cluster_id_out.Add(cid, path_out)
                            access_edge.Add(3 if acc_up else 1, path_out)
                            _fb[4] += 1
                            branch_room_count += 1
                            _room_spans.append((x0, x0 + w))
                            if gi == 0:
                                _top_y_ext.extend([y0, y0 + h])
                            else:
                                _bot_y_ext.extend([y0, y0 + h])
                            _br_x_ext.extend([x0, x0 + w])
                            cminx = min(cminx, x0); cminy = min(cminy, y0)
                            cmaxx = max(cmaxx, x0 + w); cmaxy = max(cmaxy, y0 + h)

                    # branch centerline. For single-loaded branches, put the
                    # centerline on the TRUNK-facing side of the rooms (so the
                    # corridor sits between rooms and trunk), not the outer edge,
                    # and span only the rooms' actual x-extent (they may be mirror_x'd).
                    bcy = (by - br["bc_y"]) if mirror_y else (by + br["bc_y"])
                    bx0 = bx
                    bx1 = bx + br["w"]
                    if sl_flip:
                        row_ys = _top_y_ext + _bot_y_ext
                        if row_ys:
                            if not mirror_y:
                                bcy = max(row_ys) + branch_gap * 0.5
                            else:
                                bcy = min(row_ys) - branch_gap * 0.5
                        if _br_x_ext:
                            bx0 = min(_br_x_ext)
                            bx1 = max(_br_x_ext)
                    # HIERARCHY DEDUP (Trunk Shelf > Trunk > Branch): if this branch
                    # corridor coincides with the shelf trunk line (within branch_gap),
                    # skip it -- the trunk already serves these rooms.
                    if abs(bcy - trunk_y) <= branch_gap:
                        pass  # overlaps shelf trunk -> eliminate branch corridor
                    else:
                        branch_ctr.Add(rg.Line(rg.Point3d(bx0, bcy, z),
                                               rg.Point3d(bx1, bcy, z)).ToNurbsCurve(), path_out)
                        bp = rg.Plane(rg.Point3d(bx0, bcy - branch_gap * 0.5, z), rg.Vector3d.ZAxis)
                        branch_rect.Add(rg.Rectangle3d(bp, bx1 - bx0, branch_gap).ToNurbsCurve(), path_out)

                    # --- COLLECT vertical corridors (emitted after consolidation)
                    # Connectors are NO LONGER emitted as standalone verticals --
                    # they routed through branch interiors (cutting rooms). Every
                    # branch reaches the trunk via a GAP corridor (between clusters)
                    # or a BREAK corridor (real room-split gap) instead, both of
                    # which sit in genuine gaps by construction.
                    # Break corridors: HALF-SPAN per row side. A top-row break
                    # runs from the branch centerline to the top row's far edge;
                    # a bottom-row break from centerline to the bottom edge. Each
                    # stays clear of the OTHER row's rooms; both meet the branch
                    # centerline corridor -> network stays connected.
                    def _bxk_world(bxk_local):
                        if mirror_x:
                            return bx + (cw_local - bxk_local)
                        return bx + bxk_local
                    for bxk_local in br.get("top_break_xs", []):
                        if _top_y_ext:
                            far = max(_top_y_ext, key=lambda yy: abs(yy - bcy))
                            ya, yb = sorted([bcy, far])
                            _vcorr.append(dict(x=_bxk_world(bxk_local), y0=ya, y1=yb,
                                               weight=int(branch_room_count),
                                               kind="break", prio=2))
                    for bxk_local in br.get("bot_break_xs", []):
                        if _bot_y_ext:
                            far = max(_bot_y_ext, key=lambda yy: abs(yy - bcy))
                            ya, yb = sorted([bcy, far])
                            _vcorr.append(dict(x=_bxk_world(bxk_local), y0=ya, y1=yb,
                                               weight=int(branch_room_count),
                                               kind="break", prio=2))

                if cmaxx > cminx:
                    cp = rg.Plane(rg.Point3d(cminx, cminy, z), rg.Vector3d.ZAxis)
                    cluster_rect_out.Add(rg.Rectangle3d(cp, cmaxx - cminx, cmaxy - cminy).ToNurbsCurve(), path_out)
                    _fb[0] = min(_fb[0], cminx); _fb[1] = min(_fb[1], cminy)
                    _fb[2] = max(_fb[2], cmaxx); _fb[3] = max(_fb[3], cmaxy)

            _fb = [floor_minx, floor_miny, floor_maxx, floor_maxy, 0]
            top_centers = _place_band(top_ids, 0, top_depth)
            bot_centers = _place_band(bot_ids, 1, bot_depth)
            floor_minx, floor_miny, floor_maxx, floor_maxy = _fb[0], _fb[1], _fb[2], _fb[3]
            total_rooms += _fb[4]

            # shelf trunk centerline: the spine, in the reserved band gap.
            # All verticals land on trunk_y by construction (shared coordinate).
            shelf_left = ox
            shelf_right = ox + shelf["width"]
            trunk_ctr.Add(rg.Line(rg.Point3d(shelf_left, trunk_y, z),
                                  rg.Point3d(shelf_right, trunk_y, z)).ToNurbsCurve(), path_out)
            # weight = total rooms this shelf's trunk serves
            shelf_room_ct = sum(cluster_layout[c]["branches"] and
                                sum(len(b["top"]) + len(b["bot"]) for b in cluster_layout[c]["branches"])
                                for c, _b in shelf["items"])
            trunk_weight.Add(int(shelf_room_ct), path_out)

            # advance to next shelf upward
            shelf_h = top_depth + trunk_gap + bot_depth
            shelf_y = shelf_y + shelf_h + shelf_gap

        # ---- CONSOLIDATE + EMIT vertical corridors (per floor) ------------
        # 1) every trunk_gap channel gets a corridor by default.
        # 2) breaks within snap_dist of a gap channel SNAP onto it.
        # 3) leftover verticals within snap_dist of each other MERGE.
        # Each resulting vertical spans from the shelf spine to the furthest
        # branch it serves (min y0 .. max y1 of the members snapped to it).
        # Result: one clean vertical per gap; mid-cluster breaks kept only when
        # no gap is near.
        gap_data = sorted(_gap_xs, key=lambda t: t[0])

        # Half-span BREAK corridors sit in real room gaps already -> emit them
        # directly (no bucket merge, which would stretch them to full height and
        # pull them onto gap-channel x). Only GAP-CHANNEL verticals go through
        # consolidation (dedup + perimeter test).
        breaks = [v for v in _vcorr if v.get("kind") == "break"]
        for v in breaks:
            if v["y1"] > v["y0"]:
                # skip breaks whose x is a true perimeter (no rooms one side)
                trunk_ctr.Add(rg.Line(rg.Point3d(v["x"], v["y0"], z),
                                      rg.Point3d(v["x"], v["y1"], z)).ToNurbsCurve(), path_out)
                trunk_weight.Add(int(max(v["weight"], 1)), path_out)

        # bucket GAP channels (dedup near-duplicates)
        buckets = []
        def _add(xv, prio, y0, y1, wt):
            for b in buckets:
                if abs(b["x"] - xv) <= snap_dist:
                    b["y0"] = min(b["y0"], y0)
                    b["y1"] = max(b["y1"], y1)
                    b["weight"] += wt
                    if prio > b["prio"]:
                        b["x"] = xv
                        b["prio"] = prio
                    return
            buckets.append(dict(x=xv, prio=prio, y0=y0, y1=y1, weight=wt))

        for (gx, gy0, gy1) in gap_data:
            _add(gx, 1, gy0, gy1, 0)

        # DROP true PERIMETER verticals only: a vertical is redundant if there
        # are NO rooms on one of its sides (it runs along the building edge). A
        # gap between two real clusters has rooms on both sides and is KEPT, even
        # if it sits near the bounding-box edge (e.g. beside a big extracted room).
        def _has_rooms_left(xv):
            for (rx0, rx1) in _room_spans:
                if rx1 <= xv + 1e-6 and (xv - rx1) < snap_dist * 3:
                    return True
            return False

        def _has_rooms_right(xv):
            for (rx0, rx1) in _room_spans:
                if rx0 >= xv - 1e-6 and (rx0 - xv) < snap_dist * 3:
                    return True
            return False

        emitted_v = 0
        for b in buckets:
            if b["y1"] <= b["y0"]:
                continue
            # keep only if rooms exist on BOTH sides within reach
            if not (_has_rooms_left(b["x"]) and _has_rooms_right(b["x"])):
                continue   # true perimeter -> redundant with building edge
            trunk_ctr.Add(rg.Line(rg.Point3d(b["x"], b["y0"], z),
                                  rg.Point3d(b["x"], b["y1"], z)).ToNurbsCurve(), path_out)
            trunk_weight.Add(int(max(b["weight"], 1)), path_out)
            emitted_v += 1

        # floor envelope
        if floor_maxx > floor_minx:
            ep = rg.Plane(rg.Point3d(floor_minx, floor_miny, z), rg.Vector3d.ZAxis)
            env_rect.Add(rg.Rectangle3d(ep, floor_maxx - floor_minx, floor_maxy - floor_miny).ToNurbsCurve(), path_out)
            extent = (floor_maxx - floor_minx) if spread_axis == 0 else (floor_maxy - floor_miny)
            floor_run += extent + floor_gap
            # efficiency: room area / envelope area for this floor
            env_area = (floor_maxx - floor_minx) * (floor_maxy - floor_miny)
            room_area = sum(r["area_model"] for r in recs)
            eff = (room_area / env_area * 100.0) if env_area > 0 else 0.0
            _eff_report.append("  Floor {} efficiency: {:.0f}% ({:.0f}x{:.0f}, aspect {:.2f})".format(
                rank, eff, (floor_maxx - floor_minx) / lin, (floor_maxy - floor_miny) / lin,
                (floor_maxx - floor_minx) / (floor_maxy - floor_miny) if (floor_maxy - floor_miny) else 0))

        lines.append("  Floor branch {{{}}} : {} rooms, {} clusters, order={}".format(
            rank, n, len(clusters), order))

    depts = sorted(d for d in dept_set if d is not None)

    header = ["Component 04 | Corridor Organizer (double-loaded, wrapping)",
              "Total rooms re-laid : {}".format(total_rooms),
              "Unit system: {}   model-units/input: {:.4f}".format(unit_system, lin),
              "Split: {}   room_depth={} {}  max_aspect={}:1".format(
                  split_mode, _get("room_depth", 28.0), unit_system, _get("max_aspect", 2.5)),
              "branch_gap={} trunk_gap={} branch_gap_v={} {}".format(
                  _get("branch_gap", 6.0), _get("trunk_gap", 8.0), _get("branch_gap_v", 8.0), unit_system),
              ("Split=bubble: adjacency chains kept contiguous (shared child beside parent)."
               if split_mode != "even" else
               "Split=even: legacy width-balanced rows (adjacency NOT preserved)."),
              "Labels loaded from lbl_in: {} (0 = falling back to uid; check lbl_in wiring/Access=Tree).".format(len(label_by_uid)),
              "Access edge PINNED FLAT; dense branch faces trunk; sub-stacked; big rooms extracted.",
              "Corridors: shelf-trunk spine + gap-channel verticals + {}ft break splits (half-span).".format(_get("max_corridor_len", 75.0))]
    header += _eff_report
    if weak_routed:
        header.append("WEAK adjacencies routed long ({}):".format(len(weak_routed)))
        for wr in weak_routed[:8]:
            header.append("  " + wr)
    return "\n".join(header + lines)


_do_run = True if ('run' not in globals() or run is None) else bool(run)
if _do_run:
    info = _build()
else:
    info = "Idle: set run=True to organize."
# ---------- end comp04_corridororganizer ----------
list_5 = ItemSelector(linetypes_3, {"Model Linetype : (Continuous)"}, selected="Model Linetype : (Continuous)")
list_6 = ItemSelector(linetypes_3, {"Model Linetype : (Continuous)"}, selected="Model Linetype : (Continuous)")
panel_37 = Panel(comp04_corridororganizer.out)
rec_10 = Rectangle(comp04_corridororganizer.rooms)
txt_13 = Text(comp04_corridororganizer.room_lbl)
col_5 = Colour(comp04_corridororganizer.room_color_out)
crv_11 = Curve(comp04_corridororganizer.branch_ctr)
crv_12 = Curve(comp04_corridororganizer.trunk_ctr)
rec_11 = Rectangle(comp04_corridororganizer.cluster_rect_out)
rec_12 = Rectangle(comp04_corridororganizer.env_rect)
panel_38 = Panel(comp04_corridororganizer.info)
boundary_4 = BoundarySurfaces(Edges=rec_10)
area_5 = Area(Geometry=rec_10)  # -> Area, Centroid
dim_4 = Dimensions(Surface=rec_10)  # -> UDimension, VDimension
len_5 = TextLength(Text=txt_13)
division_9 = Division(A=dim_4.UDimension, B=len_5)
swatch_6 = ColourSwatch(SwatchColor=RGB(0, 34, 255))
swatch_7 = ColourSwatch(SwatchColor=RGB(255, 0, 0))

int_11 = Integer(comp04_corridororganizer.access_edge)
txt_14 = Text(comp04_corridororganizer.room_uid_out)
int_12 = Integer(comp04_corridororganizer.room_dept_out)
int_13 = Integer(comp04_corridororganizer.trunk_weight)

preview_12 = CustomPreview(Geometry=boundary_4, Material=col_5)  # disabled
tag_11 = TextTag3D(Location=area_5.Centroid, Text=txt_13, Size=division_9, Colour=swatch, Justification=5)  # disabled
curve_preview_3 = CustomCurvePreview(Curve=crv_11, Linetype=list_5, Colour=swatch_6)  # disabled
curve_preview_4 = CustomCurvePreview(Curve=crv_12, Linetype=list_5, Colour=swatch_7)  # disabled
curve_preview_5 = CustomCurvePreview(Curve=rec_11, Linetype=list_6, Colour=gradient)  # disabled
curve_preview_6 = CustomCurvePreview(Curve=rec_12, Linetype=list_6, Colour=swatch)  # disabled

comp05_corridorwidth = Python3Script(
    branch_ctr=crv_11,
    trunk_ctr=crv_12,
    trunk_weight=int_13,
    rooms=rec_10,
    room_uid=txt_14,
    access_edge=int_11,
    unit_system=panel_8,
    run=Toggle(True))  # -> out, branch_corr, trunk_corr, corr_all, branch_cl, trunk_cl, trunk_w_out, n_isolated, info; inputs branch_ctr: tree of Curve, trunk_ctr: tree of Curve, trunk_weight: tree of Int32, rooms: tree of Curve, room_uid: tree of String, access_edge: tree of Int32, unit_system: String, branch_w: Double, trunk_base_w: Double, trunk_step: Double, trunk_thresh: Int32, trunk_max_w: Double, run: Boolean
#   port trunk_ctr: from 04 (spine + connectors + breaks)
#   port rooms: from 04 (re-laid room rectangles)
#   port room_uid: from 04 room_uid_out
#   port access_edge: from 04 (0=+X 1=+Y 2=-X 3=-Y)
#   port n_isolated: count of isolated rooms that got stems
# ---------- comp05_corridorwidth: Python ----------
#! python3
# ==============================================================================
# COMPONENT 05  |  CORRIDOR WIDTH PASS  (branch / trunk ribbons)
# ------------------------------------------------------------------------------
# Rhino 8 / Grasshopper CPython script component.
# Takes the corridor SKELETON from Component 04 (branch centerlines + the shelf-
# trunk spine + channel-routed verticals) and offsets it into corridor RIBBONS
# with real widths. Branch/Trunk/Shelf corridors fulfill all circulation needs;
# there are no stem corridors.
#
# The skeleton is already connected BY CONSTRUCTION on shared coordinates
# (every connector endpoint lands exactly on the trunk spine), so this component
# only assigns width and picks up stragglers -- it never recomputes connectivity
# or matches floating-point endpoints. That is what avoids the fragmentation the
# older pipeline hit.
#
# CORRIDOR TYPES:
#   BRANCH : centerlines running between the two room rows of a branch.
#            Fixed default width (branch corridors carry one branch's rooms).
#   TRUNK  : the shelf spine + channel-routed verticals + break channels.
#            TRAFFIC-WIDENED: width = base + step per room served over a threshold
#            (from Comp04 trunk_weight).
#
# ------------------------------------------------------------------------------
# INPUTS
#   branch_ctr  : Curve | Tree | from 04 (branch centerlines, per floor)
#   trunk_ctr   : Curve | Tree | from 04 (spine + verticals + breaks)
#   trunk_weight: int   | Tree | from 04 (rooms served per trunk segment)
#
#   unit_system : str   | Item | "feet" or "meters"
#   branch_w    : float | Item | branch corridor width. Default 3.0
#   trunk_base_w: float | Item | trunk base width. Default 3.0
#   trunk_step  : float | Item | width added per room over threshold. Default 0.5
#   trunk_thresh: int   | Item | rooms served before widening starts. Default 4
#   trunk_max_w : float | Item | max trunk width cap. Default 8.0
#   run         : bool  | Item | solve toggle
#
# ------------------------------------------------------------------------------
# OUTPUTS (GRAFTED PER FLOOR, branch = floor rank)
#   branch_corr : Curve | Tree | branch corridor ribbons (closed rectangles)
#   trunk_corr  : Curve | Tree | trunk corridor ribbons (closed rectangles)
#   corr_all    : Curve | Tree | all corridor ribbons merged (for downstream)
#   branch_cl   : Curve | Tree | branch centerlines (passthrough for doors)
#   trunk_cl    : Curve | Tree | trunk centerlines (passthrough)
#   trunk_w_out : float | Tree | resolved trunk width per segment
#   info        : str   | Item | diagnostics
#
# ------------------------------------------------------------------------------
# CONVENTIONS / GOTCHAS
#   - "#! python3" required. Rhino.Geometry throughout. Tree Access on all Trees.
#   - Ribbons are closed rectangle curves centered on the centerline (offset both
#     sides by width/2). Axis-aligned skeleton -> ribbons are axis-aligned rects.
#   - No connectivity recomputation: the skeleton is already a single network.
# ==============================================================================

import Rhino
import Rhino.Geometry as rg
import System
import math
from Grasshopper import DataTree
from Grasshopper.Kernel.Data import GH_Path


def _get(name, default):
    return globals()[name] if (name in globals() and globals()[name] is not None) else default


def _unit_scale(sys_name):
    name = (sys_name or "feet").strip().lower()
    src_m = 1.0 if name.startswith("m") else 0.3048
    doc = Rhino.RhinoDoc.ActiveDoc
    try:
        umeters = Rhino.RhinoMath.UnitScale(Rhino.UnitSystem.Meters, doc.ModelUnitSystem)
    except Exception:
        umeters = 1.0
    return src_m * umeters


def _branches(tree):
    out = []
    if tree is None:
        return out
    try:
        paths = list(tree.Paths)
    except Exception:
        return out
    for p in paths:
        out.append((p, list(tree.Branch(p))))
    return out


def _line_endpoints(crv):
    """Return (p0, p1) for a line-like curve."""
    return crv.PointAtStart, crv.PointAtEnd


def _ribbon(p0, p1, width, z=0.0):
    """Closed rectangle ribbon centered on segment p0->p1, offset width/2 each side.
    Skeleton is axis-aligned so the perpendicular is clean."""
    dx = p1.X - p0.X
    dy = p1.Y - p0.Y
    ln = math.hypot(dx, dy)
    if ln < 1e-9:
        return None
    ux, uy = dx / ln, dy / ln
    # perpendicular
    px, py = -uy, ux
    hw = width * 0.5
    a = rg.Point3d(p0.X + px * hw, p0.Y + py * hw, z)
    b = rg.Point3d(p1.X + px * hw, p1.Y + py * hw, z)
    c = rg.Point3d(p1.X - px * hw, p1.Y - py * hw, z)
    d = rg.Point3d(p0.X - px * hw, p0.Y - py * hw, z)
    pl = rg.Polyline([a, b, c, d, a])
    return pl.ToNurbsCurve()


# ---- outputs ---------------------------------------------------------------
branch_corr = DataTree[object]()
trunk_corr = DataTree[object]()
corr_all = DataTree[object]()
branch_cl = DataTree[object]()
trunk_cl = DataTree[object]()
trunk_w_out = DataTree[object]()
info = ""


def _build():
    unit_system = _get("unit_system", "feet")
    lin = _unit_scale(unit_system)
    branch_w = float(_get("branch_w", 3.0)) * lin
    trunk_base_w = float(_get("trunk_base_w", 3.0)) * lin
    trunk_step = float(_get("trunk_step", 0.5)) * lin
    trunk_thresh = int(_get("trunk_thresh", 4))
    trunk_max_w = float(_get("trunk_max_w", 8.0)) * lin

    br_b = _branches(_get("branch_ctr", None))
    if not br_b:
        return "Waiting: no branch_ctr tree from Component 04."
    tr_b = dict((str(p), v) for p, v in _branches(_get("trunk_ctr", None)))
    tw_b = dict((str(p), v) for p, v in _branches(_get("trunk_weight", None)))

    total_branch = 0
    total_trunk = 0

    for (path, br_list) in br_b:
        key = str(path)
        rank = path.Indices[0] if path.Indices else 0
        pout = GH_Path(rank)

        # ---- BRANCH ribbons ------------------------------------------------
        for crv in br_list:
            p0, p1 = _line_endpoints(crv)
            rib = _ribbon(p0, p1, branch_w)
            if rib:
                branch_corr.Add(rib, pout)
                corr_all.Add(rib, pout)
                branch_cl.Add(crv, pout)
                total_branch += 1

        # ---- TRUNK ribbons (traffic-widened) -------------------------------
        tlist = tr_b.get(key, [])
        wlist = tw_b.get(key, [])
        for i, crv in enumerate(tlist):
            p0, p1 = _line_endpoints(crv)
            served = int(wlist[i]) if i < len(wlist) else 0
            extra = max(0, served - trunk_thresh) * trunk_step
            tw = min(trunk_max_w, trunk_base_w + extra)
            rib = _ribbon(p0, p1, tw)
            if rib:
                trunk_corr.Add(rib, pout)
                corr_all.Add(rib, pout)
                trunk_cl.Add(crv, pout)
                trunk_w_out.Add(tw / lin, pout)   # report in input units
                total_trunk += 1

    lines = ["Component 05 | Corridor Width Pass",
             "Unit system: {}   model-units/input: {:.4f}".format(unit_system, lin),
             "Branch ribbons: {}   Trunk ribbons: {}".format(total_branch, total_trunk),
             "Widths (input units): branch={}  trunk={}..{} (base+{}/room over {})".format(
                 _get("branch_w", 3.0), _get("trunk_base_w", 3.0), _get("trunk_max_w", 8.0),
                 _get("trunk_step", 0.5), _get("trunk_thresh", 4)),
             "Branch/Trunk/Shelf corridors only (stems removed)."]
    return "\n".join(lines)


_do_run = True if ('run' not in globals() or run is None) else bool(run)
if _do_run:
    info = _build()
else:
    info = "Idle: set run=True to build corridors."
# ---------- end comp05_corridorwidth ----------
list_7 = ItemSelector(linetypes_3, {"Model Linetype : (Continuous)"}, selected="Model Linetype : (Continuous)")
panel_39 = Panel(comp05_corridorwidth.out)
crv_13 = Curve(comp05_corridorwidth.branch_corr)
crv_14 = Curve(comp05_corridorwidth.trunk_corr)
crv_15 = Curve(comp05_corridorwidth.corr_all)
crv_16 = Curve(comp05_corridorwidth.branch_cl)
crv_17 = Curve(comp05_corridorwidth.trunk_cl)
panel_40 = Panel(comp05_corridorwidth.info)

curve_preview_7 = CustomCurvePreview(Curve=crv_13, Linetype=list_7, Colour=swatch_6)  # disabled
curve_preview_8 = CustomCurvePreview(Curve=crv_14, Linetype=list_7, Colour=swatch_7)  # disabled
curve_preview_9 = CustomCurvePreview(Curve=crv_16, Linetype=list_5, Colour=swatch_6)  # disabled
curve_preview_10 = CustomCurvePreview(Curve=crv_17, Linetype=list_5, Colour=swatch_7)  # disabled

comp06_doors = Python3Script(
    rooms=rec_10,
    room_uid=txt_14,
    room_dept=int_12,
    access_edge=int_11,
    branch_cl=crv_16,
    trunk_cl=crv_17,
    uids_flat=txt,
    shared=bool,
    adj_source=txt_5,
    adj_target=txt_2,
    unit_system=panel_8,
    run=Toggle(True))  # -> out, doors, corr_doors, direct_doors, door_uid, door_kind, info; inputs rooms: tree of Curve, room_uid: tree of String, room_dept: tree of Int32, access_edge: tree of Int32, branch_cl: tree of Curve, trunk_cl: tree of Curve, uids_flat: list of String, shared: list of Boolean, adj_source: list of String, adj_target: list of String, unit_system: String, wall_tol: Double, door_search: Double, run: Boolean
# ---------- comp06_doors: Python ----------
#! python3
# ==============================================================================
# COMPONENT 06  |  DOOR PASS  (corridor doors + direct-adjacency doors)
# ------------------------------------------------------------------------------
# Rhino 8 / Grasshopper CPython script component.
# Places a door POINT for every room. Two door types:
#
#   CORRIDOR DOOR : at the midpoint of the room wall that fronts a corridor. The
#                   wall is chosen from Comp04's access_edge (authoritative), but
#                   VALIDATED against the nearest corridor: if another corridor is
#                   closer to the building center on a different wall, the door
#                   moves to that wall (favouring interior circulation).
#
#   DIRECT DOOR   : for rooms flagged "Shared Access" in Comp01 (restroom/storage
#                   -> classroom). If the room's adjacency PARENT is a spatial
#                   neighbour (shares a wall), the door goes in that SHARED WALL
#                   and NO corridor door is made -- the room connects directly to
#                   its parent, not the corridor.
#
# Doors are POINTS at the opening midpoint.
#
# ------------------------------------------------------------------------------
# INPUTS
#   rooms       : Curve | Tree | from 04 (room rectangles, per floor)
#   room_uid    : str   | Tree | from 04 room_uid_out
#   room_dept   : int   | Tree | from 04 room_dept_out
#   access_edge : int   | Tree | from 04 (0=+X 1=+Y 2=-X 3=-Y)
#   branch_cl   : Curve | Tree | from 05 branch centerlines
#   trunk_cl    : Curve | Tree | from 05 trunk centerlines
#
#   uids_flat   : str   | List | from 01 'uid'   (index-aligned to shared)
#   shared      : bool  | List | from 01 'shared_out'
#   adj_source  : str   | List | from 01 (edge tails, uid)
#   adj_target  : str   | List | from 01 (edge heads, uid)
#
#   unit_system : str   | Item | "feet" or "meters"
#   wall_tol    : float | Item | max gap to treat two rooms as sharing a wall. Default 1.0
#   door_search : float | Item | max distance from a wall to a corridor to accept it. Default 20.0
#   run         : bool  | Item | solve toggle
#
# ------------------------------------------------------------------------------
# OUTPUTS (GRAFTED PER FLOOR, branch = floor rank)
#   doors       : Point3d | Tree | all door points
#   corr_doors  : Point3d | Tree | corridor doors only
#   direct_doors: Point3d | Tree | direct-adjacency doors only
#   door_uid    : str     | Tree | uid of the room each door serves
#   door_kind   : str     | Tree | "corridor" or "direct"
#   info        : str     | Item | diagnostics
#
# ------------------------------------------------------------------------------
# CONVENTIONS / GOTCHAS
#   - "#! python3" required. Rhino.Geometry throughout. Tree Access on Trees.
#   - shared flag joined by uid from Comp01 (Comp03/04 untouched).
#   - access_edge codes: 0=+X (right) 1=+Y (top) 2=-X (left) 3=-Y (bottom).
#   - A door is a Point3d at the wall midpoint of the chosen edge.
# ==============================================================================

import Rhino
import Rhino.Geometry as rg
import System
import math
from Grasshopper import DataTree
from Grasshopper.Kernel.Data import GH_Path


def _get(name, default):
    return globals()[name] if (name in globals() and globals()[name] is not None) else default


def _unit_scale(sys_name):
    name = (sys_name or "feet").strip().lower()
    src_m = 1.0 if name.startswith("m") else 0.3048
    doc = Rhino.RhinoDoc.ActiveDoc
    try:
        umeters = Rhino.RhinoMath.UnitScale(Rhino.UnitSystem.Meters, doc.ModelUnitSystem)
    except Exception:
        umeters = 1.0
    return src_m * umeters


def _branches(tree):
    out = []
    if tree is None:
        return out
    try:
        paths = list(tree.Paths)
    except Exception:
        return out
    for p in paths:
        out.append((p, list(tree.Branch(p))))
    return out


def _bbox(crv):
    bb = crv.GetBoundingBox(True)
    return bb.Min, bb.Max


def _edge_midpoint(mn, mx, edge):
    """Midpoint of the given edge. 0=+X 1=+Y 2=-X 3=-Y."""
    cx = (mn.X + mx.X) * 0.5
    cy = (mn.Y + mx.Y) * 0.5
    if edge == 0:    # +X (right)
        return rg.Point3d(mx.X, cy, 0.0)
    if edge == 1:    # +Y (top)
        return rg.Point3d(cx, mx.Y, 0.0)
    if edge == 2:    # -X (left)
        return rg.Point3d(mn.X, cy, 0.0)
    return rg.Point3d(cx, mn.Y, 0.0)   # -Y (bottom)


def _all_edge_mids(mn, mx):
    return {e: _edge_midpoint(mn, mx, e) for e in range(4)}


# ---- outputs ---------------------------------------------------------------
doors = DataTree[object]()
corr_doors = DataTree[object]()
direct_doors = DataTree[object]()
door_uid = DataTree[object]()
door_kind = DataTree[object]()
info = ""


def _build():
    unit_system = _get("unit_system", "feet")
    lin = _unit_scale(unit_system)
    wall_tol = float(_get("wall_tol", 1.0)) * lin
    door_search = float(_get("door_search", 20.0)) * lin

    rm_b = _branches(_get("rooms", None))
    if not rm_b:
        return "Waiting: no rooms tree from Component 04."
    ru_b = dict((str(p), v) for p, v in _branches(_get("room_uid", None)))
    ae_b = dict((str(p), v) for p, v in _branches(_get("access_edge", None)))
    bcl_b = dict((str(p), v) for p, v in _branches(_get("branch_cl", None)))
    tcl_b = dict((str(p), v) for p, v in _branches(_get("trunk_cl", None)))

    # flat joins from Comp01
    uids_flat = list(_get("uids_flat", []))
    shared_flat = list(_get("shared", []))
    shared_by_uid = {}
    for i in range(min(len(uids_flat), len(shared_flat))):
        shared_by_uid[uids_flat[i]] = bool(shared_flat[i])
    asrc = list(_get("adj_source", []))
    atgt = list(_get("adj_target", []))
    target_of = {}   # uid -> its adjacency target uid
    for s, t in zip(asrc, atgt):
        target_of[s] = t

    n_corr = 0
    n_direct = 0
    n_shared_no_parent = 0

    for (path, room_list) in rm_b:
        key = str(path)
        rank = path.Indices[0] if path.Indices else 0
        pout = GH_Path(rank)
        n = len(room_list)
        if n == 0:
            continue

        uids = ru_b.get(key, ["?%d" % i for i in range(n)])
        aes = ae_b.get(key, [1] * n)

        # room bboxes + centroid for this floor
        boxes = []
        cxs = []
        cys = []
        for i in range(n):
            mn, mx = _bbox(room_list[i])
            boxes.append((mn, mx))
            cxs.append((mn.X + mx.X) * 0.5)
            cys.append((mn.Y + mx.Y) * 0.5)
        floor_cx = sum(cxs) / n
        floor_cy = sum(cys) / n
        floor_center = rg.Point3d(floor_cx, floor_cy, 0.0)

        # corridor centerlines on this floor (branch + trunk)
        corridors = list(bcl_b.get(key, [])) + list(tcl_b.get(key, []))

        # uid -> room index (for direct-door parent lookup)
        idx_of_uid = {}
        for i in range(n):
            idx_of_uid[uids[i]] = i

        def _nearest_corridor_dist(pt):
            best = None
            for c in corridors:
                cp = c.ClosestPoint(pt, door_search)
                if cp[0]:
                    d = pt.DistanceTo(c.PointAt(cp[1]))
                    if best is None or d < best:
                        best = d
            return best

        for i in range(n):
            mn, mx = boxes[i]
            uid = uids[i]
            is_shared = shared_by_uid.get(uid, False)

            # ---- DIRECT DOOR (shared-access rooms) ------------------------
            if is_shared and uid in target_of:
                parent = target_of[uid]
                if parent in idx_of_uid:
                    pj = idx_of_uid[parent]
                    pmn, pmx = boxes[pj]
                    # find the shared wall: the edge of THIS room closest to the
                    # parent room within wall_tol (overlapping/touching).
                    shared_edge = _shared_wall_edge(mn, mx, pmn, pmx, wall_tol)
                    if shared_edge is not None:
                        dp = _edge_midpoint(mn, mx, shared_edge)
                        doors.Add(dp, pout)
                        direct_doors.Add(dp, pout)
                        door_uid.Add(uid, pout)
                        door_kind.Add("direct", pout)
                        n_direct += 1
                        continue   # shared room done -> no corridor door
                    else:
                        n_shared_no_parent += 1
                        # falls through to corridor door as a fallback

            # ---- CORRIDOR DOOR --------------------------------------------
            # start from access_edge; validate against nearest corridor.
            ae = int(aes[i]) if i < len(aes) else 1
            mids = _all_edge_mids(mn, mx)
            # candidate: access_edge midpoint
            best_edge = ae
            best_pt = mids[ae]
            best_d = _nearest_corridor_dist(best_pt)
            # check the other edges; prefer one whose nearest corridor is closer
            # to the building center AND within door_search.
            for e in range(4):
                pt = mids[e]
                d = _nearest_corridor_dist(pt)
                if d is None:
                    continue
                if best_d is None:
                    best_d, best_edge, best_pt = d, e, pt
                    continue
                # prefer a corridor-adjacent edge; tie-break toward building center
                pt_to_center = pt.DistanceTo(floor_center)
                best_to_center = best_pt.DistanceTo(floor_center)
                if (d < best_d - 1e-6) or (abs(d - best_d) <= 1.0 and pt_to_center < best_to_center):
                    best_d, best_edge, best_pt = d, e, pt

            doors.Add(best_pt, pout)
            corr_doors.Add(best_pt, pout)
            door_uid.Add(uid, pout)
            door_kind.Add("corridor", pout)
            n_corr += 1

    lines = ["Component 06 | Door Pass",
             "Unit system: {}   model-units/input: {:.4f}".format(unit_system, lin),
             "Corridor doors: {}   Direct doors: {}".format(n_corr, n_direct),
             "Shared rooms without adjacent parent (fell back to corridor): {}".format(n_shared_no_parent),
             "Door = point at wall midpoint; access_edge validated vs nearest corridor."]
    return "\n".join(lines)


def _shared_wall_edge(mn, mx, pmn, pmx, tol):
    """Which edge of THIS room (mn,mx) abuts the parent room (pmn,pmx) within tol?
    Returns 0=+X 1=+Y 2=-X 3=-Y or None. Requires overlap along the shared edge."""
    # +X edge touches parent's -X edge
    if abs(mx.X - pmn.X) <= tol and _overlap(mn.Y, mx.Y, pmn.Y, pmx.Y) > 0:
        return 0
    # -X edge touches parent's +X edge
    if abs(mn.X - pmx.X) <= tol and _overlap(mn.Y, mx.Y, pmn.Y, pmx.Y) > 0:
        return 2
    # +Y edge touches parent's -Y edge
    if abs(mx.Y - pmn.Y) <= tol and _overlap(mn.X, mx.X, pmn.X, pmx.X) > 0:
        return 1
    # -Y edge touches parent's +Y edge
    if abs(mn.Y - pmx.Y) <= tol and _overlap(mn.X, mx.X, pmn.X, pmx.X) > 0:
        return 3
    return None


def _overlap(a0, a1, b0, b1):
    """Length of 1D overlap between [a0,a1] and [b0,b1]."""
    return max(0.0, min(a1, b1) - max(a0, b0))


_do_run = True if ('run' not in globals() or run is None) else bool(run)
if _do_run:
    info = _build()
else:
    info = "Idle: set run=True to place doors."
# ---------- end comp06_doors ----------
swatch_8 = ColourSwatch(SwatchColor=RGB(0, 255, 255))
swatch_9 = ColourSwatch(SwatchColor=RGB(0, 34, 255))
panel_41 = Panel(comp06_doors.info)

preview_13 = CustomPreview(Geometry=comp06_doors.corr_doors, Material=swatch_9)  # disabled
preview_14 = CustomPreview(Geometry=comp06_doors.direct_doors, Material=swatch_8)  # disabled
tag_12 = TextTag3D(Location=comp06_doors.corr_doors, Text=comp06_doors.door_kind, Size=1, Justification=8)  # disabled

list_8 = ValueList({"X Axis": 0, "Y Axis": 1}, selected="X Axis")
comp03_tiler_2 = Python3Script(
    centers=match,
    radii=partition_color_4,
    labels=partition_color_3,
    colors=partition_color_2,
    uid_out=partition_color_7,
    dept_out=partition_color_6,
    areas=num,
    uids_flat=txt,
    adj_source=txt_5,
    adj_target=txt_2,
    floor_pref=int_4,
    shared=bool,
    boundary=crv_2,
    unit_system=panel_34,
    n_clusters=Slider(6, range=1..10),
    w_prox=Slider(1, range=0..2.5),
    w_adj=Slider(2.5, range=0..2.5),
    w_dept=Slider(1, range=0..2.5),
    spread_axis=list_8,
    seed=Slider(20, range=0..100),
    run=Toggle(True))  # -> out, rooms, room_lbl, room_uid, room_dept, room_color, cluster_id, access_edge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; inputs centers: tree of Point3d, radii: tree of Double, labels: tree of String, colors: tree of Color, uid_out: tree of String, dept_out: tree of Int32, areas: list of Double, uids_flat: list of String, adj_source: list of String, adj_target: list of String, floor_pref: list of Int32, shared: list of Boolean, boundary: Curve, plate_w: Double, plate_l: Double, floor_efficiency: Double, max_floors: Int32, unit_system: String, n_clusters: Int32, w_prox: Double, w_adj: Double, w_dept: Double, area_tol: Double, channel_gap: Double, room_gap: Double, spread_axis: Int32, floor_gap: Double, kmeans_iters: Int32, seed: Int32, run: Boolean; disabled; same code as comp03_tiler
panel_42 = Panel(comp03_tiler_2.out)
rec_13 = Rectangle(comp03_tiler_2.rooms)
txt_15 = Text(comp03_tiler_2.room_lbl)
panel_43 = Panel(comp03_tiler_2.info)
txt_16 = Text(comp03_tiler_2.room_uid)
rec_14 = Rectangle(comp03_tiler_2.cluster_rect)
rec_15 = Rectangle(comp03_tiler_2.env_rect)
int_14 = Integer(comp03_tiler_2.depts)
int_15 = Integer(comp03_tiler_2.room_dept)
col_6 = Colour(comp03_tiler_2.room_color)
int_16 = Integer(comp03_tiler_2.cluster_id)
int_17 = Integer(comp03_tiler_2.access_edge)
partition_2 = PartitionList(List=txt_16, Size=division_7)
partition_3 = PartitionList(List=int_15, Size=division_7)

# ---- group: Claude Code_V0.3.0 / Color
partition_4 = PartitionList(List=col_6, Size=division_7)

# ---- group: Claude Code_V0.3.0 / Rooms
partition_5 = PartitionList(List=rec_13, Size=division_7)

# ---- group: Claude Code_V0.3.0 / Label
partition_6 = PartitionList(List=txt_15, Size=division_7)

# ---- group: Claude Code_V0.3.0 / Cluster_uid
partition_7 = PartitionList(List=int_16, Size=division_7)

# ---- group: Claude Code_V0.3.0 / env_rect
partition_8 = PartitionList(List=rec_15, Size=1)

# ---- group: Claude Code_V0.3.0
bnd_5 = Bounds(Numbers=flatten(dim_3.UDimension))
debrep = DeconstructBrep(Brep=comp03_tiler_2.env_rect)  # -> Faces, Edges, Vertices
dedomain_5 = DeconstructDomain(Domain=bnd_5)  # -> Start, End
multiplication_4 = Multiplication(A=dedomain_5.End, B=[2, 3.5])
item_8 = ListItem(List=debrep.Edges, Index=3, Wrap=True)
lng_5 = ListLength(List=rec_14)
pt_7 = ConstructPoint(XCoordinate=graft(multiplication_4), YCoordinate=series_3, ZCoordinate=0)  # -> graft(Point)
midpt = CurveMiddle(Curve=item_8)
division_10 = Division(A=lng_5, B=number_slider_13)
vec2pt = Vector2Pt(PointA=midpt, PointB=pt_7, Unitize=False)  # -> Vector, Length
move_8 = Move(Geometry=partition_5, Motion=vec2pt.Vector)  # -> Geometry, Transform
move_9 = Move(Geometry=partition_8, Motion=vec2pt.Vector)  # -> Geometry, Transform
dim_5 = Dimensions(Surface=move_8.Geometry)  # -> UDimension, VDimension
len_6 = TextLength(Text=partition_6)
division_11 = Division(A=dim_5.UDimension, B=len_6)

bnd_6 = Bounds(Numbers=partition_7)
dedomain_6 = DeconstructDomain(Domain=bnd_6)  # -> Start, End
gradient_2 = Gradient(
    LowerLimit=dedomain_6.Start,
    UpperLimit=dedomain_6.End,
    Parameter=partition_7,
    stops=[0: RGB(48, 18, 59), 0.0294: RGB(56, 40, 112), 0.0588: RGB(63, 62, 156), 0.0882: RGB(68, 82, 193), 0.118: RGB(70, 102, 221), 0.147: RGB(71, 122, 241)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])
area_6 = Area(Geometry=move_8.Geometry)  # -> Area, Centroid
boundary_5 = BoundarySurfaces(Edges=move_8.Geometry)

# ---- group: Claude Code_V0.3.0 / Cluster_rect
partition_9 = PartitionList(List=rec_14, Size=division_10)

# ---- group: Claude Code_V0.3.0 (continued)
move_10 = Move(Geometry=partition_9, Motion=vec2pt.Vector)  # -> Geometry, Transform

preview_15 = CustomPreview(Geometry=boundary_5, Material=gradient_2)
preview_16 = CustomPreview(Geometry=move_10.Geometry, Material=swatch_5)
preview_17 = CustomPreview(Geometry=move_9.Geometry, Material=swatch_5)
tag_13 = TextTag3D(Location=area_6.Centroid, Text=partition_6, Size=division_11, Colour=swatch_5, Justification=5)

list_9 = ValueList({"Bubble": "bubble", "Even": "even"}, selected="Bubble")
linetypes_4 = QueryModelLinetypes(AutoUpdateState=True)
comp04_corridororganizer_2 = Python3Script(
    room_uid=partition_2,
    room_dept=partition_3,
    room_color=partition_4,
    lbl_in=partition_6,
    cluster_id=partition_7,
    uids_flat=txt,
    areas=num,
    adj_source=txt_5,
    adj_target=txt_2,
    shared=bool,
    sol_centers=match,
    sol_uid=partition_color_7,
    unit_system=panel_34,
    split_mode=list_9,
    max_aspect=Slider(2, range=0.5..2.5),
    trunk_gap=Slider(8, range=6..10),
    envelope_aspect=Slider(1, range=0.5..3),
    snap_dist=Slider(12, range=8..15),
    spread_axis=list_8,
    run=Toggle(True))  # -> out, rooms, room_lbl, room_uid_out, room_dept_out, room_color_out, cluster_id_out, access_edge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; inputs room_uid: tree of String, room_dept: tree of Int32, room_color: tree of Color, lbl_in: tree of String, cluster_id: tree of Int32, uids_flat: list of String, areas: list of Double, adj_source: list of String, adj_target: list of String, shared: list of Boolean, sol_centers: tree of Point3d, sol_uid: tree of String, unit_system: String, split_mode: String, room_depth: Double, max_aspect: Double, branch_gap: Double, trunk_gap: Double, room_gap: Double, branch_gap_v: Double, envelope_aspect: Double, shelf_gap: Double, big_room_frac: Double, max_corridor_len: Double, break_gap: Double, snap_dist: Double, spread_axis: Int32, floor_gap: Double, run: Boolean; same code as comp04_corridororganizer
list_10 = ItemSelector(linetypes_4, {"Model Linetype : (Continuous)"}, selected="Model Linetype : (Continuous)")
list_11 = ItemSelector(linetypes_4, {"Model Linetype : (Continuous)"}, selected="Model Linetype : (Continuous)")
panel_44 = Panel(comp04_corridororganizer_2.out)
int_18 = Integer(comp04_corridororganizer_2.access_edge)
crv_18 = Curve(comp04_corridororganizer_2.branch_ctr)
col_7 = Colour(comp04_corridororganizer_2.room_color_out)
int_19 = Integer(comp04_corridororganizer_2.trunk_weight)
rec_16 = Rectangle(comp04_corridororganizer_2.cluster_rect_out)
txt_17 = Text(comp04_corridororganizer_2.room_uid_out)
crv_19 = Curve(comp04_corridororganizer_2.trunk_ctr)
rec_17 = Rectangle(comp04_corridororganizer_2.rooms)
txt_18 = Text(comp04_corridororganizer_2.room_lbl)
rec_18 = Rectangle(comp04_corridororganizer_2.env_rect)
panel_45 = Panel(comp04_corridororganizer_2.info)
partition_10 = PartitionList(List=txt_17, Size=division_7)
partition_11 = PartitionList(List=int_18, Size=division_7)
swatch_10 = ColourSwatch(SwatchColor=RGB(0, 34, 255))
swatch_11 = ColourSwatch(SwatchColor=RGB(255, 0, 0))

# ---- group: Claude Code_V0.3.0 / Rooms
partition_12 = PartitionList(List=rec_17, Size=division_7)

# ---- group: Claude Code_V0.3.0 / Room_Lbl
partition_13 = PartitionList(List=txt_18, Size=division_7)

# ---- group: Claude Code_V0.3.0 / env_rect
partition_14 = PartitionList(List=rec_18, Size=1)

# ---- group: Claude Code_V0.3.0
midpt_2 = CurveMiddle(Curve=crv_18)
midpt_3 = CurveMiddle(Curve=crv_19)
lng_6 = ListLength(List=rec_16)
debrep_2 = DeconstructBrep(Brep=rec_18)  # -> Faces, Edges, Vertices
multiplication_5 = Multiplication(A=dedomain_5.End, B=[5, 6.5])
incurve = PointInCurve(Point=flatten(midpt_2), Curve=graft(rec_18))  # -> Relationship, Point
incurve_2 = PointInCurve(Point=flatten(midpt_3), Curve=graft(rec_18))  # -> Relationship, Point
division_12 = Division(A=lng_6, B=number_slider_13)
item_9 = ListItem(List=debrep_2.Edges, Index=3, Wrap=True)
pt_8 = ConstructPoint(XCoordinate=graft(multiplication_5), YCoordinate=series_3, ZCoordinate=0)  # -> graft(Point)
midpt_4 = CurveMiddle(Curve=item_9)
vec2pt_2 = Vector2Pt(PointA=midpt_4, PointB=pt_8, Unitize=False)  # -> Vector, Length
move_11 = Move(Geometry=partition_14, Motion=simplify(vec2pt_2.Vector))  # -> Geometry, Transform
move_12 = Move(Geometry=partition_12, Motion=simplify(vec2pt_2.Vector))  # -> Geometry, Transform
dim_6 = Dimensions(Surface=move_12.Geometry)  # -> UDimension, VDimension
len_7 = TextLength(Text=partition_13)
division_13 = Division(A=dim_6.UDimension, B=len_7)

# ---- group: Claude Code_V0.3.0 / Branch_ctr
dispatch_3 = Dispatch(List=flatten(crv_18), DispatchPattern=incurve.Relationship)  # -> ListA, ListB

# ---- group: Claude Code_V0.3.0 / Trunk_ctr
dispatch_4 = Dispatch(List=flatten(crv_19), DispatchPattern=incurve_2.Relationship)  # -> ListA, ListB

# ---- group: Claude Code_V0.3.0 / cluster_rect
partition_15 = PartitionList(List=rec_16, Size=division_12)

# ---- group: Claude Code_V0.3.0 (continued)
move_13 = Move(Geometry=dispatch_3.ListA, Motion=simplify(vec2pt_2.Vector))  # -> Geometry, Transform
move_14 = Move(Geometry=dispatch_4.ListA, Motion=simplify(vec2pt_2.Vector))  # -> Geometry, Transform
move_15 = Move(Geometry=partition_15, Motion=simplify(vec2pt_2.Vector))  # -> Geometry, Transform

# ---- group: Claude Code_V0.3.0 / Trunk_weight
dispatch_5 = Dispatch(List=flatten(int_19), DispatchPattern=incurve_2.Relationship)  # -> ListA, ListB

# ---- group: Claude Code_V0.3.0 (continued)
boundary_6 = BoundarySurfaces(Edges=move_12.Geometry)
area_7 = Area(Geometry=move_12.Geometry)  # -> Area, Centroid

preview_18 = CustomPreview(Geometry=boundary_6, Material=col_7)
tag_14 = TextTag3D(Location=area_7.Centroid, Text=partition_13, Size=division_13, Colour=swatch_5, Justification=5)
curve_preview_11 = CustomCurvePreview(Curve=move_13.Geometry, Linetype=list_10, Colour=swatch_10)
curve_preview_12 = CustomCurvePreview(Curve=move_14.Geometry, Linetype=list_10, Colour=swatch_11)
curve_preview_13 = CustomCurvePreview(Curve=move_15.Geometry, Linetype=list_11, Colour=gradient_2)
curve_preview_14 = CustomCurvePreview(Curve=move_11.Geometry, Linetype=list_11, Colour=swatch_5)

comp05_corridorwidth_2 = Python3Script(
    branch_ctr=move_13.Geometry,
    trunk_ctr=move_14.Geometry,
    trunk_weight=dispatch_5.ListA,
    rooms=move_12.Geometry,
    room_uid=partition_10,
    access_edge=partition_11,
    unit_system=panel_34,
    run=Toggle(True))  # -> out, branch_corr, trunk_corr, corr_all, branch_cl, trunk_cl, trunk_w_out, n_isolated, info; inputs branch_ctr: tree of Curve, trunk_ctr: tree of Curve, trunk_weight: tree of Int32, rooms: tree of Curve, room_uid: tree of String, access_edge: tree of Int32, unit_system: String, branch_w: Double, trunk_base_w: Double, trunk_step: Double, trunk_thresh: Int32, trunk_max_w: Double, run: Boolean; same code as comp05_corridorwidth
list_12 = ItemSelector(linetypes_4, {"Model Linetype : (Continuous)"}, selected="Model Linetype : (Continuous)")
panel_46 = Panel(comp05_corridorwidth_2.out)
crv_20 = Curve(comp05_corridorwidth_2.branch_corr)
crv_21 = Curve(comp05_corridorwidth_2.trunk_corr)
crv_22 = Curve(comp05_corridorwidth_2.corr_all)
crv_23 = Curve(comp05_corridorwidth_2.branch_cl)
crv_24 = Curve(comp05_corridorwidth_2.trunk_cl)
panel_47 = Panel(comp05_corridorwidth_2.info)

curve_preview_15 = CustomCurvePreview(Curve=crv_20, Linetype=list_12, Colour=swatch_10)
curve_preview_16 = CustomCurvePreview(Curve=crv_21, Linetype=list_12, Colour=swatch_11)
curve_preview_17 = CustomCurvePreview(Curve=crv_23, Linetype=list_10, Colour=swatch_10)
curve_preview_18 = CustomCurvePreview(Curve=crv_24, Linetype=list_10, Colour=swatch_11)
